# Grasshopper definition Data Generation.gh (Grasshopper 1.0.7)
# plug-ins: Anemone, treesloth01

series = Series(Start=0, Step=1, Count="4")
series_2 = Series(Start=0, Step=1, Count="3")
graft = GraftTree(Tree=series_2, IncludeEmptyLists=True, IncludeNullItems=True)
merge = Merge(
    Data1="Run",
    Data2="Length [m]",
    Data3="Width [m]",
    Data4="WWR [/]",
    Data5="Layout [/]",
    Data6="Orientation [/]",
    Data7="Area [m²]",
    Data8="Occupancy [/]",
    Data9="Total [kWh]",
    Data10="Heating [kWh]",
    Data11="Cooling [kWh]",
    Data12="Total_srf [kWh/m²]",
    Data13="Heating_srf [kWh/m²]",
    Data14="Cooling_srf [kWh/m²]",
    Data15="Total_ppl [kWh/capita]",
    Data16="Heating_ppl [kWh/capita]",
    Data17="Cooling_ppl [kWh/capita]")  # -> flatten(Result)
merge_2 = Merge(
    Data1="Run",
    Data2="Length [m]",
    Data3="Width [m]",
    Data4="WWR [/]",
    Data5="Layout [/]",
    Data6="Insulation [/]",
    Data7="Area [m²]",
    Data8="Occupancy [/]",
    Data9="Tot_Embodied Energy [MJ]",
    Data10="Tot_Embodied Energy_srf [MJ/m²]",
    Data11="Tot_Embodied Energy_ppl [MJ/capita]",
    Data12="Tot_Embodied GHG [kg CO2e]",
    Data13="Tot_Embodied GHG_srf [kg CO2e/m²]",
    Data14="Tot_Embodied GHG_ppl [kg CO2e/capita]",
    Data15="Fac_Embodied Energy [MJ]",
    Data16="Fac_Embodied Energy_srf [MJ/m²]",
    Data17="Fac_Embodied Energy_ppl [MJ/capita]",
    Data18="Fac_Embodied GHG [kg CO2e]",
    Data19="Fac_Embodied GHG_srf [kg CO2e/m²]",
    Data20="Fac_Embodied GHG_ppl [kg CO2e/capita]",
    Data21="Floor_Embodied Energy [MJ]",
    Data22="Floor_Embodied Energy_srf [MJ/m²]",
    Data23="Floor_Embodied Energy_ppl [MJ/capita]",
    Data24="Floor_Embodied GHG [kg CO2e]",
    Data25="Floor_Embodied GHG_srf [kg CO2e/m²]",
    Data26="Floor_Embodied GHG_ppl [kg CO2e/capita]",
    Data27="Part_Embodied Energy [MJ]",
    Data28="Part_Embodied Energy_srf [MJ/m²]",
    Data29="Part_Embodied Energy_ppl [MJ/capita]",
    Data30="Part_Embodied GHG [kg CO2e]",
    Data31="Part_Embodied GHG_srf [kg CO2e/m²]",
    Data32="Part_Embodied GHG_ppl [kg CO2e/capita]")  # -> flatten(Result)
merge_3 = Merge(
    Data1="Run",
    Data2="Length [m]",
    Data3="Width [m]",
    Data4="WWR [/]",
    Data5="Layout [/]",
    Data6="Orientation [/]",
    Data7="SDA25 [%]",
    Data8="SDA50 [%]",
    Data9="SDA75 [%]")  # -> flatten(Result)
concat = Concatenate(FragmentA=graft, FragmentC=",", FragmentB=series_2)  # -> simplify(graft(Result))
concat_2 = Concatenate(FragmentA=concat, FragmentC=",", FragmentB=series_2)  # -> simplify(graft(Result))
concat_3 = Concatenate(FragmentA=concat_2, FragmentC=",", FragmentB=series_2)  # -> simplify(graft(Result))
concat_4 = Concatenate(FragmentA=concat_3, FragmentC=",", FragmentB=series)  # -> simplify(graft(Result))
concat_5 = Concatenate(FragmentA=concat_4, FragmentC=",", FragmentB=series_2)  # -> flatten(Result)
lng = ListLength(List=flatten(concat_5))
subtraction = Subtraction(A=lng, B=1)
panel = Panel("3")
panel_2 = Panel(concat_5)
loop_start = LoopStart(N=subtraction, T=Button(), D0=merge_3, D1=merge, D2=merge_2)  # -> port, Counter, Data, Data_2, Data_3
item = ListItem(List=flatten(concat_5), Index=loop_start.Counter, Wrap=True)
split = TextSplit(Text=item, Separators=",")  # -> flatten(Result)
join = TextJoin(Text=split)
panel_3 = Panel(loop_start.Counter)
ground_to_window_height = Slider(1.2, range=0..10)
wwr_1 = Slider(0.3, range=0..1)
wwr_3 = Slider(0.5, range=0..1)
wwr_2 = Slider(0.4, range=0..1)
window_to_ceiling_height = Slider(0.5, range=0..1)
circulation_size = Slider(2, range=0..2)
room_count = Slider(8, range=0..10)
ceiling_height = Slider(3.7, range=2.4..4)
door_height = Slider(2.5, range=2..3)
door_width = Slider(1, range=0.8..1.2)
length_1 = Slider(2.9, range=2..10)
length_3 = Slider(5.4, range=2..10)
width_1 = Slider(3.4, range=2..10)
width_3 = Slider(6.6, range=2..10)
length_2 = Slider(3.6, range=2..10)
width_2 = Slider(5, range=2..10)

# ---- group: Orientation
item_2 = ListItem(List=split, Index="4", Wrap=True)

# ---- group: Insulation
item_3 = ListItem(List=split, Index="5", Wrap=True)

# ---- group: Spatial Distribution
item_4 = ListItem(List=split, Index="3", Wrap=True)

# ----
item_5 = ListItem(List=split, Index="0", Wrap=True)
item_6 = ListItem(List=split, Index="1", Wrap=True)
item_7 = ListItem(List=split, Index="2", Wrap=True)
filter = StreamFilter(Gate=item_7, Stream0=wwr_1, Stream1=wwr_2, Stream2=wwr_3)
filter_2 = StreamFilter(Gate=item_5, Stream0=length_1, Stream1=length_2, Stream2=length_3)
filter_3 = StreamFilter(Gate=item_6, Stream0=width_1, Stream1=width_2, Stream2=width_3)
addition = Addition(A=item_5, B=1)
addition_2 = Addition(A=item_6, B=1)
multiplication = Multiplication(A=addition, B=addition_2, C=room_count, D="2")
merge_4 = Merge(Data1=join, Data2=filter_2, Data3=filter_3, Data4=filter, Data5=item_4, Data6=item_2)
merge_5 = Merge(Data1=join, Data2=filter_2, Data3=filter_3, Data4=filter, Data5=item_4, Data6=item_2)
merge_6 = Merge(Data1=join, Data2=filter_2, Data3=filter_3, Data4=filter, Data5=item_4, Data6=item_3)
multiplication_2 = Multiplication(A=ceiling_height, B=2)
pt = ConstructPoint(XCoordinate=0, YCoordinate=0, ZCoordinate=multiplication_2)
xy = XYPlane(Origin=pt)

series_3 = Series(Start=0, Step=filter_2, Count=room_count)
X = UnitX(Factor=series_3)
rectangle = Rectangle(Plane=xy, XSize=filter_2, YSize=filter_3, Radius=0)  # -> Rectangle, Length
move = Move(Geometry=rectangle.Rectangle, Motion=X)  # -> Geometry, Transform
explode = Explode(Curve=move.Geometry, Recursive=True)  # -> simplify(Segments), simplify(Vertices)

boxrec = BoxRectangle(Rectangle=move.Geometry, Height=ceiling_height)
item_8 = TreeItem(Tree=explode.Vertices, Path="{1}", Index="2", Wrap=True)
item_9 = TreeItem(Tree=explode.Vertices, Path="{0}", Index="0", Wrap=True)
rec_2pt = Rectangle2Pt(Plane=xy, PointA=item_9, PointB=item_8, Radius=0)  # -> Rectangle, Length
item_10 = TreeItem(Tree=explode.Vertices, Path="{0}", Index="0", Wrap=True)
boxrec_2 = BoxRectangle(Rectangle=rec_2pt.Rectangle, Height=ceiling_height)
division = Division(A=circulation_size, B=2)
list = ValueList({"High-density polyethylene (HDPE) film | (kg)": "AU2019_PL00101", "High-density polyethylene (HDPE) film - 100 μm | (m²)": "AU2019_PL00102", "High-density polyethylene (HDPE) film - 200 μm | (m²)": "AU2019_PL00103", "High-density polyethylene (HDPE) pipe | (kg)": "AU2019_PL00201", "High-density polyethylene (HDPE) pipe - 32 mm inner dia., 1.88 mm thick | (m)": "AU2019_PL00202", "High-density polyethylene (HDPE) pipe - 63 mm inner dia., 3.75 mm thick | (m)": "AU2019_PL00203"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}, selected="Polypropylene (PP) sheet | (kg)": "AU2019_PL01201")
addition_3 = Addition(A=filter_3, B=division)
list_2 = ValueList({"Concrete block | (kg)": "AU2019_CP00101", "Concrete block - 390 × 190 × 90 mm | (no.)": "AU2019_CP00102", "Concrete block - 390 × 190 × 140 mm | (no.)": "AU2019_CP00103", "Concrete block - 390 × 190 × 190 mm | (no.)": "AU2019_CP00104", "Cement mortar | (kg)": "AU2019_CP00201", "Portland cement | (kg)": "AU2019_CP00301"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}, selected="Concrete 32 MPa | (m³)": "AU2019_CP00701")
list_3 = ValueList({"Concrete block | (kg)": "AU2019_CP00101", "Concrete block - 390 × 190 × 90 mm | (no.)": "AU2019_CP00102", "Concrete block - 390 × 190 × 140 mm | (no.)": "AU2019_CP00103", "Concrete block - 390 × 190 × 190 mm | (no.)": "AU2019_CP00104", "Cement mortar | (kg)": "AU2019_CP00201", "Portland cement | (kg)": "AU2019_CP00301"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}, selected="Plasterboard - 10 mm | (m²)": "AU2019_CP01301")
list_4 = ValueList({"Concrete block | (kg)": "AU2019_CP00101", "Concrete block - 390 × 190 × 90 mm | (no.)": "AU2019_CP00102", "Concrete block - 390 × 190 × 140 mm | (no.)": "AU2019_CP00103", "Concrete block - 390 × 190 × 190 mm | (no.)": "AU2019_CP00104", "Cement mortar | (kg)": "AU2019_CP00201", "Portland cement | (kg)": "AU2019_CP00301"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}, selected="Fibre cement weatherboard - 300 × 7.5 mm, per square metre of wall | (m²)": "AU2019_CP01006")
list_5 = ValueList({"Concrete block | (kg)": "AU2019_CP00101", "Concrete block - 390 × 190 × 90 mm | (no.)": "AU2019_CP00102", "Concrete block - 390 × 190 × 140 mm | (no.)": "AU2019_CP00103", "Concrete block - 390 × 190 × 190 mm | (no.)": "AU2019_CP00104", "Cement mortar | (kg)": "AU2019_CP00201", "Portland cement | (kg)": "AU2019_CP00301"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}, selected="Concrete block - 390 × 190 × 190 mm | (no.)")
list_6 = ValueList({"Concrete block | (kg)": "AU2019_CP00101", "Concrete block - 390 × 190 × 90 mm | (no.)": "AU2019_CP00102", "Concrete block - 390 × 190 × 140 mm | (no.)": "AU2019_CP00103", "Concrete block - 390 × 190 × 190 mm | (no.)": "AU2019_CP00104", "Cement mortar | (kg)": "AU2019_CP00201", "Portland cement | (kg)": "AU2019_CP00301"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}, selected="Plasterboard - 13 mm | (m²)": "AU2019_CP01302")
list_7 = ValueList({"Aluminium bar | (kg)": "AU2019_ME00101", "Aluminium bar flat - 12 mm × 3 mm | (m)": "AU2019_ME00102", "Aluminium bar flat - 40 mm × 3 mm | (m)": "AU2019_ME00103", "Aluminium bar flat - 100 mm × 6 mm | (m)": "AU2019_ME00104", "Aluminium bar round - 16 mm dia. | (m)": "AU2019_ME00105", "Aluminium bar round - 50 mm dia. | (m)": "AU2019_ME00106"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}, selected="Aluminium extruded square tube - 40 mm, 2 mm thick | (m)": "AU2019_ME00308")
list_8 = ValueList({"Aluminium bar | (kg)": "AU2019_ME00101", "Aluminium bar flat - 12 mm × 3 mm | (m)": "AU2019_ME00102", "Aluminium bar flat - 40 mm × 3 mm | (m)": "AU2019_ME00103", "Aluminium bar flat - 100 mm × 6 mm | (m)": "AU2019_ME00104", "Aluminium bar round - 16 mm dia. | (m)": "AU2019_ME00105", "Aluminium bar round - 50 mm dia. | (m)": "AU2019_ME00106"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}, selected="Steel bar | (kg)": "AU2019_ME01601")
list_9 = ValueList({"Cellulose insulation | (kg)": "AU2019_IN00101", "Cellulose insulation - 80 mm (R2) | (m²)": "AU2019_IN00102", "Cellulose insulation - 100 mm (R2.5) | (m²)": "AU2019_IN00103", "Aluminium foil insulation | (m²)": "AU2019_IN00201", "Glasswool insulation | (kg)": "AU2019_IN00301", "Glasswool insulation - 80 mm (R2) | (m²)": "AU2019_IN00302", "Glasswool insulation - 100 mm (R2.5) | (m²)": "AU2019_IN00303", "Rockwool insulation | (kg)": "AU2019_IN00401", "Rockwool insulation - 80 mm (R2) | (m²)": "AU2019_IN00402", "Rockwool insulation - 100 mm (R2.5) | (m²)": "AU2019_IN00403", "Polystyrene (EPS/XPS) rigid foam insulation | (kg)": "AU2019_IN00501", "Polystyrene (EPS/XPS) rigid foam insulation - 72 mm (R2) | (m²)": "AU2019_IN00502", "Polystyrene (EPS/XPS) rigid foam insulation - 90 mm (R2.5) | (m²)": "AU2019_IN00503", "Polyurethane (PU) rigid foam insulation | (kg)": "AU2019_IN00601", "Polyurethane (PU) rigid foam insulation - 44 mm (R2) | (m²)": "AU2019_IN00602", "Polyurethane (PU) rigid foam insulation - 55 mm (R2.5) | (m²)": "AU2019_IN00603", "Polyester insulation | (kg)": "AU2024_IN00701", "Polyester insulation - 75 mm (R1.5) | (m²)": "AU2024_IN00702", "Polyester insulation - 90 mm (R2.0) | (m²)": "AU2024_IN00703"}, selected="Polystyrene (EPS/XPS) rigid foam insulation - 72 mm (R2) | (m²)")
list_10 = ValueList({"Cellulose insulation | (kg)": "AU2019_IN00101", "Cellulose insulation - 80 mm (R2) | (m²)": "AU2019_IN00102", "Cellulose insulation - 100 mm (R2.5) | (m²)": "AU2019_IN00103", "Aluminium foil insulation | (m²)": "AU2019_IN00201", "Glasswool insulation | (kg)": "AU2019_IN00301", "Glasswool insulation - 80 mm (R2) | (m²)": "AU2019_IN00302", "Glasswool insulation - 100 mm (R2.5) | (m²)": "AU2019_IN00303", "Rockwool insulation | (kg)": "AU2019_IN00401", "Rockwool insulation - 80 mm (R2) | (m²)": "AU2019_IN00402", "Rockwool insulation - 100 mm (R2.5) | (m²)": "AU2019_IN00403", "Polystyrene (EPS/XPS) rigid foam insulation | (kg)": "AU2019_IN00501", "Polystyrene (EPS/XPS) rigid foam insulation - 72 mm (R2) | (m²)": "AU2019_IN00502", "Polystyrene (EPS/XPS) rigid foam insulation - 90 mm (R2.5) | (m²)": "AU2019_IN00503", "Polyurethane (PU) rigid foam insulation | (kg)": "AU2019_IN00601", "Polyurethane (PU) rigid foam insulation - 44 mm (R2) | (m²)": "AU2019_IN00602", "Polyurethane (PU) rigid foam insulation - 55 mm (R2.5) | (m²)": "AU2019_IN00603", "Polyester insulation | (kg)": "AU2024_IN00701", "Polyester insulation - 75 mm (R1.5) | (m²)": "AU2024_IN00702", "Polyester insulation - 90 mm (R2.0) | (m²)": "AU2024_IN00703"}, selected="Rockwool insulation | (kg)")
list_11 = ValueList({"Cellulose insulation | (kg)": "AU2019_IN00101", "Cellulose insulation - 80 mm (R2) | (m²)": "AU2019_IN00102", "Cellulose insulation - 100 mm (R2.5) | (m²)": "AU2019_IN00103", "Aluminium foil insulation | (m²)": "AU2019_IN00201", "Glasswool insulation | (kg)": "AU2019_IN00301", "Glasswool insulation - 80 mm (R2) | (m²)": "AU2019_IN00302", "Glasswool insulation - 100 mm (R2.5) | (m²)": "AU2019_IN00303", "Rockwool insulation | (kg)": "AU2019_IN00401", "Rockwool insulation - 80 mm (R2) | (m²)": "AU2019_IN00402", "Rockwool insulation - 100 mm (R2.5) | (m²)": "AU2019_IN00403", "Polystyrene (EPS/XPS) rigid foam insulation | (kg)": "AU2019_IN00501", "Polystyrene (EPS/XPS) rigid foam insulation - 72 mm (R2) | (m²)": "AU2019_IN00502", "Polystyrene (EPS/XPS) rigid foam insulation - 90 mm (R2.5) | (m²)": "AU2019_IN00503", "Polyurethane (PU) rigid foam insulation | (kg)": "AU2019_IN00601", "Polyurethane (PU) rigid foam insulation - 44 mm (R2) | (m²)": "AU2019_IN00602", "Polyurethane (PU) rigid foam insulation - 55 mm (R2.5) | (m²)": "AU2019_IN00603", "Polyester insulation | (kg)": "AU2024_IN00701", "Polyester insulation - 75 mm (R1.5) | (m²)": "AU2024_IN00702", "Polyester insulation - 90 mm (R2.0) | (m²)": "AU2024_IN00703"}, selected="Cellulose insulation | (kg)")
pt_2 = ConstructPoint(XCoordinate=0, YCoordinate=addition_3, ZCoordinate=0)
list_12 = ValueList({"Asphalt | (kg)": "AU2019_MI00101", "Nylon tufted carpet, average | (m²)": "AU2019_MI00201", "Nylon tufted carpet, prestige | (m²)": "AU2019_MI00202", "Nylon tufted carpet, quality | (m²)": "AU2019_MI00203", "Nylon woven carpet, average | (m²)": "AU2019_MI00204", "Nylon woven carpet, quality | (m²)": "AU2019_MI00205", "Wool tufted carpet, average | (m²)": "AU2019_MI00301", "Wool tufted carpet, prestige | (m²)": "AU2019_MI00302", "Wool tufted carpet, quality | (m²)": "AU2019_MI00303", "Silicone | (kg)": "AU2019_MI00401"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}, selected="Nylon tufted carpet, average | (m²)")
list_13 = ValueList({"Asphalt | (kg)": "AU2019_MI00101", "Nylon tufted carpet, average | (m²)": "AU2019_MI00201", "Nylon tufted carpet, prestige | (m²)": "AU2019_MI00202", "Nylon tufted carpet, quality | (m²)": "AU2019_MI00203", "Nylon woven carpet, average | (m²)": "AU2019_MI00204", "Nylon woven carpet, quality | (m²)": "AU2019_MI00205", "Wool tufted carpet, average | (m²)": "AU2019_MI00301", "Wool tufted carpet, prestige | (m²)": "AU2019_MI00302", "Wool tufted carpet, quality | (m²)": "AU2019_MI00303", "Silicone | (kg)": "AU2019_MI00401"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}, selected="Water-based paint - per square metre | (m²)": "AU2019_MI00902")
list_14 = ValueList({"Asphalt | (kg)": "AU2019_MI00101", "Nylon tufted carpet, average | (m²)": "AU2019_MI00201", "Nylon tufted carpet, prestige | (m²)": "AU2019_MI00202", "Nylon tufted carpet, quality | (m²)": "AU2019_MI00203", "Nylon woven carpet, average | (m²)": "AU2019_MI00204", "Nylon woven carpet, quality | (m²)": "AU2019_MI00205", "Wool tufted carpet, average | (m²)": "AU2019_MI00301", "Wool tufted carpet, prestige | (m²)": "AU2019_MI00302", "Wool tufted carpet, quality | (m²)": "AU2019_MI00303", "Silicone | (kg)": "AU2019_MI00401"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}, selected="Water-based paint - per square metre | (m²)": "AU2019_MI00902")
list_15 = ValueList({"Asphalt | (kg)": "AU2019_MI00101", "Nylon tufted carpet, average | (m²)": "AU2019_MI00201", "Nylon tufted carpet, prestige | (m²)": "AU2019_MI00202", "Nylon tufted carpet, quality | (m²)": "AU2019_MI00203", "Nylon woven carpet, average | (m²)": "AU2019_MI00204", "Nylon woven carpet, quality | (m²)": "AU2019_MI00205", "Wool tufted carpet, average | (m²)": "AU2019_MI00301", "Wool tufted carpet, prestige | (m²)": "AU2019_MI00302", "Wool tufted carpet, quality | (m²)": "AU2019_MI00303", "Silicone | (kg)": "AU2019_MI00401"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}, selected="Water-based paint - per square metre | (m²)": "AU2019_MI00902")
xz = XZPlane(Origin=pt_2)

multiplication_3 = Multiplication(A=ceiling_height, B=filter_2)
subtraction_2 = Subtraction(A=ceiling_height, B=window_to_ceiling_height, C=ground_to_window_height)
multiplication_4 = Multiplication(A=multiplication_3, B=filter)
division_2 = Division(A=multiplication_4, B=subtraction_2)
subtraction_3 = Subtraction(A=filter_2, B=division_2)
division_3 = Division(A=subtraction_3, B=2)
item_11 = ListItem(List=explode.Segments, Index="0", Wrap=True)
X_2 = UnitX(Factor=expr("-X", division_3))
end = EndPoints(Curve=item_11)  # -> Start, End
X_3 = UnitX(Factor=division_3)
move_2 = Move(Geometry=end.End, Motion=X_2)  # -> Geometry, Transform
move_3 = Move(Geometry=end.Start, Motion=X_3)  # -> Geometry, Transform
Z = UnitZ(Factor=ground_to_window_height)
ln = Line(StartPoint=move_3.Geometry, EndPoint=move_2.Geometry)
move_4 = Move(Geometry=ln, Motion=Z)  # -> Geometry, Transform
Z_2 = UnitZ(Factor=subtraction_2)
extr = Extrude(Base=move_4.Geometry, Direction=Z_2)
mirror = Mirror(Geometry=extr, Plane=xz)  # -> Geometry, Transform
merge_7 = Merge(Data1=extr, Data2=mirror.Geometry)

item_12 = ListItem(List=explode.Segments, Index="2", Wrap=True)
X_4 = UnitX(Factor=expr("-X", door_width))
end_2 = EndPoints(Curve=item_12)  # -> Start, End
move_5 = Move(Geometry=end_2.Start, Motion=X_4)  # -> Geometry, Transform
ln_2 = Line(StartPoint=end_2.Start, EndPoint=move_5.Geometry)
Z_3 = UnitZ(Factor=door_height)
extr_2 = Extrude(Base=ln_2, Direction=Z_3)
mirror_2 = Mirror(Geometry=extr_2, Plane=xz)  # -> Geometry, Transform

list_16 = ValueList({"Flat glass double glazing - 4:6:4 | (m²)": "AU2019_GL00101", "Flat glass double glazing - 4:12:4 | (m²)": "AU2019_GL00102", "Flat glass double glazing - 6:6:6 | (m²)": "AU2019_GL00103", "Flat glass double glazing - 6:12:6 | (m²)": "AU2019_GL00104", "Flat glass sheet | (kg)": "AU2019_GL00201", "Flat glass sheet - 3 mm | (m²)": "AU2019_GL00202", "Flat glass sheet - 4 mm | (m²)": "AU2019_GL00203", "Flat glass sheet - 5 mm | (m²)": "AU2019_GL00204", "Flat glass sheet - 6 mm | (m²)": "AU2019_GL00205", "Flat glass sheet - 10 mm | (m²)": "AU2019_GL00206"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}, selected="Flat glass double glazing - 6:12:6 | (m²)")
list_17 = ValueList({"Cork slab | (kg)": "AU2019_TP00101", "Cork slab - 6 mm | (m²)": "AU2019_TP00102", "Cork slab - 10 mm | (m²)": "AU2019_TP00103", "Cork slab - 12 mm | (m²)": "AU2019_TP00104", "Cork slab - 20 mm | (m²)": "AU2019_TP00105", "Cork slab - 50 mm | (m²)": "AU2019_TP00106", "Hardwood, air-dried | (m³)": "AU2019_TP00201", "Hardwood, kiln-dried - dressed | (m³)": "AU2019_TP00202", "Hardwood, kiln-dried - structural | (m³)": "AU2019_TP00203", "Cross laminated timber (CLT) | (m³)": "AU2019_TP00301", "Cross laminated timber (CLT) - 60 mm | (m²)": "AU2019_TP00302", "Cross laminated timber (CLT) - 105 mm | (m²)": "AU2019_TP00303", "Cross laminated timber (CLT) - 175 mm | (m²)": "AU2019_TP00304", "Glued laminated timber, indoor | (m³)": "AU2019_TP00401", "Glued laminated timber, outdoor | (m³)": "AU2019_TP00402", "Laminated veneer lumber (LVL) | (m³)": "AU2019_TP00501", "Medium density fibreboard (MDF) sheet | (m³)": "AU2019_TP00601", "Melamine-coated MDF sheet - 16 mm | (m²)": "AU2019_TP00602", "Melamine-coated MDF sheet - 18 mm | (m²)": "AU2019_TP00603", "Melamine-coated MDF sheet - 25 mm | (m²)": "AU2019_TP00604", "Oriented strand board (OSB) sheet | (m³)": "AU2019_TP00701", "Particleboard, indoor | (m³)": "AU2019_TP00801", "Particleboard, outdoor | (m³)": "AU2019_TP00802", "Plywood, indoor decorative | (m³)": "AU2019_TP00901", "Plywood, outdoor | (m³)": "AU2019_TP00902", "Structural insulated panel (SIP) - 112 mm | (m²)": "AU2019_TP01001", "Structural insulated panel (SIP) - 142 mm | (m²)": "AU2019_TP01002", "Structural insulated panel (SIP) - 162 mm | (m²)": "AU2019_TP01003", "Softwood, air-dried | (m³)": "AU2019_TP01101", "Softwood, kiln-dried | (m³)": "AU2019_TP01102"}, selected="Melamine-coated MDF sheet - 18 mm | (m²)")
list_18 = ValueList({"Cork slab | (kg)": "AU2019_TP00101", "Cork slab - 6 mm | (m²)": "AU2019_TP00102", "Cork slab - 10 mm | (m²)": "AU2019_TP00103", "Cork slab - 12 mm | (m²)": "AU2019_TP00104", "Cork slab - 20 mm | (m²)": "AU2019_TP00105", "Cork slab - 50 mm | (m²)": "AU2019_TP00106", "Hardwood, air-dried | (m³)": "AU2019_TP00201", "Hardwood, kiln-dried - dressed | (m³)": "AU2019_TP00202", "Hardwood, kiln-dried - structural | (m³)": "AU2019_TP00203", "Cross laminated timber (CLT) | (m³)": "AU2019_TP00301", "Cross laminated timber (CLT) - 60 mm | (m²)": "AU2019_TP00302", "Cross laminated timber (CLT) - 105 mm | (m²)": "AU2019_TP00303", "Cross laminated timber (CLT) - 175 mm | (m²)": "AU2019_TP00304", "Glued laminated timber, indoor | (m³)": "AU2019_TP00401", "Glued laminated timber, outdoor | (m³)": "AU2019_TP00402", "Laminated veneer lumber (LVL) | (m³)": "AU2019_TP00501", "Medium density fibreboard (MDF) sheet | (m³)": "AU2019_TP00601", "Melamine-coated MDF sheet - 16 mm | (m²)": "AU2019_TP00602", "Melamine-coated MDF sheet - 18 mm | (m²)": "AU2019_TP00603", "Melamine-coated MDF sheet - 25 mm | (m²)": "AU2019_TP00604", "Oriented strand board (OSB) sheet | (m³)": "AU2019_TP00701", "Particleboard, indoor | (m³)": "AU2019_TP00801", "Particleboard, outdoor | (m³)": "AU2019_TP00802", "Plywood, indoor decorative | (m³)": "AU2019_TP00901", "Plywood, outdoor | (m³)": "AU2019_TP00902", "Structural insulated panel (SIP) - 112 mm | (m²)": "AU2019_TP01001", "Structural insulated panel (SIP) - 142 mm | (m²)": "AU2019_TP01002", "Structural insulated panel (SIP) - 162 mm | (m²)": "AU2019_TP01003", "Softwood, air-dried | (m³)": "AU2019_TP01101", "Softwood, kiln-dried | (m³)": "AU2019_TP01102"}, selected="Softwood, air-dried | (m³)")
list_19 = ValueList({"Cork slab | (kg)": "AU2019_TP00101", "Cork slab - 6 mm | (m²)": "AU2019_TP00102", "Cork slab - 10 mm | (m²)": "AU2019_TP00103", "Cork slab - 12 mm | (m²)": "AU2019_TP00104", "Cork slab - 20 mm | (m²)": "AU2019_TP00105", "Cork slab - 50 mm | (m²)": "AU2019_TP00106", "Hardwood, air-dried | (m³)": "AU2019_TP00201", "Hardwood, kiln-dried - dressed | (m³)": "AU2019_TP00202", "Hardwood, kiln-dried - structural | (m³)": "AU2019_TP00203", "Cross laminated timber (CLT) | (m³)": "AU2019_TP00301", "Cross laminated timber (CLT) - 60 mm | (m²)": "AU2019_TP00302", "Cross laminated timber (CLT) - 105 mm | (m²)": "AU2019_TP00303", "Cross laminated timber (CLT) - 175 mm | (m²)": "AU2019_TP00304", "Glued laminated timber, indoor | (m³)": "AU2019_TP00401", "Glued laminated timber, outdoor | (m³)": "AU2019_TP00402", "Laminated veneer lumber (LVL) | (m³)": "AU2019_TP00501", "Medium density fibreboard (MDF) sheet | (m³)": "AU2019_TP00601", "Melamine-coated MDF sheet - 16 mm | (m²)": "AU2019_TP00602", "Melamine-coated MDF sheet - 18 mm | (m²)": "AU2019_TP00603", "Melamine-coated MDF sheet - 25 mm | (m²)": "AU2019_TP00604", "Oriented strand board (OSB) sheet | (m³)": "AU2019_TP00701", "Particleboard, indoor | (m³)": "AU2019_TP00801", "Particleboard, outdoor | (m³)": "AU2019_TP00802", "Plywood, indoor decorative | (m³)": "AU2019_TP00901", "Plywood, outdoor | (m³)": "AU2019_TP00902", "Structural insulated panel (SIP) - 112 mm | (m²)": "AU2019_TP01001", "Structural insulated panel (SIP) - 142 mm | (m²)": "AU2019_TP01002", "Structural insulated panel (SIP) - 162 mm | (m²)": "AU2019_TP01003", "Softwood, air-dried | (m³)": "AU2019_TP01101", "Softwood, kiln-dried | (m³)": "AU2019_TP01102"}, selected="Softwood, air-dried | (m³)")
list_20 = ValueList({"0: Concrete and plaster products", "1: Glass", "2: Insulation", "3: Metals", "4: Miscellaneous", "5: Plastics", "6: Sand, stone and ceramics", "7: Timber products"}, selected="3: Metals")
list_21 = ValueList({"0: Concrete and plaster products", "1: Glass", "2: Insulation", "3: Metals", "4: Miscellaneous", "5: Plastics", "6: Sand, stone and ceramics", "7: Timber products"}, selected="7: Timber products")
list_22 = ValueList({"0: Concrete and plaster products", "1: Glass", "2: Insulation", "3: Metals", "4: Miscellaneous", "5: Plastics", "6: Sand, stone and ceramics", "7: Timber products"}, selected="7: Timber products")
list_23 = ValueList({"0: Concrete and plaster products", "1: Glass", "2: Insulation", "3: Metals", "4: Miscellaneous", "5: Plastics", "6: Sand, stone and ceramics", "7: Timber products"}, selected="1: Glass")
list_24 = ValueList({"0: Concrete and plaster products", "1: Glass", "2: Insulation", "3: Metals", "4: Miscellaneous", "5: Plastics", "6: Sand, stone and ceramics", "7: Timber products"}, selected="3: Metals")
list_25 = ValueList({"0: Concrete and plaster products", "1: Glass", "2: Insulation", "3: Metals", "4: Miscellaneous", "5: Plastics", "6: Sand, stone and ceramics", "7: Timber products"}, selected="4: Miscellaneous")
list_26 = ValueList({"0: Concrete and plaster products", "1: Glass", "2: Insulation", "3: Metals", "4: Miscellaneous", "5: Plastics", "6: Sand, stone and ceramics", "7: Timber products"}, selected="0: Concrete and plaster products")
list_27 = ValueList({"0: Concrete and plaster products", "1: Glass", "2: Insulation", "3: Metals", "4: Miscellaneous", "5: Plastics", "6: Sand, stone and ceramics", "7: Timber products"}, selected="4: Miscellaneous")
list_28 = ValueList({"0: Concrete and plaster products", "1: Glass", "2: Insulation", "3: Metals", "4: Miscellaneous", "5: Plastics", "6: Sand, stone and ceramics", "7: Timber products"}, selected="7: Timber products")
list_29 = ValueList({"0: Concrete and plaster products", "1: Glass", "2: Insulation", "3: Metals", "4: Miscellaneous", "5: Plastics", "6: Sand, stone and ceramics", "7: Timber products"}, selected="0: Concrete and plaster products")
list_30 = ValueList({"0: Concrete and plaster products", "1: Glass", "2: Insulation", "3: Metals", "4: Miscellaneous", "5: Plastics", "6: Sand, stone and ceramics", "7: Timber products"}, selected="4: Miscellaneous")
list_31 = ValueList({"0: Concrete and plaster products", "1: Glass", "2: Insulation", "3: Metals", "4: Miscellaneous", "5: Plastics", "6: Sand, stone and ceramics", "7: Timber products"}, selected="0: Concrete and plaster products")
list_32 = ValueList({"0: Concrete and plaster products", "1: Glass", "2: Insulation", "3: Metals", "4: Miscellaneous", "5: Plastics", "6: Sand, stone and ceramics", "7: Timber products"}, selected="2: Insulation")
list_33 = ValueList({"0: Concrete and plaster products", "1: Glass", "2: Insulation", "3: Metals", "4: Miscellaneous", "5: Plastics", "6: Sand, stone and ceramics", "7: Timber products"}, selected="2: Insulation")
list_34 = ValueList({"0: Concrete and plaster products", "1: Glass", "2: Insulation", "3: Metals", "4: Miscellaneous", "5: Plastics", "6: Sand, stone and ceramics", "7: Timber products"}, selected="2: Insulation")
list_35 = ValueList({"0: Concrete and plaster products", "1: Glass", "2: Insulation", "3: Metals", "4: Miscellaneous", "5: Plastics", "6: Sand, stone and ceramics", "7: Timber products"}, selected="0: Concrete and plaster products")
list_36 = ValueList({"0: Concrete and plaster products", "1: Glass", "2: Insulation", "3: Metals", "4: Miscellaneous", "5: Plastics", "6: Sand, stone and ceramics", "7: Timber products"}, selected="5: Plastics")
list_37 = ValueList({"0: Concrete and plaster products", "1: Glass", "2: Insulation", "3: Metals", "4: Miscellaneous", "5: Plastics", "6: Sand, stone and ceramics", "7: Timber products"}, selected="0: Concrete and plaster products")
list_38 = ValueList({"0: Concrete and plaster products", "1: Glass", "2: Insulation", "3: Metals", "4: Miscellaneous", "5: Plastics", "6: Sand, stone and ceramics", "7: Timber products"}, selected="4: Miscellaneous")
mirror_3 = Mirror(Geometry=explode.Vertices, Plane=xz)  # -> Geometry, Transform
mirror_4 = Mirror(Geometry=boxrec, Plane=xz)  # -> Geometry, Transform
epic_material = EPiCMaterial(
    Connect_Toggle_Switch_to_Activate=Toggle(True),
    Material_Category=list_32,
    Selected_Material=list_9,
    Wastage_Coefficient=Slider(10, range=0..100),
    Material_Service_Life__Years=Slider(30, range=0..100))  # -> EPiC_Material, port, Embodied_Energy_Coefficient__MJ_FU, Embodied_Water_Coefficient__L_FU, Embodied_GHG_Coefficient__kgCO₂e_FU, port_2, DOI, Density__kg_m³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; inputs Material_Category: list, Comments: list
# ---------- epic_material: Python ----------
# -*- coding: UTF-8 -*-
# EPiC Grasshopper: A Plugin for analysing embodied environmental flows
#
# Copyright (c) 2023, EPiC Grasshopper.
# You should have received a copy of the GNU General Public License
# along with EPiC Grasshopper; If not, see <http://www.gnu.org/licenses/>.
#
# Further information about the EPiC Database can be found at <https://bit.ly/EPiC_Database>
# To download a full copy of the database, goto <http://doi.org/10.26188/5dc228ef98c5a>
#
# @license GPL-3.0+ <http://spdx.org/licenses/GPL-3.0+>

"""
Select a material from the EPiC Database

    Inputs:
        >>**Connect_Toggle_Switch_to_Activate: Connect a toggle switch and set to 'True' to activate this component.
        (**REQUIRED)

        **Material_Category: Once the EPiC Material component has been activated,
        a value list will be automatically generated with pre-filled categories wired to this input.
        *** To reset this input, delete any connected wires, and re-activate the button ***

        **Selected_Material: Once the EPiC Material component has been activated,
        a value list will be automatically generated with pre-filled materials, based on the selected category (above).
        *** To reset this input, delete any connected wires, and re-activate the button ***

        Wastage_Coefficient_(%): Estimated wastage percentage (%) for the material.
        This will use the default value for the material (if it exists in the database), otherwise it will default to 0.
        0 indicates no wastage, 100 indicates 100% wastage.
        ***Optional***

        Material_Service_Life_(Years): Estimated service_life (in years) for the material.
        This will use the default value for the material (if it exists in the database), otherwise it will default to 0.
        0 indicates that the material will never need to be replaced.
        ***Optional***

        Energy_Reduction_Factor_(%): Reduce the value of the energy coefficient by a percentage
        0(%) indicates no change, 50(%) half of the value, and 100(%) reduces the energy coefficient to zero
        ***Optional***

        Water_Reduction_Factor_(%): Reduce the value of the water coefficient by a percentage
        0(%) indicates no change, 50(%) half of the value, and 100(%) reduces the water coefficient to zero
        ***Optional***

        GHG_Reduction_Factor_(%): Reduce the value of the GHG emissions coefficient by a percentage
        0(%) indicates no change, 50(%) half of the value, and 100(%) reduces the GHG emissions coefficient to zero
        ***Optional***
        Comments: Comments about the material - these will appear in the printed/exported reports.
        ***Optional***

        >>Connect_Toggle_Switch_to_Open_EPiC_Database: Connect a toggle switch and set to True.
        This will open https://bit.ly/EPiC_Database in a web browser

    Outputs:
        EPiC_Material: Outputs a class object (EPiCMaterial) containing all of the embedded material attributes:
        (name, energy, water, ghg, functional_unit, doi, category, material_id, wastage, service_life, comments)
        ***Connect that output to a panel for a summary***

        Embodied_Energy_Coefficient_(MJ/FU): The Embodied Energy Coefficient for this material.
        Values are imported from the EPiC Database
        ***Note this does not include wastage in the calculation***

        Embodied_Water_Coefficient_(L/FU): The Embodied Water Coefficient for this material.
        Values are imported from the EPiC Database.
        ***Note this does not include wastage in the calculation***

        Embodied_GHG_Coefficient_(kgCO₂e/FU): The Embodied Greenhouse Gas Emissions Coefficient for this material.
        Values are imported from the EPiC Database.
        ***Note this does not include wastage in the calculation***

        Digital Object Identifier (DOI): A link to the material information sheet in the EPiC Database

        Density_(kg/m³): Material density, as provided in the EPiC Database

        Functional_Unit: Functional Unit, as provided in the EPiC Database

        Wastage_Coefficient_(%): Estimated wastage percentage (%) for the material.
        This will use the default value for the material (if it exists in the database), otherwise it will default to 0.
        0 indicates no wastage, 100 indicates 100% wastage

        Material_Service_Life_(Years): Estimated service_life (in years) for the material.
        This will use the default value for the material (if it exists in the database), otherwise it will default to 0.
        0 indicates that the material will never need to be replaced

        Disclaimer: Disclaimer of the authors associated with the use of the EPiC Grasshopper plugin
"""

import webbrowser
from Grasshopper.Kernel.Special import GH_NumberSlider
from Grasshopper import Folders
from Grasshopper.Kernel import GH_RuntimeMessageLevel as RML
from ghpythonlib.componentbase import executingcomponent as component
from scriptcontext import sticky as st

import epic

# Allow realtime feedback with external python files in grasshopper
epic = reload(epic)


class EPiCMaterialComponent(component):

    def RunScript(self,
                  connect_button,
                  material_category,
                  material_id,
                  comments,
                  _null,
                  wastage,
                  service_life,
                  _null2,
                  energy_reduction,
                  water_reduction,
                  ghg_reduction,
                  _null3,
                  epic_help):

        # Component and version information
        __author__ = epic.__author__
        __version__ = "1.02"
        if __version__ == epic.__version__:
            ghenv.Component.Message = epic.__message__
        else:
            ghenv.Component.Message = epic.version_mismatch(__version__)
            ghenv.Component.AddRuntimeMessage(RML.Remark, ghenv.Component.Message)
        ghenv.Component.Name = "EPiC Material"
        ghenv.Component.NickName = "EPiC Material"

        # Setup a global sticky variable for the component, ensuring sliders component are not continuously generated.
        component_id = ghenv.Component.InstanceGuid
        if component_id not in st:
            st[component_id] = material_id

        # Open the EPiC Database or EPiC Grasshopper Bugs / Suggestions Google Form
        if epic_help:
            webbrowser.open("https://bit.ly/EPiC_Database", new=1)

        # Specify the directory where the EPiC Database is stored (usually the grasshopper library folder), only load once into sticky dictionary
        if 'epic_db' not in st:
            st['epic_db'] = epic.EPiCDatabase(Folders.DefaultAssemblyFolder)
        epic_db = st['epic_db']

        if material_category:
            if isinstance(material_category, list):
                material_category = material_category[0]
            if ':' in material_category:
                material_category = material_category.split(': ')[1]

        # Generate a material and category list when button is turned on
        if connect_button:
            if not material_id or not material_category:
                if material_category:
                    epic.EPiCMaterial.generate_material_and_category_dropdown_list(ghenv.Component, ghenv, epic_db,
                                                                                   category=material_category)
                else:
                    epic.EPiCMaterial.generate_material_and_category_dropdown_list(ghenv.Component, ghenv, epic_db)
                # Reset the global sticky value
                st[component_id] = None

        # Make sure that a material category & material have been selected
        if material_id and material_category:

            # Flatten material category list and remove number from start of string

            # Test if the selected material is in the selected category
            if material_id not in epic_db.dict_of_categories[material_category]:
                
                # Test if material is in old database
                legacy_material = epic_db._query_for_name_or_old_mat_id(material_id)
                if legacy_material:
                    material_id = legacy_material
                    ghObject = ghenv.Component.Params.Input[2].Sources[0]
                    epic.EPiCMaterial.recreate_material_list(epic_db, ghObject, material_category, ghenv.Component, set_material=material_id)
                else:
                    ghObject = ghenv.Component.Params.Input[2].Sources[0]
                    epic.EPiCMaterial.recreate_material_list(epic_db, ghObject, material_category, ghenv.Component)
            # Load the material values from the database
            energy, water, ghg, functional_unit, name, doi, category, density = \
                epic_db.query(material_id, ['Energy', 'Water', 'GHG', 'Functional Unit', 'name',
                                            'DOI', 'Category', 'Density'])
            process_shares = {flow: epic_db.query(material_id, 'hybrid_process_proportion_' + str(flow)) for
                              flow in epic.DEFINED_FLOWS.keys()}

            # Only run this code if the material selection has changed. Uses global sticky to track material choice.
            if material_id != st[component_id]:
                # Fetch the wastage/service life coefficient from the EPiCDB (if exists)
                try:
                    # In db, wastage coefficient of 1 = 0%, 1.1 = 10%. Scale accordingly
                    # In db, service life of -1 = no service life.
                    epic_wastage = (epic_db.query(material_id, 'Wastage') - 1) * 100
                    epic_service_life = (epic_db.query(material_id, 'Service Life'))
                    if epic_service_life == -1 or not epic_service_life:
                        epic_service_life = 0
                except TypeError:
                    epic_wastage = 0
                    epic_service_life = 0

                # Generate a slider input and set wastage/service life. If one already exists, change the value to new material.
                for input in [(5, epic_wastage), (6, epic_service_life)]:
                    if not ghenv.Component.Params.Input[input[0]].Sources:
                        epic.EPiCMaterial.generate_slider_input(ghenv.Component, None, input[1], input[0])
                    else:
                        list_object = ghenv.Component.Params.Input[input[0]].Sources[0]
                        # Only change value if input is a number slider, otherwise leave untouched
                        if isinstance(list_object, GH_NumberSlider):
                            ghenv.Component.OnPingDocument().ScheduleSolution(5,
                                                                              ScheduleCallback(list_object, input[1]))

                # Reset global sticky value to the current material selection choice
                st[component_id] = material_id

            # Include reduction factor for materials
            if water and ghg and energy:
                energy = energy if not energy_reduction and energy_reduction != 0 \
                    else energy / 100 * abs(100 - energy_reduction)
                water = water if not water_reduction and water_reduction != 0 else water / 100 * abs(
                    100 - water_reduction)
                ghg = ghg if not ghg_reduction and ghg_reduction != 0 else ghg / 100 * abs(100 - ghg_reduction)

            # Create the EPiCMaterial class object
            output_epic_material = epic.EPiCMaterial(name=name, water=water, ghg=ghg, energy=energy,
                                                     functional_unit=functional_unit, doi=doi, category=category,
                                                     material_id=material_id, wastage=wastage,
                                                     service_life=service_life,
                                                     comments=comments,
                                                     density=density,
                                                     process_shares=process_shares)

            # Component outputs
            return output_epic_material, None, output_epic_material.energy, output_epic_material.water, \
                output_epic_material.ghg, None, output_epic_material.doi, output_epic_material.density, \
                output_epic_material.functional_unit, wastage, service_life, epic.DISCLAIMER

        # Raise error when there is no material and category selected
        else:
            warning = 'Connect a button to the first input, and activate to generate a material & category list'
            ghenv.Component.AddRuntimeMessage(RML.Warning, warning)
            return [warning] * 11 + [epic.DISCLAIMER]


def ScheduleCallback(obj, val=0):
    if val:
        if val > 100:
            obj.Slider.Maximum = val
        obj.Slider.Value = val
# ---------- end epic_material ----------
epic_material_2 = EPiCMaterial(
    Connect_Toggle_Switch_to_Activate=Toggle(True),
    Material_Category=list_31,
    Selected_Material=list_4,
    Wastage_Coefficient=Slider(5, range=0..100),
    Material_Service_Life__Years=Slider(30, range=0..100))  # -> EPiC_Material, port, Embodied_Energy_Coefficient__MJ_FU, Embodied_Water_Coefficient__L_FU, Embodied_GHG_Coefficient__kgCO₂e_FU, port_2, DOI, Density__kg_m³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; inputs Material_Category: list, Comments: list; same code as epic_material
epic_material_3 = EPiCMaterial(
    Connect_Toggle_Switch_to_Activate=Toggle(True),
    Material_Category=list_33,
    Selected_Material=list_10,
    Wastage_Coefficient=Slider(10, range=0..100),
    Material_Service_Life__Years=Slider(50, range=0..100))  # -> EPiC_Material, port, Embodied_Energy_Coefficient__MJ_FU, Embodied_Water_Coefficient__L_FU, Embodied_GHG_Coefficient__kgCO₂e_FU, port_2, DOI, Density__kg_m³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; inputs Material_Category: list, Comments: list; same code as epic_material
epic_material_4 = EPiCMaterial(
    Connect_Toggle_Switch_to_Activate=Toggle(True),
    Material_Category=list_37,
    Selected_Material=list_6,
    Wastage_Coefficient=Slider(5, range=0..100),
    Material_Service_Life__Years=Slider(35, range=0..100))  # -> EPiC_Material, port, Embodied_Energy_Coefficient__MJ_FU, Embodied_Water_Coefficient__L_FU, Embodied_GHG_Coefficient__kgCO₂e_FU, port_2, DOI, Density__kg_m³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; inputs Material_Category: list, Comments: list; same code as epic_material
epic_material_5 = EPiCMaterial(
    Connect_Toggle_Switch_to_Activate=Toggle(True),
    Material_Category=list_34,
    Selected_Material=list_11,
    Wastage_Coefficient=Slider(10, range=0..100),
    Material_Service_Life__Years=Slider(30, range=0..100))  # -> EPiC_Material, port, Embodied_Energy_Coefficient__MJ_FU, Embodied_Water_Coefficient__L_FU, Embodied_GHG_Coefficient__kgCO₂e_FU, port_2, DOI, Density__kg_m³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; inputs Material_Category: list, Comments: list; same code as epic_material
epic_material_6 = EPiCMaterial(
    Connect_Toggle_Switch_to_Activate=Toggle(True),
    Material_Category=list_36,
    Selected_Material=list,
    Wastage_Coefficient=Slider(5, range=0..100),
    Material_Service_Life__Years=Slider(70, range=0..100))  # -> EPiC_Material, port, Embodied_Energy_Coefficient__MJ_FU, Embodied_Water_Coefficient__L_FU, Embodied_GHG_Coefficient__kgCO₂e_FU, port_2, DOI, Density__kg_m³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; inputs Material_Category: list, Comments: list; same code as epic_material
epic_material_7 = EPiCMaterial(
    Connect_Toggle_Switch_to_Activate=Toggle(True),
    Material_Category=list_38,
    Selected_Material=list_15,
    Wastage_Coefficient=Slider(5, range=0..100),
    Material_Service_Life__Years=Slider(10, range=0..100))  # -> EPiC_Material, port, Embodied_Energy_Coefficient__MJ_FU, Embodied_Water_Coefficient__L_FU, Embodied_GHG_Coefficient__kgCO₂e_FU, port_2, DOI, Density__kg_m³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; inputs Material_Category: list, Comments: list; same code as epic_material
epic_material_8 = EPiCMaterial(
    Connect_Toggle_Switch_to_Activate=Toggle(True),
    Material_Category=list_35,
    Selected_Material=list_5,
    Wastage_Coefficient=Slider(5, range=0..100),
    Material_Service_Life__Years=Slider(70, range=0..100))  # -> EPiC_Material, port, Embodied_Energy_Coefficient__MJ_FU, Embodied_Water_Coefficient__L_FU, Embodied_GHG_Coefficient__kgCO₂e_FU, port_2, DOI, Density__kg_m³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; inputs Material_Category: list, Comments: list; same code as epic_material
epic_material_9 = EPiCMaterial(
    Connect_Toggle_Switch_to_Activate=Toggle(True),
    Material_Category=list_21,
    Selected_Material=list_17,
    Wastage_Coefficient=Slider(5, range=0..100),
    Material_Service_Life__Years=Slider(30, range=0..100))  # -> EPiC_Material, port, Embodied_Energy_Coefficient__MJ_FU, Embodied_Water_Coefficient__L_FU, Embodied_GHG_Coefficient__kgCO₂e_FU, port_2, DOI, Density__kg_m³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; inputs Material_Category: list, Comments: list; same code as epic_material
epic_material_10 = EPiCMaterial(
    Connect_Toggle_Switch_to_Activate=Toggle(True),
    Material_Category=list_22,
    Selected_Material=list_18,
    Wastage_Coefficient=Slider(2, range=0..100),
    Material_Service_Life__Years=Slider(30, range=0..100))  # -> EPiC_Material, port, Embodied_Energy_Coefficient__MJ_FU, Embodied_Water_Coefficient__L_FU, Embodied_GHG_Coefficient__kgCO₂e_FU, port_2, DOI, Density__kg_m³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; inputs Material_Category: list, Comments: list; same code as epic_material
epic_material_11 = EPiCMaterial(
    Connect_Toggle_Switch_to_Activate=Toggle(True),
    Material_Category=list_23,
    Selected_Material=list_16,
    Wastage_Coefficient=Slider(3, range=0..100),
    Material_Service_Life__Years=Slider(25, range=0..100))  # -> EPiC_Material, port, Embodied_Energy_Coefficient__MJ_FU, Embodied_Water_Coefficient__L_FU, Embodied_GHG_Coefficient__kgCO₂e_FU, port_2, DOI, Density__kg_m³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; inputs Material_Category: list, Comments: list; same code as epic_material
epic_material_12 = EPiCMaterial(
    Connect_Toggle_Switch_to_Activate=Toggle(True),
    Material_Category=list_24,
    Selected_Material=list_7,
    Wastage_Coefficient=Slider(5, range=0..100),
    Material_Service_Life__Years=Slider(60, range=0..100))  # -> EPiC_Material, port, Embodied_Energy_Coefficient__MJ_FU, Embodied_Water_Coefficient__L_FU, Embodied_GHG_Coefficient__kgCO₂e_FU, port_2, DOI, Density__kg_m³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; inputs Material_Category: list, Comments: list; same code as epic_material
epic_material_13 = EPiCMaterial(
    Connect_Toggle_Switch_to_Activate=Toggle(True),
    Material_Category=list_20,
    Selected_Material=list_8,
    Wastage_Coefficient=Slider(5, range=0..100),
    Material_Service_Life__Years=Slider(70, range=0..100))  # -> EPiC_Material, port, Embodied_Energy_Coefficient__MJ_FU, Embodied_Water_Coefficient__L_FU, Embodied_GHG_Coefficient__kgCO₂e_FU, port_2, DOI, Density__kg_m³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; inputs Material_Category: list, Comments: list; same code as epic_material
epic_material_14 = EPiCMaterial(
    Connect_Toggle_Switch_to_Activate=Toggle(True),
    Material_Category=list_28,
    Selected_Material=list_19,
    Wastage_Coefficient=Slider(2, range=0..100),
    Material_Service_Life__Years=Slider(30, range=0..100))  # -> EPiC_Material, port, Embodied_Energy_Coefficient__MJ_FU, Embodied_Water_Coefficient__L_FU, Embodied_GHG_Coefficient__kgCO₂e_FU, port_2, DOI, Density__kg_m³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; inputs Material_Category: list, Comments: list; same code as epic_material
epic_material_15 = EPiCMaterial(
    Connect_Toggle_Switch_to_Activate=Toggle(True),
    Material_Category=list_29,
    Selected_Material=list_3,
    Wastage_Coefficient=Slider(5, range=0..100),
    Material_Service_Life__Years=Slider(35, range=0..100))  # -> EPiC_Material, port, Embodied_Energy_Coefficient__MJ_FU, Embodied_Water_Coefficient__L_FU, Embodied_GHG_Coefficient__kgCO₂e_FU, port_2, DOI, Density__kg_m³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; inputs Material_Category: list, Comments: list; same code as epic_material
epic_material_16 = EPiCMaterial(
    Connect_Toggle_Switch_to_Activate=Toggle(True),
    Material_Category=list_30,
    Selected_Material=list_14,
    Wastage_Coefficient=Slider(5, range=0..100),
    Material_Service_Life__Years=Slider(10, range=0..100))  # -> EPiC_Material, port, Embodied_Energy_Coefficient__MJ_FU, Embodied_Water_Coefficient__L_FU, Embodied_GHG_Coefficient__kgCO₂e_FU, port_2, DOI, Density__kg_m³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; inputs Material_Category: list, Comments: list; same code as epic_material
epic_material_17 = EPiCMaterial(
    Connect_Toggle_Switch_to_Activate=Toggle(True),
    Material_Category=list_25,
    Selected_Material=list_12,
    Wastage_Coefficient=Slider(5, range=0..100),
    Material_Service_Life__Years=Slider(10, range=0..100))  # -> EPiC_Material, port, Embodied_Energy_Coefficient__MJ_FU, Embodied_Water_Coefficient__L_FU, Embodied_GHG_Coefficient__kgCO₂e_FU, port_2, DOI, Density__kg_m³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; inputs Material_Category: list, Comments: list; same code as epic_material
epic_material_18 = EPiCMaterial(
    Connect_Toggle_Switch_to_Activate=Toggle(True),
    Material_Category=list_26,
    Selected_Material=list_2,
    Wastage_Coefficient=Slider(15, range=0..100),
    Material_Service_Life__Years=Slider(70, range=0..100))  # -> EPiC_Material, port, Embodied_Energy_Coefficient__MJ_FU, Embodied_Water_Coefficient__L_FU, Embodied_GHG_Coefficient__kgCO₂e_FU, port_2, DOI, Density__kg_m³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; inputs Material_Category: list, Comments: list; same code as epic_material
epic_material_19 = EPiCMaterial(
    Connect_Toggle_Switch_to_Activate=Toggle(True),
    Material_Category=list_27,
    Selected_Material=list_13,
    Wastage_Coefficient=Slider(5, range=0..100),
    Material_Service_Life__Years=Slider(10, range=0..100))  # -> EPiC_Material, port, Embodied_Energy_Coefficient__MJ_FU, Embodied_Water_Coefficient__L_FU, Embodied_GHG_Coefficient__kgCO₂e_FU, port_2, DOI, Density__kg_m³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; inputs Material_Category: list, Comments: list; same code as epic_material

subtraction_4 = Subtraction(A=room_count, B=1)
concat_6 = Concatenate(FragmentA="{", FragmentB=subtraction_4, FragmentC="}")
item_13 = TreeItem(Tree=explode.Vertices, Path=concat_6, Index="2", Wrap=True)
item_14 = TreeItem(Tree=mirror_3.Geometry, Path="{0}", Index="0", Wrap=True)
rec_2pt_2 = Rectangle2Pt(Plane=xy, PointA=item_14, PointB=item_13, Radius=0)  # -> Rectangle, Length
split_2 = SplitList(List=flatten(extr_2), Index="1")  # -> ListA, ListB
split_3 = SplitList(List=boxrec, Index="2")  # -> ListA, ListB
area = Area(Geometry=rec_2pt_2.Rectangle)  # -> Area, Centroid
boxrec_3 = BoxRectangle(Rectangle=rec_2pt_2.Rectangle, Height=ceiling_height)
merge_8 = Merge(Data1=flatten(boxrec_2), Data2=flatten(split_3.ListB))
xz_2 = XZPlane(Origin=area.Centroid)
mirror_5 = Mirror(Geometry=boxrec_3, Plane=xz_2)  # -> Geometry, Transform
open_space = Data(mirror_5.Geometry)
rooms = Data(merge_8)
doors = Data(split_2.ListB)

item_15 = TreeItem(Tree=mirror_3.Geometry, Path=concat_6, Index="1", Wrap=True)
cluster = Cluster_3(A=ceiling_height, A_3=ceiling_height, F=ceiling_height, P=xy, A_2=item_10, B=item_15)  # -> R_2, R
floor = Data(cluster.R)
srf = Surface(floor)
area_2 = Area(Geometry=srf)  # -> Area, Centroid
area_3 = Area(Geometry=doors)  # -> Area, Centroid
mm = MassMultiplication(Input=area_3.Area)  # -> Result, PartialResults

lng_2 = ListLength(List=boxrec)
division_4 = Division(A=lng_2, B=2)
concat_7 = Concatenate(FragmentA="{", FragmentB=division_4, FragmentC="}")
concat_8 = Concatenate(FragmentA="{", FragmentB=division_4, FragmentC="}")
item_16 = TreeItem(Tree=explode.Vertices, Path="{0}", Index="3", Wrap=True)
item_17 = TreeItem(Tree=mirror_3.Geometry, Path=concat_8, Index="3", Wrap=True)
item_18 = TreeItem(Tree=explode.Vertices, Path=concat_7, Index="0", Wrap=True)
item_19 = TreeItem(Tree=mirror_3.Geometry, Path=concat_6, Index="1", Wrap=True)
split_4 = SplitList(List=flatten(extr_2), Index=division_4)  # -> ListA, ListB
split_5 = SplitList(List=flatten(mirror_2.Geometry), Index=division_4)  # -> ListA, ListB
split_6 = SplitList(List=mirror_4.Geometry, Index=division_4)  # -> ListA, ListB
split_7 = SplitList(List=boxrec, Index=division_4)  # -> ListA, ListB
rec_2pt_3 = Rectangle2Pt(Plane=xy, PointA=item_18, PointB=item_19, Radius=0)  # -> Rectangle, Length
rec_2pt_4 = Rectangle2Pt(Plane=xy, PointA=item_16, PointB=item_17, Radius=0)  # -> Rectangle, Length
data = Data(split_5.ListA)
split_8 = SplitList(List=split_7.ListA, Index="2")  # -> ListA, ListB
split_9 = SplitList(List=split_4.ListA, Index="1")  # -> ListA, ListB
boxrec_4 = BoxRectangle(Rectangle=rec_2pt_3.Rectangle, Height=ceiling_height)
boxrec_5 = BoxRectangle(Rectangle=rec_2pt_4.Rectangle, Height=ceiling_height)
merge_9 = Merge(Data1=flatten(boxrec_2), Data2=flatten(split_8.ListB), Data3=flatten(split_6.ListA))
merge_10 = Merge(Data1=flatten(split_9.ListB), Data2=flatten(data))

lng_3 = ListLength(List=boxrec)
subtraction_5 = Subtraction(A=lng_3, B=1)
concat_9 = Concatenate(FragmentA="{", FragmentB=subtraction_5, FragmentC="}")
item_20 = TreeItem(Tree=mirror_3.Geometry, Path=concat_9, Index="2", Wrap=True)
item_21 = TreeItem(Tree=mirror_3.Geometry, Path="{0}", Index="0", Wrap=True)
division_5 = Division(A=lng_3, B=2)
concat_10 = Concatenate(FragmentA="{", FragmentB=division_5, FragmentC="}")
concat_11 = Concatenate(FragmentA="{", FragmentB=division_5, FragmentC="}")
item_22 = TreeItem(Tree=explode.Vertices, Path=concat_11, Index="3", Wrap=True)
item_23 = TreeItem(Tree=explode.Vertices, Path=concat_10, Index="0", Wrap=True)
split_10 = SplitList(List=boxrec, Index=division_5)  # -> ListA, ListB
split_11 = SplitList(List=flatten(extr_2), Index=division_5)  # -> ListA, ListB
split_12 = SplitList(List=flatten(mirror_2.Geometry), Index=division_5)  # -> ListA, ListB
rec_2pt_5 = Rectangle2Pt(Plane=xy, PointA=item_21, PointB=item_22, Radius=0)  # -> Rectangle, Length
split_13 = SplitList(List=mirror_4.Geometry, Index=division_5)  # -> ListA, ListB
rec_2pt_6 = Rectangle2Pt(Plane=xy, PointA=item_23, PointB=item_20, Radius=0)  # -> Rectangle, Length
split_14 = SplitList(List=split_11.ListA, Index="1")  # -> ListA, ListB
boxrec_6 = BoxRectangle(Rectangle=rec_2pt_6.Rectangle, Height=ceiling_height)
boxrec_7 = BoxRectangle(Rectangle=rec_2pt_5.Rectangle, Height=ceiling_height)
split_15 = SplitList(List=split_10.ListA, Index="2")  # -> ListA, ListB
merge_11 = Merge(Data1=flatten(boxrec_2), Data2=flatten(split_15.ListB))

division_6 = Division(A="130", B="72")
multiplication_5 = Multiplication(A="0.19", B=epic_material_5.Density__kg_m³)
multiplication_6 = Multiplication(A="100", B="0.2")
multiplication_7 = Multiplication(A="0.14", B=epic_material_3.Density__kg_m³)
multiplication_8 = Multiplication(A="0.39", B="0.19")
multiplication_9 = Multiplication(A=epic_material_6.Density__kg_m³, B="0.0002")
division_7 = Division(A="1", B=multiplication_8)
epic_assembly_surface_m² = EPiCAssemblySurfaceM²(
    Assembly_Name="Doors",
    Assembly_Category="Partitions",
    Selected_Surfaces_and_or_Numerical_Values__m²=mm.Result,
    Material_Melamine_coated_MDF_sheet_18_mm=epic_material_9.EPiC_Material,
    m²_m²="2",
    Material_Softwood_air_dried=epic_material_10.EPiC_Material,
    m³_m²="0.000527300422295")  # -> EPiC_Assembly, port, Initial_Embodied_Energy__MJ, Initial_Embodied_Water__L, Initial_Embodied_GHG__kgCO₂e, port_2, Geometry; inputs Assembly_Name: list, Assembly_Category: list, Assembly_Comments: list, Selected_Surfaces_and_or_Numerical_Values__m²: list
# ---------- epic_assembly_surface_m²: Python ----------
# -*- coding: UTF-8 -*-
# EPiC Grasshopper: A Plugin for analysing embodied environmental flows
#
# Copyright (c) 2023, EPiC Grasshopper.
# You should have received a copy of the GNU General Public License
# along with EPiC Grasshopper; If not, see <http://www.gnu.org/licenses/>.
#
# Further information about the EPiC Database can be found at <https://bit.ly/EPiC_Database>
# To download a full copy of the database, goto <http://doi.org/10.26188/5dc228ef98c5a>
#
# @license GPL-3.0+ <http://spdx.org/licenses/GPL-3.0+>

"""
Creates a surface assembly based on the selected geometry and EPiC Materials

    Inputs:
        Assembly_Name: Name for the assembly - this will appear in data EPiC Built Assets and reports.
        ***Optional***

        Assembly_Category: Name for the assembly category. Will use assembly name if none specified.
        Note that assemblies in the same category will be grouped together in the EPiC Built Assets.
        ***Optional***

        Assembly_Comments: Comments about the assembly - these will appear in the data EPiC Built Assets and reports.
        ***Optional***

        **Selected_Surfaces_and/or_Numerical_Values_(m²): A selection of surfaces that represent the EPiC Assembly AND/OR values in m².
        An area calculation will be performed on geometry to calculate embodied environmental flows.
        (**REQUIRED)

        Service_Life_(Years)_Assembly_Override: Estimated service_life (in years) for the assembly.
        Note this will override all material service_life attributes.
        ***Optional***

        Wastage_Coefficient_(%)_Assembly_Override: Estimated wastage percentage (%) for the material.
        Note this will override all material wastage attributes.
        ***Optional***

    Outputs:
        EPiC_Assembly: Outputs a class object (EPiC_Assembly) to be used in EPiC_Analysis.
        This contains all of the embedded assembly attributes.
        (selected_geometry, name, thickness, service_life, wastage, comments, epic_materials, assembly_units)
        ***Connect that output to a panel for a summary***

        Initial_Embodied_Energy_(MJ): The total initial Embodied Energy (MJ) for the assembly.
        This includes the wastage coefficient but does NOT include service_life calculations.

        Initial_Embodied_Water_(L): The total initial Embodied Water (L) for the assembly.
        This includes the wastage coefficient but does NOT include service_life calculations.

        Initial_Embodied_GHG_(kgCO₂e): The total initial Embodied Greenhouse Gas Emissions (kgCO₂e) for the assembly.
        This includes the wastage coefficient but does NOT include service_life calculations.

        Geometry: The geometry used to define the assembly.
"""

from Grasshopper.Kernel import GH_RuntimeMessageLevel as RML
from ghpythonlib.componentbase import executingcomponent as component
import epic

# Allow realtime feedback with external python files in grasshopper
epic = reload(epic)

# Specify component attributes and units to use for the assembly
units = 'm²'
component_name = "EPiC Assembly - Surface (m²)"
geometry_warning = "Brep/line/point input detected. Please input a surface, closed polyline, or numerical value"


class EPiCAssemblyVolumetricComponent(component):

    def RunScript(self,
            input_assembly_name,
            input_assembly_category,
            input_assembly_comments,
            input_selected_geometry,
            input_service_life_override,
            input_wastage_override,
            _null,
            material_01,
            material_01_qty,
            material_02,
            material_02_qty,
            material_03,
            material_03_qty,
            material_04,
            material_04_qty,
            material_05,
            material_05_qty,
            material_06,
            material_06_qty,
            material_07,
            material_07_qty,
            material_08,
            material_08_qty,
            material_09,
            material_09_qty,
            material_10,
            material_10_qty):

        # Component and version information
        __author__ = epic.__author__
        __version__ = "1.02"
        if __version__ == epic.__version__:
            ghenv.Component.Message = epic.__message__
        else:
            ghenv.Component.Message = epic.version_mismatch(__version__)
            ghenv.Component.AddRuntimeMessage(RML.Remark, ghenv.Component.Message)
        ghenv.Component.Name = component_name
        ghenv.Component.NickName = component_name

        # Added for compatability with Rhino 8.
        # Get material variables from locals(), so it is possible to create inputs dynamically. Check for up to 20 materials.
        material_list = []
        for num in range(1, 21):
            if num < 10:
                num = str(0) + str(num)
            else:
                num = str(num)
            _ = 'material_' + num
            if _ and _ + '_qty' in locals():
                material_list.append(locals()[_])
                material_list.append(locals()[_ + '_qty'])
            else:
                break

        # Sort the material inputs and quantities
        material_list = epic.EPiCAssembly.create_list_of_input_materials_and_qty(ghenv.Component, units, material_list)

        # Create an EPiCAssembly class object
        try:
            assembly = epic.EPiCAssembly(input_selected_geometry, input_assembly_name, input_service_life_override,
                                         input_wastage_override, input_assembly_comments, material_list,
                                         assembly_units=units, category=input_assembly_category)
        except TypeError:
            ghenv.Component.AddRuntimeMessage(RML.Warning, geometry_warning)
            return [geometry_warning]*5

        # Test to see if geometry is connected to the component
        if not input_selected_geometry:
            ghenv.Component.AddRuntimeMessage(RML.Warning, "No geometry is connected to the assembly")

        # Test to see if any material inputs exist
        if len(material_list) < 1:
            ghenv.Component.AddRuntimeMessage(RML.Warning, "No input EPiC_Material inputs or material quantities have been found ")

        # Calculate the environmental flows for the assembly
        assembly.calculate_flows()

        # Specify the component outputs
        output_initial_energy = assembly.flows['initial']['energy']
        output_initial_water = assembly.flows['initial']['water']
        output_initial_ghg = assembly.flows['initial']['ghg']

        # Return all component outputs
        return assembly, None, output_initial_energy, output_initial_water, output_initial_ghg, None, assembly.output_geometry
# ---------- end epic_assembly_surface_m² ----------
epic_assembly_surface_m²_2 = EPiCAssemblySurfaceM²(
    Assembly_Name="Floors",
    Selected_Surfaces_and_or_Numerical_Values__m²=area_2.Area,
    Material_Nylon_tufted_carpet_average=epic_material_17.EPiC_Material,
    m²_m²="1",
    Material_Steel_bar=epic_material_13.EPiC_Material,
    kg_m²=multiplication_6,
    Material_Concrete_32_MPa=epic_material_18.EPiC_Material,
    m³_m²="0.2",
    Material_Water_based_paint_per_square_metre=epic_material_19.EPiC_Material,
    m²_m²_2="3")  # -> EPiC_Assembly, port, Initial_Embodied_Energy__MJ, Initial_Embodied_Water__L, Initial_Embodied_GHG__kgCO₂e, port_2, Geometry; inputs Assembly_Name: list, Assembly_Category: list, Assembly_Comments: list, Selected_Surfaces_and_or_Numerical_Values__m²: list; same code as epic_assembly_surface_m²

searchmods = HBSearchModifiers()  # -> modifiers; plug-in component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
panel_4 = Panel(searchmods)
item_24 = ListItem(List=searchmods, Index="10", Wrap=True)
item_25 = ListItem(List=searchmods, Index="16", Wrap=True)
item_26 = ListItem(List=searchmods, Index="2", Wrap=True)
item_27 = ListItem(List=searchmods, Index="17", Wrap=True)

mirror_6 = Mirror(Geometry=boxrec_7, Plane=xz_2)  # -> Geometry, Transform
data_2 = Data(flatten(split_12.ListB))
data_3 = Data(flatten(split_14.ListB))
wdws = Data(flatten(merge_7))
srf_2 = Surface(wdws)
area_4 = Area(Geometry=srf_2)  # -> Area, Centroid
ma = MassAddition(Input=area_4.Area)  # -> Result, PartialResults
len = Length(Curve=wdws)
ma_2 = MassAddition(Input=len)  # -> Result, PartialResults
multiplication_10 = Multiplication(A=ma_2.Result, B=2)
division_8 = Division(A=multiplication_10, B=ma.Result)
epic_assembly_surface_m²_3 = EPiCAssemblySurfaceM²(
    Assembly_Name="Windows",
    Assembly_Category="Façade",
    Selected_Surfaces_and_or_Numerical_Values__m²=ma.Result,
    Material_Flat_glass_double_glazing_6_12_6=epic_material_11.EPiC_Material,
    m²_m²="1",
    Material_Aluminium_extruded_square_tube_40_mm_2_mm_thick=epic_material_12.EPiC_Material,
    m_m²=division_8)  # -> EPiC_Assembly, port, Initial_Embodied_Energy__MJ, Initial_Embodied_Water__L, Initial_Embodied_GHG__kgCO₂e, port_2, Geometry; inputs Assembly_Name: list, Assembly_Category: list, Assembly_Comments: list, Selected_Surfaces_and_or_Numerical_Values__m²: list; same code as epic_assembly_surface_m²
openspace_1 = Data(mirror_6.Geometry)
openspace_2 = Data(boxrec_6)
open_space_2 = Data(boxrec_4)

opaquemat = HBOpaqueMaterial(name="EPS", thickness="0.13", conductivity="0.034", density=epic_material.Density__kg_m³, spec_heat="1223")  # -> mat; plug-in component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
opaquemat_2 = HBOpaqueMaterial(name="Rockwool", thickness="0.14", conductivity="0.036", density=epic_material_3.Density__kg_m³, spec_heat="840")  # -> mat; plug-in component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
opaquemat_3 = HBOpaqueMaterial(name="Cellulose", thickness="0.19", conductivity="0.04", density=epic_material_5.Density__kg_m³, spec_heat="1400")  # -> mat; plug-in component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
opaquemat_4 = HBOpaqueMaterial(name="Blocks", thickness="0.19", conductivity="1.35", density=epic_material_8.Density__kg_m³, spec_heat="1000")  # -> mat; plug-in component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
opaquemat_5 = HBOpaqueMaterial(name="Plasterboard", thickness="0.013", conductivity="0.13", density=epic_material_4.Density__kg_m³, spec_heat="1225")  # -> mat; plug-in component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
filter_4 = StreamFilter(Gate="0", Stream0=opaquemat, Stream1=opaquemat_2, Stream2=opaquemat_3)
merge_12 = Merge(Data1=filter_4, Data2=opaquemat_4, Data3=opaquemat_5)
opaqueconstr = HBOpaqueConstruction(materials=merge_12)  # -> constr; plug-in component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

corridor = Data(boxrec_5)
rooms_2 = Data(merge_9)
doors_2 = Data(merge_10)
data_4 = Data(merge_11)
data_5 = Data(split_13.ListB)
filter_5 = StreamFilter(
    Gate=item_3,
    Stream0=epic_material.EPiC_Material,
    Stream1=epic_material_3.EPiC_Material,
    Stream2=epic_material_5.EPiC_Material)
filter_6 = StreamFilter(Gate=item_3, Stream0=division_6, Stream1=multiplication_7, Stream2=multiplication_5)
merge_13 = Merge(Data1=data_3, Data2=data_2)
bldgvintages = HBBuildingVintages({"ASHRAE 90.1 2019  |  IECC 2021": "2019", "ASHRAE 90.1 2016  |  IECC 2018": "2016", "ASHRAE 90.1 2013  |  IECC 2015": "2013", "ASHRAE 90.1 2010  |  IECC 2012": "2010", "ASHRAE 90.1 2007  |  IECC 2009": "2007", "ASHRAE 90.1 2004  |  IECC 2006": "2004", "1980-2004 (CBECS)": "1980_2004", "Pre-1980 (CBECS)": "pre_1980"}, selected="ASHRAE 90.1 2019  |  IECC 2021")
merge_14 = Merge(Data1=flatten(data_4), Data2=flatten(data_5))
division_9 = Division(A=epic_assembly_surface_m².Initial_Embodied_Energy__MJ, B=mm.Result)
division_10 = Division(A=epic_assembly_surface_m².Initial_Embodied_GHG__kgCO₂e, B=mm.Result)
debrep = DeconstructBrep(Brep=openspace_1)  # -> Faces, Edges, Vertices
debrep_2 = DeconstructBrep(Brep=openspace_2)  # -> Faces, Edges, Vertices
division_11 = Division(A=epic_assembly_surface_m²_2.Initial_Embodied_Energy__MJ, B=area_2.Area)
division_12 = Division(A=epic_assembly_surface_m²_2.Initial_Embodied_GHG__kgCO₂e, B=area_2.Area)
division_13 = Division(A=epic_assembly_surface_m²_3.Initial_Embodied_Energy__MJ, B=ma.Result)
division_14 = Division(A=epic_assembly_surface_m²_3.Initial_Embodied_GHG__kgCO₂e, B=ma.Result)
constructiontypes = HBConstructionTypes({"SteelFramed", "WoodFramed", "Mass", "Metal Building"}, selected="Mass")
panel_5 = Panel(division_9)
panel_6 = Panel(division_10)
panel_7 = Panel(division_11)
panel_8 = Panel(division_13)
item_28 = ListItem(List=debrep_2.Faces, Index=Slider(3, range=0..7), Wrap=True)
item_29 = ListItem(List=debrep.Faces, Index=Slider(1, range=0..7), Wrap=True)
panel_9 = Panel(division_12)
panel_10 = Panel(division_14)
bldgprograms = HBBuildingPrograms({"LargeOffice", "MediumOffice", "SmallOffice", "MidriseApartment", "HighriseApartment", "Retail", "StripMall", "PrimarySchool", "SecondarySchool", "SmallHotel", "LargeHotel", "Hospital", "Outpatient", "Laboratory", "Warehouse", "SuperMarket", "FullServiceRestaurant", "QuickServiceRestaurant", "Courthouse", "College", "LargeDataCenterHighITE", "LargeDataCenterLowITE", "SmallDataCenterHighITE", "SmallDataCenterLowITE"}, selected="MediumOffice")
constrsetclimate = HBConstructionSetByClimate(climate_zone="4", vintage=bldgvintages, constr_type=constructiontypes)  # -> constr_set; plug-in component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
cluster_2 = Cluster_5(doors=merge_13, rooms=merge_14, open_space=openspace_1, open_space_2=openspace_2)
cluster_3 = Cluster_4(doors=doors_2, rooms=rooms_2, open_space=open_space_2, corridor=corridor)
cluster_4 = Cluster_2(wdws=wdws, doors=doors, B=rooms, B_2=open_space)  # -> façade, partitions
epic_assembly_surface_m²_4 = EPiCAssemblySurfaceM²(
    Assembly_Name="Façade",
    Assembly_Category="Façade",
    Selected_Surfaces_and_or_Numerical_Values__m²=cluster_4.façade,
    Material_Fibre_cement_weatherboard_300_7_5_mm_per_square_metre_of_wall=epic_material_2.EPiC_Material,
    m²_m²="1",
    Material_Polystyrene_EPS_XPS_rigid_foam_insulation_72_mm_R2=filter_5,
    m²_m²_2=filter_6,
    Material_Concrete_block_390_190_190_mm=epic_material_8.EPiC_Material,
    no_m²=division_7,
    Material_Polypropylene_PP_sheet=epic_material_6.EPiC_Material,
    kg_m²=multiplication_9,
    Material_Plasterboard_13_mm=epic_material_4.EPiC_Material,
    m²_m²_3="1",
    Material_Water_based_paint_per_square_metre=epic_material_7.EPiC_Material,
    m²_m²_4="3")  # -> EPiC_Assembly, port, Initial_Embodied_Energy__MJ, Initial_Embodied_Water__L, Initial_Embodied_GHG__kgCO₂e, port_2, Geometry; inputs Assembly_Name: list, Assembly_Category: list, Assembly_Comments: list, Selected_Surfaces_and_or_Numerical_Values__m²: list; same code as epic_assembly_surface_m²
cluster_5 = Cluster(B=rooms, ep_constr=opaqueconstr, relay=item_25, rad_mod_2=item_24, rad_mod=item_26)
cluster_6 = Cluster(B=open_space, ep_constr=opaqueconstr, relay=item_25, rad_mod_2=item_24, rad_mod=item_26)
cluster_7 = Cluster(B=rooms_2, ep_constr=opaqueconstr, relay=item_25, rad_mod_2=item_24, rad_mod=item_26)
cluster_8 = Cluster(B=merge_14, ep_constr=opaqueconstr, relay=item_25, rad_mod_2=item_24, rad_mod=item_26)
cluster_alternate = ClusterAlternate(B_2=item_28, B=openspace_1, ep_constr=opaqueconstr, relay=item_25, rad_mod_2=item_24, rad_mod=item_26)
cluster_alternate_2 = ClusterAlternate2(B_2=item_29, B=openspace_2, ep_constr=opaqueconstr, relay=item_25, rad_mod_2=item_24, rad_mod=item_26)
cluster_corridor = ClusterCorridor(relay=item_25, B=corridor, rad_mod_2=item_24, rad_mod=item_26)  # -> i, R
cluster_traversant = ClusterTraversant(B_2=cluster_corridor.i, ep_constr=opaqueconstr, relay=item_25, B=open_space_2, rad_mod_2=item_24, rad_mod=item_26)
filter_7 = StreamFilter(Gate=item_4, Stream0=cluster_4.partitions, Stream1=cluster_3, Stream2=cluster_2)
epic_assembly_surface_m²_5 = EPiCAssemblySurfaceM²(
    Assembly_Name="Partitions",
    Assembly_Category="Partitions",
    Selected_Surfaces_and_or_Numerical_Values__m²=filter_7,
    Material_Softwood_air_dried=epic_material_14.EPiC_Material,
    m³_m²="0.042",
    Material_Plasterboard_10_mm=epic_material_15.EPiC_Material,
    m²_m²="2",
    Material_Water_based_paint_per_square_metre=epic_material_16.EPiC_Material,
    m²_m²_2="6")  # -> EPiC_Assembly, port, Initial_Embodied_Energy__MJ, Initial_Embodied_Water__L, Initial_Embodied_GHG__kgCO₂e, port_2, Geometry; inputs Assembly_Name: list, Assembly_Category: list, Assembly_Comments: list, Selected_Surfaces_and_or_Numerical_Values__m²: list; same code as epic_assembly_surface_m²
division_15 = Division(A=epic_assembly_surface_m²_5.Initial_Embodied_Energy__MJ, B=filter_7)
division_16 = Division(A=epic_assembly_surface_m²_5.Initial_Embodied_GHG__kgCO₂e, B=filter_7)
panel_11 = Panel(division_15)
panel_12 = Panel(division_16)
division_17 = Division(A=epic_assembly_surface_m²_4.Initial_Embodied_Energy__MJ, B=cluster_4.façade)
division_18 = Division(A=epic_assembly_surface_m²_4.Initial_Embodied_GHG__kgCO₂e, B=cluster_4.façade)
decnstrconstr = HBDeconstructConstruction(constr=opaqueconstr)  # -> materials, layers, r_val_si, r_val_ip, u_fac_si, u_fac_ip, shgc, t_sol, t_vis; plug-in component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
panel_13 = Panel(division_17)
panel_14 = Panel(division_18)
panel_15 = Panel(decnstrconstr.u_fac_si)
number_slider = Slider(0.2, range=0..1)
room = HBRoom(faces=cluster_8, constr_set=constrsetclimate, program=bldgprograms, conditioned="True")  # -> report, flatten(room); plug-in component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
room_2 = HBRoom(faces=cluster_alternate, constr_set=constrsetclimate, program=bldgprograms, conditioned="True")  # -> report, flatten(room); plug-in component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
number_slider_2 = Slider(0.2, range=0..1)
number_slider_3 = Slider(0.2, range=0..1)
room_3 = HBRoom(faces=cluster_alternate_2, constr_set=constrsetclimate, program=bldgprograms, conditioned="True")  # -> report, flatten(room); plug-in component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
door = HBDoor(geo=data_2)  # -> report, doors; plug-in component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
room_4 = HBRoom(faces=cluster_7, constr_set=constrsetclimate, program=bldgprograms, conditioned="True")  # -> report, flatten(room); plug-in component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
door_2 = HBDoor(geo=data_3)  # -> report, doors; plug-in component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
room_5 = HBRoom(faces=cluster_corridor.R, constr_set=constrsetclimate, program=bldgprograms, conditioned="True")  # -> report, flatten(room); plug-in component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
room_6 = HBRoom(faces=cluster_5, constr_set=constrsetclimate, program=bldgprograms, conditioned="True")  # -> report, flatten(room); plug-in component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
room_7 = HBRoom(faces=cluster_6, constr_set=constrsetclimate, program=bldgprograms, conditioned="True")  # -> report, flatten(room); plug-in component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
room_8 = HBRoom(faces=cluster_traversant, constr_set=constrsetclimate, program=bldgprograms, conditioned="True")  # -> report, flatten(room); plug-in component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
door_3 = HBDoor(geo=doors)  # -> report, doors; plug-in component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
door_4 = HBDoor(geo=doors_2)  # -> report, doors; plug-in component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
merge_15 = Merge(
    Data1=flatten(epic_assembly_surface_m²_4.EPiC_Assembly),
    Data2=flatten(epic_assembly_surface_m²_3.EPiC_Assembly),
    Data3=flatten(epic_assembly_surface_m²_2.EPiC_Assembly),
    Data4=flatten(epic_assembly_surface_m²_5.EPiC_Assembly),
    Data5=flatten(epic_assembly_surface_m².EPiC_Assembly))
merge_16 = Merge(Data1=door_2.doors, Data2=door.doors)
addsubface = HBAddSubface(hb_obj=flatten(room_6.room), sub_faces=flatten(door_3.doors), project_dist=number_slider_2)  # -> report, hb_obj, unmatched; plug-in component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
filter_8 = StreamFilter(Gate=item_2, Stream0=merge_15)
addsubface_2 = HBAddSubface(hb_obj=flatten(room_7.room), sub_faces=flatten(door_3.doors), project_dist=number_slider_2)  # -> report, hb_obj, unmatched; plug-in component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
addsubface_3 = HBAddSubface(hb_obj=flatten(room.room), sub_faces=flatten(merge_16), project_dist=number_slider)  # -> report, hb_obj, unmatched; plug-in component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
addsubface_4 = HBAddSubface(hb_obj=flatten(room_4.room), sub_faces=flatten(door_4.doors), project_dist=number_slider_3)  # -> report, hb_obj, unmatched; plug-in component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
addsubface_5 = HBAddSubface(hb_obj=flatten(room_2.room), sub_faces=flatten(door_2.doors), project_dist=number_slider)  # -> report, hb_obj, unmatched; plug-in component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
addsubface_6 = HBAddSubface(hb_obj=flatten(room_3.room), sub_faces=flatten(door.doors), project_dist=number_slider)  # -> report, hb_obj, unmatched; plug-in component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
addsubface_7 = HBAddSubface(hb_obj=flatten(room_5.room), sub_faces=flatten(door_4.doors), project_dist=number_slider_3)  # -> report, hb_obj, unmatched; plug-in component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
epic_built_asset = EPiCBuiltAsset(EPiC_Assemblies=filter_8)  # -> EPiC_Built_Asset, port, Geometry_by_Assembly; inputs Asset_Name: list, Asset_Comments: list, EPiC_Assemblies: tree; disabled
# ---------- epic_built_asset: Python ----------
# -*- coding: UTF-8 -*-
# EPiC Grasshopper: A Plugin for analysing embodied environmental flows
#
# Copyright (c) 2023, EPiC Grasshopper.
# You should have received a copy of the GNU General Public License
# along with EPiC Grasshopper; If not, see <http://www.gnu.org/licenses/>.
#
# Further information about the EPiC Database can be found at <https://bit.ly/EPiC_Database>
# To download a full copy of the database, goto <http://doi.org/10.26188/5dc228ef98c5a>
#
# @license GPL-3.0+ <http://spdx.org/licenses/GPL-3.0+>

"""
Creates a built asset object using multiple EPiC_Assembly items

    Inputs:

        Asset_Name: Name for the Built Asset
        ***Optional***

        Asset_Comments: Comments for the Built Asset
        ***Optional***

        EPiC_Assemblies: In input one or more EPiC_Assembly objects
        (**REQUIRED)

    Outputs:
        EPiC_Built_Asset: Built Asset class with detailed report
        ***Connect that output to a panel for a summary***

        Geometry_by_Assembly: A collection of all selected geometries for each EPiC Assembly
"""

from Grasshopper.Kernel import GH_RuntimeMessageLevel as RML
import Grasshopper.Kernel.Data as ghp
from ghpythonlib.componentbase import executingcomponent as component
import ghpythonlib.treehelpers as th
import epic

# Allow realtime feedback with external python files in grasshopper
epic = reload(epic)


class MyComponent(component):
    def RunScript(self, input_name, input_comments, _null, epic_assemblies):

        # Component and version information
        __author__ = epic.__author__
        __version__ = "1.02"
        if __version__ == epic.__version__:
            ghenv.Component.Message = epic.__message__
        else:
            ghenv.Component.Message = epic.version_mismatch(__version__)
            ghenv.Component.AddRuntimeMessage(RML.Remark, ghenv.Component.Message)
        ghenv.Component.Name = "EPiC Built Asset"
        ghenv.Component.NickName = "EPiC Built Asset"

        if epic_assemblies:
            # Convert inputs to flat list
            epic_assemblies.Flatten(ghp.GH_Path(0))
            epic_assemblies = th.tree_to_list(epic_assemblies)

            # Provide a default name if none provided
            input_name = 'EPiC Built Asset' if not input_name else input_name
            # Generate an EPiCBuiltAsset class object
            built_asset = epic.EPiCBuiltAsset(input_name, epic_assemblies, comments=input_comments)
            return built_asset, None, built_asset.fetch_geometry_as_list()
        else:
            ghenv.Component.AddRuntimeMessage(RML.Warning,
                                              "No input detected, please provide one/multiple EPiC_Assembly objects")
# ---------- end epic_built_asset ----------
list_39 = ValueList({"Total": "total", "By Material": "by_material", "By Assembly": "by_assembly", "By Assembly and material": "by_assembly_and_material"}, selected="By Assembly")
merge_17 = Merge(Data1=addsubface.hb_obj, Data2=addsubface_2.hb_obj)
merge_18 = Merge(Data1=flatten(addsubface_4.hb_obj), Data2=flatten(addsubface_7.hb_obj), Data3=flatten(room_8.room))
merge_19 = Merge(Data1=addsubface_3.hb_obj, Data2=addsubface_5.hb_obj, Data3=addsubface_6.hb_obj)
epic_analysis = EPiCAnalysis(
    EPiC_Assemblies_or_Built_Assets=epic_built_asset.EPiC_Built_Asset,
    Period_of_Analysis__Years=Slider(60, range=0..100),
    Analysis_Type=list_39)  # -> Detailed_Report_Information, Graph_Outputs, Output_Breakdown, port, Initial_Embodied_Energy__MJ, Initial_Wastage_Embodied_Energy__MJ, Recurrent_Embodied_Energy__MJ, Recurrent_Wastage_Embodied_Energy__MJ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; inputs Analysis_Name: list, EPiC_Assemblies_or_Built_Assets: tree, Connect_Button_to_Generate__csv: Boolean
# ---------- epic_analysis: Python ----------
# -*- coding: UTF-8 -*-
# EPiC Grasshopper: A Plugin for analysing embodied environmental flows
#
# Copyright (c) 2023, EPiC Grasshopper.
# You should have received a copy of the GNU General Public License
# along with EPiC Grasshopper; If not, see <http://www.gnu.org/licenses/>.
#
# Further information about the EPiC Database can be found at <https://bit.ly/EPiC_Database>
# To download a full copy of the database, goto <http://doi.org/10.26188/5dc228ef98c5a>
#
# @license GPL-3.0+ <http://spdx.org/licenses/GPL-3.0+>

"""
Calculates Embodied Environmental Flows and plots a stacked bar chart of the results, with the ability to generate a csv report

    Inputs:

        Analysis_Name: Name for the Analysis Report
        ***Optional***

        **EPiC_Assemblies_or_Built_Assets: Input EPiC_Assembly and/or EPiC_Built_Asset items for built_assets
        (**REQUIRED)

        Comparison_Values_(EPiC_Assemblies): Input EPiC_Assembly items to compare (not shown in .csv report)
        ***Optional***

        Period_of_Analysis_(Years): The period of analysis to be used for calculations.
        Default value of None - indicating that no recurrent calculations will be made.
        ***Optional***

        >>Connect_Button_to_Load_Analysis_Types: Connect and activate a button.
        This will generate a dropdown list for the Analysis Type input

        Analysis_Type: Input the type of built_assets to be used for graph visualisations.
        Possible inputs include: 'total', 'by_material', 'by_assembly', or 'by_assembly_and_material'
        Defaults to: 'total'
        ***Optional***

        Graph_Origin_Point: Specify the origin point for graph visualisations. Defaults to 0,0,0.
        ***Optional***

        Graph_Scale: Specify the scale of the graph visualisations. 1=normal size, 0.5=half size, 2=double size
        ***Optional***

        csv_Folder_location: Folder location for generation of a csv report. Use the 'path' object in grasshopper
        (**REQUIRED for report generation)

        >>Connect_Button_to_Generate_csv: Connect a Button to Generate the csv. report

    Outputs:
        Detailed_Report_Information: Detailed report information
        ***Connect that output to a panel for a summary***

        Graph_Outputs: Outputs a list of bakeable geometry for the graph visualisation

        Output_Breakdown: Text detailing the flow outputs, depending on the analysis type.
        For 'by_assembly_and_by_material' this will be a nested list

        Initial_Embodied_Energy_(MJ): Initial Embodied Energy (MJ)
        This includes wastage

        Initial_Wastage_Embodied_Energy_(MJ): Initial Wastage Embodied Energy (MJ)

        Recurrent_Embodied_Energy_(MJ): Recurrent Embodied Energy (MJ)
        This includes wastage

        Recurrent_Wastage_Embodied_Energy_(MJ): Recurrent Wastage Embodied Energy (MJ)

        Life_Cycle_Embodied_Energy_(MJ): Life Cycle Embodied Energy (MJ)
        This includes initial, recurrent, and wastage flows

        Life_Cycle_Wastage_Embodied_Energy_(MJ): Life Cycle Wastage Embodied Energy (MJ)

        Initial_Embodied_Water_(L): Initial Embodied Water (L)
        This includes wastage

        Initial_Wastage_Embodied_Water_(L): Initial Wastage Embodied Water (L)

        Recurrent_Embodied_Water_(L): Recurrent Embodied Water (L)
        This includes wastage

        Recurrent_Wastage_Embodied_Water_(L): Recurrent Wastage Embodied Water (L)

        Life_Cycle_Embodied_Water_(L): Life Cycle Embodied Water (L)
        This includes initial, recurrent, and wastage flows

        Life_Cycle_Wastage_Embodied_Water_(L): Life Cycle Wastage Embodied Water (L)

        Initial_Embodied_GHG_(kgCO₂e): Initial Embodied GHG (kgCO₂e)
        This includes wastage

        Initial_Wastage_Embodied_GHG_(kgCO₂e): Initial Wastage Embodied GHG (kgCO₂e)

        Recurrent_Embodied_GHG_(kgCO₂e): Recurrent Embodied GHG (kgCO₂e)
        This includes wastage

        Recurrent_Wastage_Embodied_GHG_(kgCO₂e): Recurrent Wastage Embodied GHG (kgCO₂e)

        Life_Cycle_Embodied_GHG_(kgCO₂e): Life Cycle Embodied GHG (kgCO₂e)
        This includes initial, recurrent, and wastage flows

        Life_Cycle_Wastage_Embodied_GHG_(kgCO₂e): Life Cycle Wastage Embodied GHG (kgCO₂e)

        Geometry_by_Assembly: A collection of all selected geometries for each EPiC Assembly (including within EPiC Built Assets)

"""

import os.path as path
from collections import OrderedDict

from Grasshopper.Kernel import GH_RuntimeMessageLevel as RML
import Grasshopper.Kernel.Data as ghp
from Rhino import RhinoApp
from ghpythonlib.componentbase import executingcomponent as component
import ghpythonlib.treehelpers as th
from scriptcontext import sticky as st

import epic

# Allow realtime feedback with external python files in grasshopper
epic = reload(epic)
no_inputs_warning = "No assemblies nor built assets linked, please input assemblies and/or built assets"


class EPiCAnalysisComponent(component):
    def RunScript(self,
                  report_name,
                  epic_inputs,
                  period_of_analysis,
                  _null,
                  analysis_button,
                  analysis_type,
                  graph_origin,
                  graph_scale,
                  _null2,
                  folder_location,
                  button):

        # Component and version information
        __author__ = epic.__author__
        __version__ = "1.02"
        if __version__ == epic.__version__:
            ghenv.Component.Message = epic.__message__
        else:
            ghenv.Component.Message = epic.version_mismatch(__version__)
            ghenv.Component.AddRuntimeMessage(RML.Remark, ghenv.Component.Message)
        ghenv.Component.Name = "EPiC Analysis"
        ghenv.Component.NickName = "EPiC Analysis"

        # Convert inputs to flat list
        epic_inputs.Flatten(ghp.GH_Path(0))
        epic_inputs = th.tree_to_list(epic_inputs)

        # Remove any file names from folder path
        if folder_location:
            folder_location = path.dirname(folder_location)

        # Component variables
        analysis_types = OrderedDict([('Total', 'total'),
                                      ('By Material', 'by_material'),
                                      ('By Assembly', 'by_assembly'),
                                      ('By Assembly and material', 'by_assembly_and_material')])

        # Default name for built_assets report
        report_name = 'EPiC Analysis' if not report_name else report_name

        # Default name for EPiC_Assembly inputs
        epic_assemblies_name = 'Assembly Collection'
        if analysis_button:
            epic.make_value_list_input_component(5, analysis_types.values(), ghenv,
                                                 valuelist_names=analysis_types.keys(),
                                                 xloc=-170,
                                                 yloc=10)

        if epic_inputs:
            # Process the built_assets inputs and create an EPiCAnalysis class instance
            epic_analysis, epic_inputs = epic.EPiCAnalysis.process_inputs(epic_inputs,
                                                                          analysis_type,
                                                                          graph_origin=graph_origin,
                                                                          graph_scale=graph_scale,
                                                                          period_of_analysis=period_of_analysis,
                                                                          report_name=report_name,
                                                                          epic_assemblies_name=epic_assemblies_name)

            # Stop report from printing whenever component is updated (if toggle is connected).
            if 'report_exporting' not in st:
                st['report_exporting'] = True

            # Button / toggle must return to 'False' before a new report is printed
            elif not button:
                st['report_exporting'] = False

            # Create CSV report when button is pressed
            if button and folder_location and not st['report_exporting']:
                st['report_exporting'] = True
                message = epic.print_csv(report_name, folder_location, period_of_analysis, epic_analysis, epic_inputs)
                RhinoApp.WriteLine(message)

            # Hide output geometry
            ghenv.Component.Params.Output[25].Hidden = True

            # Generate component outputs depending on the analysis_type
            return epic_analysis.generate_analysis_breakdown_for_outputs(analysis_type=analysis_type)
        else:
            ghenv.Component.AddRuntimeMessage(RML.Warning,
                                              "Input EPiCAssembly or EPiCBuiltAsset items for built_assets")
# ---------- end epic_analysis ----------
filter_9 = StreamFilter(Gate=item_4, Stream0=merge_17, Stream1=merge_18, Stream2=merge_19)
glassmod = HBGlassModifier(trans=Slider(0.55, range=0..1))  # -> modifier; plug-in component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
solveadj = HBSolveAdjacency(rooms=flatten(filter_9), run=Toggle(True))  # -> report, adj_rooms; plug-in component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
ma_3 = MassAddition(Input=epic_analysis.Life_Cycle_Embodied_Energy__MJ)  # -> Result, PartialResults
ma_4 = MassAddition(Input=epic_analysis.Life_Cycle_Embodied_GHG__kgCO₂e)  # -> Result, PartialResults
bang = ExplodeTree(Data=simplify(graft(epic_analysis.Life_Cycle_Embodied_GHG__kgCO₂e)))  # -> Branch0, Branch1, Branch2
aperture = HBAperture(geo=flatten(wdws), operable="True", ep_constr="U 0.35 SHGC 0.26 Dbl Ref-C-M Clr 6mm/13mm Arg", rad_mod=glassmod)  # -> report, apertures; plug-in component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
bang_2 = ExplodeTree(Data=simplify(graft(epic_analysis.Life_Cycle_Embodied_Energy__MJ)))  # -> Branch0, Branch1, Branch2
panel_16 = Panel(epic_analysis.Output_Breakdown)
division_19 = Division(A=ma_4.Result, B=multiplication)
division_20 = Division(A=ma_3.Result, B=multiplication)
addsubface_8 = HBAddSubface(hb_obj=solveadj.adj_rooms, sub_faces=aperture.apertures)  # -> report, hb_obj, unmatched; plug-in component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
division_21 = Division(A=bang_2.Branch0, B=multiplication)
division_22 = Division(A=bang_2.Branch1, B=multiplication)
division_23 = Division(A=bang_2.Branch2, B=multiplication)
division_24 = Division(A=bang.Branch0, B=multiplication)
division_25 = Division(A=bang.Branch1, B=multiplication)
division_26 = Division(A=bang.Branch2, B=multiplication)
filter_10 = StreamFilter(Gate=item_3, Stream0=addsubface_8.hb_obj)
null = NullItem(Item=cluster.R_2)  # -> NullFlags, InvalidFlags, Description
dispatch = Dispatch(List=cluster.R_2, DispatchPattern=null.NullFlags)  # -> ListA, ListB
shade = HBShade(geo=dispatch.ListB, rad_mod=item_27)  # -> report, shades; plug-in component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
deconstrprogram = HBDeconstructProgramType(program=bldgprograms)  # -> people, lighting, electric_equip, gas_equip, hot_water, infiltration, ventilation, setpoint; plug-in component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
brep = Brep(cluster.R)
area_5 = Area(Geometry=brep)  # -> Area, Centroid
division_27 = Division(A=ma_4.Result, B=area_5.Area)
division_28 = Division(A=ma_3.Result, B=area_5.Area)
division_29 = Division(A=bang_2.Branch0, B=area_5.Area)
division_30 = Division(A=bang_2.Branch1, B=area_5.Area)
division_31 = Division(A=bang_2.Branch2, B=area_5.Area)
division_32 = Division(A=bang.Branch0, B=area_5.Area)
division_33 = Division(A=bang.Branch1, B=area_5.Area)
division_34 = Division(A=bang.Branch2, B=area_5.Area)
merge_20 = Merge(
    Data1=flatten(ma_3.Result),
    Data2=flatten(division_28),
    Data3=flatten(division_20),
    Data4=flatten(ma_4.Result),
    Data5=flatten(division_27),
    Data6=flatten(division_19),
    Data7=flatten(bang_2.Branch0),
    Data8=flatten(division_29),
    Data9=flatten(division_21),
    Data10=flatten(bang.Branch0),
    Data11=flatten(division_32),
    Data12=flatten(division_24),
    Data13=flatten(bang_2.Branch2),
    Data14=flatten(division_31),
    Data15=flatten(division_23),
    Data16=flatten(bang.Branch2),
    Data17=flatten(division_34),
    Data18=flatten(division_26),
    Data19=flatten(bang_2.Branch1),
    Data20=flatten(division_30),
    Data21=flatten(division_22),
    Data22=flatten(bang.Branch1),
    Data23=flatten(division_33),
    Data24=flatten(division_25))
doas = HBDOASHVACTemplates({"DOAS with fan coil chiller with boiler": "DOAS_FCU_Chiller_Boiler", "DOAS with fan coil chiller with central air source heat pump": "DOAS_FCU_Chiller_ASHP", "DOAS with fan coil chiller with district hot water": "DOAS_FCU_Chiller_DHW", "DOAS with fan coil chiller with baseboard electric": "DOAS_FCU_Chiller_ElectricBaseboard", "DOAS with fan coil chiller with gas unit heaters": "DOAS_FCU_Chiller_GasHeaters", "DOAS with fan coil chiller with no heat": "DOAS_FCU_Chiller", "DOAS with fan coil air-cooled chiller with boiler": "DOAS_FCU_ACChiller_Boiler", "DOAS with fan coil air-cooled chiller with central air source heat pump": "DOAS_FCU_ACChiller_ASHP", "DOAS with fan coil air-cooled chiller with district hot water": "DOAS_FCU_ACChiller_DHW", "DOAS with fan coil air-cooled chiller with baseboard electric": "DOAS_FCU_ACChiller_ElectricBaseboard"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}, selected="DOAS with fan coil chiller with boiler")
number_slider_4 = Slider(8, range=0..10)
hoy_generation = HOYGeneration()
genpts = LBGeneratePointGrid(geometry=flatten(brep), grid_size=Slider(0.5, range=0..1), offset_dist=Slider(1, range=0..1.4))  # -> points, vectors, face_areas, mesh; plug-in component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
panel_17 = Panel("C:\Users\mdasse\OneDrive - UCL\PhD\Writings\Master Thesis Paper\Revised version submission\BEL_Brussels.064510_IWEC\BEL_Brussels.064510_IWEC.epw")
subtraction_6 = Subtraction(A=Slider(18, range=0..100), B=number_slider_4)
repeat = RepeatData(Data="0", Length="24")
series_4 = Series(Start=number_slider_4, Step=1, Count=subtraction_6)
sensorgrid = HBSensorGrid(positions=simplify(genpts.points), mesh=simplify(genpts.mesh))  # -> grid; plug-in component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
model = HBModel(rooms=flatten(filter_10), shades=flatten(shade.shades), name="testModel")  # -> report, model; plug-in component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
replace = ReplaceItems(List=repeat, Item="1", Indices=series_4, Wrap=False)
addition_4 = Addition(A="19", B="3")
subtraction_7 = Subtraction(A="25", B="1")
weeklyschedule = HBWeeklySchedule(sun=repeat, mon=replace, tue=replace, wed=replace, thu=replace, fri=replace, sat=repeat)  # -> report, schedule, idf_year, idf_week, idf_days; plug-in component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
lighting = HBLighting(watts_per_area="4.5", schedule=weeklyschedule.schedule)  # -> lighting; plug-in component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
programtype = HBProgramType(
    base_program=bldgprograms,
    people=deconstrprogram.people,
    lighting=lighting,
    electric_equip=deconstrprogram.electric_equip,
    gas_equip=deconstrprogram.gas_equip,
    hot_water=deconstrprogram.hot_water,
    infiltration=deconstrprogram.infiltration,
    ventilation=deconstrprogram.ventilation,
    setpoint=deconstrprogram.setpoint)  # -> program; plug-in component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
applyprogram = HBApplyProgramType(rooms=flatten(filter_10), program=programtype)  # -> report, rooms; plug-in component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
daylightcontrol = HBApplyDaylightControl(rooms=flatten(applyprogram.rooms), control_fract="0.5", min_power_in="0.6", off_at_min="True")  # -> report, rooms; plug-in component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
applysetpointvals = HBApplySetpointValues(room_or_program=flatten(daylightcontrol.rooms), cooling_setpt="25", heating_setpt="19", cutout_difference="1")  # -> report, mod_obj; plug-in component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
assigngridsviews = HBAssignGridsAndViews(model=model.model, grids=flatten(sensorgrid))  # -> model; plug-in component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
wea = HBWeaFromEPW(epw_file=panel_17)  # -> wea; plug-in component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
ventcontrol = HBVentilationControl(min_in_temp=addition_4, max_in_temp=subtraction_7, min_out_temp="16", max_out_temp="24", delta_temp="4")  # -> vent_cntrl; plug-in component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
doashvac = HBDOASHVAC(rooms=flatten(applysetpointvals.mod_obj), system_type=doas, vintage=bldgvintages, dcv=Toggle(True))  # -> report, rooms; plug-in component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
multiplication_11 = Multiplication(A=item_2, B=90)
windowopen = HBWindowOpening(rooms=flatten(doashvac.rooms), vent_cntrl=ventcontrol, discharge_coeff="0.65", wind_cross_vent="True")  # -> report, rooms; plug-in component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
division_35 = Division(A=multiplication, B=area_5.Area)
annualdaylight = HBAnnualDaylight(model=assigngridsviews, wea=wea, north=multiplication_11, schedule=weeklyschedule.schedule, run=Toggle(False))  # -> report, results, DA, cDA, UDI, UDI_low, UDI_up; plug-in component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
applyloadvals = HBApplyLoadValues(room_or_program=flatten(windowopen.rooms), people_per_floor=division_35, infilt_per_exterior="0.0003")  # -> report, mod_obj; plug-in component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
heatmap = LBSpatialHeatmap(values=simplify(annualdaylight.DA), mesh=simplify(genpts.mesh))  # -> mesh, legend, title, colors, legend_par, vis_set; disabled; plug-in component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
sda = HBSpatialDaylightAutonomy(DA=annualdaylight.DA, target_time="25")  # -> report, sDA, pass_fail; plug-in component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
sda_2 = HBSpatialDaylightAutonomy(DA=annualdaylight.DA, target_time="50")  # -> report, sDA, pass_fail; plug-in component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
sda_3 = HBSpatialDaylightAutonomy(DA=annualdaylight.DA, target_time="75")  # -> report, sDA, pass_fail; plug-in component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
merge_21 = Merge(Data1=area_5.Area, Data2=multiplication)
avr = Average(Input=sda_3.sDA)
toggle = BooleanToggle(True)
avr_2 = Average(Input=sda_2.sDA)
avr_3 = Average(Input=sda.sDA)
merge_22 = Merge(Data1=merge_6, Data2=merge_21)
merge_23 = Merge(Data1=merge_5, Data2=merge_21)
simoutput = HBSimulationOutput(
    zone_energy_use=toggle,
    system_energy_use=toggle,
    gains_and_losses=toggle,
    surface_temperature=toggle,
    surface_energy_flow=toggle)  # -> report, sim_output; plug-in component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
sizingpar = HBSizingParameter(bldg_type=bldgprograms)  # -> sizing; plug-in component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
merge_24 = Merge(Data1=avr_3, Data2=avr_2, Data3=avr)
idealair = HBIdealAir(rooms=flatten(applyloadvals.mod_obj), dcv=Toggle(True))  # -> report, rooms; plug-in component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
panel_18 = Panel(merge_24)
merge_25 = Merge(Data1=merge_22, Data2=merge_20)
simpar = HBSimulationParameter(
    north=multiplication_11,
    output=simoutput.sim_output,
    start_dow="Monday",
    timestep="1",
    terrain="Suburbs",
    sizing=sizingpar)  # -> sim_par; plug-in component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
model_2 = HBModel(rooms=flatten(idealair.rooms), shades=flatten(shade.shades), name="testModel")  # -> report, model; plug-in component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
toggle_2 = BooleanToggle(False)
merge_26 = Merge(Data1=flatten(merge_4), Data2=flatten(merge_24))
number_slider_5 = Slider(20, range=0..29)  # disabled
vizall = HBVisualizeAll(hb_objs=flatten(model_2.model))  # -> geo; plug-in component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
modeltoosm = HBModelToOSM(model=model_2.model, epw_file=panel_17, sim_par=simpar, write=toggle_2, run=toggle_2)  # -> report, jsons, osw, osm, idf, sql, zsz, rdd, html; plug-in component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
faceresult = HBReadFaceResult(sql=modeltoosm.sql)  # -> face_indoor_temp, face_outdoor_temp, face_energy_flow; disabled; plug-in component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
roomenergyresult = HBReadRoomEnergyResult(sql=modeltoosm.sql)  # -> cooling, heating, lighting, electric_equip, gas_equip, process, hot_water, fan_electric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; disabled; plug-in component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
eui = HBEndUseIntensity(sql=modeltoosm.sql)  # -> eui, eui_end_use, end_uses, gross_floor; plug-in component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
colrange = LBColorRange(index=number_slider_5)  # -> colors; disabled; plug-in component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
bang_3 = ExplodeTree(Data=simplify(graft(eui.eui_end_use)))  # -> Branch0, Branch1, Branch2, Branch3, Branch4
ma_5 = MassAddition(Input=eui.eui_end_use)  # -> Result, PartialResults
panel_19 = Panel(eui.eui_end_use)
loadbalance = HBThermalLoadBalance(
    rooms_model=flatten(model_2.model),
    cooling=roomenergyresult.cooling,
    heating=roomenergyresult.heating,
    lighting=roomenergyresult.lighting,
    electric_equip=roomenergyresult.electric_equip,
    gas_equip=roomenergyresult.gas_equip,
    process=roomenergyresult.process,
    hot_water=roomenergyresult.hot_water,
    people_gain=roomenergyresult.people_gain,
    solar_gain=roomenergyresult.solar_gain,
    infiltration_load=roomenergyresult.infiltration_load,
    mech_vent_load=roomenergyresult.mech_vent_load,
    nat_vent_load=roomenergyresult.nat_vent_load,
    face_energy_flow=faceresult.face_energy_flow)  # -> report, balance, balance_stor, norm_bal, norm_bal_stor; disabled; plug-in component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
panel_20 = Panel(eui.end_uses)
merge_27 = Merge(Data1=flatten(ma_5.Result), Data2=flatten(bang_3.Branch0), Data3=flatten(bang_3.Branch1))
multiplication_12 = Multiplication(A=merge_27, B=area_5.Area)
division_36 = Division(A=multiplication_12, B=multiplication)
merge_28 = Merge(Data1=flatten(merge_23), Data2=flatten(multiplication_12), Data3=flatten(merge_27), Data4=flatten(division_36))
legendpar = LBLegendParameters(colors=colrange)  # -> leg_par; disabled; plug-in component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
monthlychart = LBMonthlyChart(data=loadbalance.balance, legend_par=legendpar)  # -> out, data_mesh, data_lines, col_lines, legend, borders, labels, y_title, title, vis_set; disabled; plug-in component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
hourlyplot = LBHourlyPlot(data=loadbalance.balance)  # -> report, mesh, legend, borders, labels, title, vis_set; disabled; plug-in component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
stack = StackTrees(Data1=merge_26, Reduce=True)
stack_2 = StackTrees(Data0=loop_start.Data_3, Data1=merge_25, Reduce=True)
stack_3 = StackTrees(Data1=merge_28, Reduce=True)
loop_paused = LoopPaused(
    port=loop_start.port,
    Exit=False,
    Data=stack,
    Data_2=stack_3,
    Data_3=stack_2,
    TimeOutVal=0,
    pausedState=True,
    state="Constant output")  # -> D0, D1, D2
join_2 = TextJoin(Text=loop_paused.D0, Join=",")
join_3 = TextJoin(Text=loop_paused.D1, Join=",")
join_4 = TextJoin(Text=loop_paused.D2, Join=",")
panel_21 = Panel(join_3)
panel_22 = Panel(join_4)
panel_23 = Panel(join_2)

# ==== cluster HOYGeneration
division = Division(A="365", B=7)
round = Round(Number=division)  # -> Nearest, Floor, Ceiling
series = Series(Start=0, Step=1, Count=round.Floor)
multiplication = Multiplication(A=round.Floor, B=7)
multiplication_2 = Multiplication(A="7", B=series)
subtraction = Subtraction(A="365", B=multiplication)
subtraction_2 = Subtraction(A="365", B=subtraction)
series_2 = Series(Start=multiplication_2, Step=1, Count="5")  # -> flatten(Series)
merge = Merge(Data1=series_2, Data2=subtraction_2)
multiplication_3 = Multiplication(A="24", B=merge)
subtraction_3 = Subtraction(A="18", B="8")
addition = Addition(A="8", B=multiplication_3)
series_3 = Series(Start=addition, Step=1, Count=subtraction_3)  # -> flatten(Series)

# ==== cluster Cluster
B = ClusterInput()
debrep = DeconstructBrep(Brep=B)  # -> simplify(Faces), Edges, Vertices
item = ListItem(List=debrep.Faces, Index="5", Wrap=True)
item_2 = ListItem(List=debrep.Faces, Index="2", Wrap=True)
item_3 = ListItem(List=debrep.Faces, Index="4", Wrap=True)
item_4 = ListItem(List=debrep.Faces, Index=["1", "3"], Wrap=True)
item_5 = ListItem(List=debrep.Faces, Index="0", Wrap=True)
panel = Panel("Adiabatic")
relay = ClusterInput()
rad_mod = ClusterInput()
rad_mod_2 = ClusterInput()
ep_constr = ClusterInput()
face = HBFace(geo=item, name="Ceiling", bc="Adiabatic", rad_mod=rad_mod)  # -> report, faces; plug-in component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
face_2 = HBFace(geo=item_3, name="Floor", bc="Adiabatic", rad_mod=rad_mod_2)  # -> report, faces; plug-in component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
face_3 = HBFace(geo=item_2, name="Corridor Walls", bc="Outdoors", rad_mod=relay)  # -> report, faces; plug-in component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
face_4 = HBFace(geo=item_4, name="Partition Walls", bc="Adiabatic", rad_mod=relay)  # -> report, faces; plug-in component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
face_5 = HBFace(geo=item_5, name="Façades", bc="Outdoors", ep_constr=ep_constr, rad_mod=relay)  # -> report, faces; plug-in component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
merge = Merge(Data1=face_5.faces, Data2=face_4.faces, Data3=face_3.faces, Data4=face_2.faces, Data5=face.faces)  # -> simplify(Result)
R = ClusterOutput(merge)

# ==== cluster ClusterCorridor
B = ClusterInput()
debrep = DeconstructBrep(Brep=B)  # -> simplify(Faces), Edges, Vertices
item = ListItem(List=debrep.Faces, Index="5", Wrap=True)
item_2 = ListItem(List=debrep.Faces, Index="4", Wrap=True)
item_3 = ListItem(List=debrep.Faces, Index="3", Wrap=True)
item_4 = ListItem(List=debrep.Faces, Index="1", Wrap=True)
item_5 = ListItem(List=debrep.Faces, Index=["0", "2"], Wrap=True)
relay = ClusterInput()
i = ClusterOutput(item_4)
rad_mod = ClusterInput()
rad_mod_2 = ClusterInput()
face = HBFace(geo=item_3, name="Partition Walls", bc="Adiabatic", rad_mod=relay)  # -> report, faces; plug-in component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
face_2 = HBFace(geo=item, name="Ceiling", bc="Adiabatic", rad_mod=rad_mod)  # -> report, faces; plug-in component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
face_3 = HBFace(geo=item_2, name="Floor", bc="Adiabatic", rad_mod=rad_mod_2)  # -> report, faces; plug-in component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
face_4 = HBFace(geo=item_4, name="Air", type="AirBoundary", bc="outdoors")  # -> report, faces; plug-in component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
face_5 = HBFace(geo=item_5, name="Corridor Walls", bc="outdoors", rad_mod=relay)  # -> report, faces; plug-in component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
merge = Merge(Data1=face_4.faces, Data2=face.faces, Data3=face_5.faces, Data4=face_3.faces, Data5=face_2.faces)  # -> simplify(Result)
R = ClusterOutput(merge)

# ==== cluster ClusterTraversant
B = ClusterInput()
debrep = DeconstructBrep(Brep=B)  # -> simplify(Faces), Edges, Vertices
item = ListItem(List=debrep.Faces, Index="5", Wrap=True)
item_2 = ListItem(List=debrep.Faces, Index="4", Wrap=True)
item_3 = ListItem(List=debrep.Faces, Index="1", Wrap=True)
item_4 = ListItem(List=debrep.Faces, Index=["0", "2"], Wrap=True)
item_5 = ListItem(List=debrep.Faces, Index="3", Wrap=True)
B_2 = ClusterInput()
debrep_2 = DeconstructBrep(Brep=item_5)  # -> Faces, Edges, Vertices
debrep_3 = DeconstructBrep(Brep=B_2)  # -> Faces, Edges, Vertices
data = Data(debrep_2.Vertices)
data_2 = Data(debrep_3.Vertices)
item_6 = ListItem(List=data, Index=Slider(0, range=0..3), Wrap=True)
item_7 = ListItem(List=data, Index=Slider(3, range=0..3), Wrap=True)
item_8 = ListItem(List=data_2, Index=Slider(2, range=0..3), Wrap=True)
item_9 = ListItem(List=data_2, Index=Slider(1, range=0..3), Wrap=True)
yz = YZPlane(Origin=item_6)
rec_2pt = Rectangle2Pt(Plane=yz, PointA=item_6, PointB=item_8, Radius=0)  # -> Rectangle, Length
rec_2pt_2 = Rectangle2Pt(Plane=yz, PointA=item_9, PointB=item_7, Radius=0)  # -> Rectangle, Length
srf = Surface(rec_2pt_2.Rectangle)
srf_2 = Surface(B_2)
srf_3 = Surface(rec_2pt.Rectangle)
ep_constr = ClusterInput()
merge = Merge(Data1=srf_3, Data2=srf)
relay = ClusterInput()
rad_mod = ClusterInput()
rad_mod_2 = ClusterInput()
face = HBFace(geo=item, name="Ceiling", bc="Adiabatic", rad_mod=rad_mod)  # -> report, faces; plug-in component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
face_2 = HBFace(geo=flatten([item_3, merge]), name="Partition Walls", bc="Adiabatic", rad_mod=relay)  # -> report, faces; plug-in component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
face_3 = HBFace(geo=item_2, name="Floor", bc="Adiabatic", rad_mod=rad_mod_2)  # -> report, faces; plug-in component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
face_4 = HBFace(geo=item_4, name="Façades", bc="Outdoors", ep_constr=ep_constr, rad_mod=relay)  # -> report, faces; plug-in component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
face_5 = HBFace(geo=srf_2, name="Air", type="AirBoundary", bc="Adiabatic")  # -> report, faces; plug-in component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
merge_2 = Merge(
    Data1=flatten(face_4.faces),
    Data2=flatten(face_5.faces),
    Data3=flatten(face_2.faces),
    Data4=flatten(face_3.faces),
    Data5=flatten(face.faces))  # -> simplify(Result)
R = ClusterOutput(merge_2)

# ==== cluster ClusterAlternate
B = ClusterInput()
debrep = DeconstructBrep(Brep=B)  # -> simplify(Faces), Edges, Vertices
B_2 = ClusterInput()
item = ListItem(List=debrep.Faces, Index="1", Wrap=True)
item_2 = ListItem(List=debrep.Faces, Index="5", Wrap=True)
item_3 = ListItem(List=debrep.Faces, Index="2", Wrap=True)
item_4 = ListItem(List=debrep.Faces, Index="4", Wrap=True)
item_5 = ListItem(List=debrep.Faces, Index="3", Wrap=True)
item_6 = ListItem(List=debrep.Faces, Index="0", Wrap=True)
debrep_2 = DeconstructBrep(Brep=B_2)  # -> Faces, Edges, Vertices
debrep_3 = DeconstructBrep(Brep=item)  # -> Faces, Edges, Vertices
item_7 = ListItem(List=debrep_2.Vertices, Index=Slider(3, range=0..3), Wrap=True)
item_8 = ListItem(List=debrep_2.Vertices, Index=Slider(1, range=0..3), Wrap=True)
item_9 = ListItem(List=debrep_3.Vertices, Index=Slider(2, range=0..3), Wrap=True)
item_10 = ListItem(List=debrep_3.Vertices, Index=Slider(1, range=0..3), Wrap=True)
yz = YZPlane(Origin=item_9)
relay = ClusterInput()
rec_2pt = Rectangle2Pt(Plane=yz, PointA=item_9, PointB=item_7, Radius=0)  # -> Rectangle, Length
rec_2pt_2 = Rectangle2Pt(Plane=yz, PointA=item_8, PointB=item_10, Radius=0)  # -> Rectangle, Length
rad_mod = ClusterInput()
rad_mod_2 = ClusterInput()
ep_constr = ClusterInput()
srf = Surface(rec_2pt.Rectangle)
srf_2 = Surface(rec_2pt_2.Rectangle)
face = HBFace(geo=item_2, name="Ceiling", bc="Adiabatic", rad_mod=rad_mod)  # -> report, faces; plug-in component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
face_2 = HBFace(geo=item_4, name="Floor", bc="Adiabatic", rad_mod=rad_mod_2)  # -> report, faces; plug-in component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
face_3 = HBFace(geo=item_3, name="Corridor Walls", bc="outdoors", rad_mod=relay)  # -> report, faces; plug-in component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
face_4 = HBFace(geo=[item_5, srf], name="Partition Walls", bc="Adiabatic", rad_mod=relay)  # -> report, faces; plug-in component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
face_5 = HBFace(geo=item_6, name="Façades", bc="Outdoors", ep_constr=ep_constr, rad_mod=relay)  # -> report, faces; plug-in component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
face_6 = HBFace(geo=srf_2, name="Air", type="AirBoundary", bc="outdoors", rad_mod=relay)  # -> report, faces; plug-in component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
merge = Merge(
    Data1=flatten(face_6.faces),
    Data2=flatten(face_5.faces),
    Data3=flatten(face_4.faces),
    Data4=flatten(face_3.faces),
    Data5=flatten(face_2.faces),
    Data6=flatten(face.faces))  # -> simplify(Result)
R = ClusterOutput(merge)

# ==== cluster ClusterAlternate2
B = ClusterInput()
debrep = DeconstructBrep(Brep=B)  # -> simplify(Faces), Edges, Vertices
item = ListItem(List=debrep.Faces, Index="5", Wrap=True)
item_2 = ListItem(List=debrep.Faces, Index="2", Wrap=True)
item_3 = ListItem(List=debrep.Faces, Index="4", Wrap=True)
item_4 = ListItem(List=debrep.Faces, Index="1", Wrap=True)
item_5 = ListItem(List=debrep.Faces, Index="0", Wrap=True)
B_2 = ClusterInput()
item_6 = ListItem(List=debrep.Faces, Index="3", Wrap=True)
debrep_2 = DeconstructBrep(Brep=B_2)  # -> simplify(Faces), Edges, Vertices
debrep_3 = DeconstructBrep(Brep=item_6)  # -> simplify(Faces), Edges, Vertices
item_7 = ListItem(List=debrep_2.Vertices, Index=Slider(1, range=0..3), Wrap=True)
item_8 = ListItem(List=debrep_2.Vertices, Index=Slider(3, range=0..3), Wrap=True)
item_9 = ListItem(List=debrep_3.Vertices, Index=Slider(2, range=0..3), Wrap=True)
item_10 = ListItem(List=debrep_3.Vertices, Index=Slider(1, range=0..3), Wrap=True)
yz = YZPlane(Origin=item_7)
relay = ClusterInput()
rec_2pt = Rectangle2Pt(Plane=yz, PointA=item_8, PointB=item_9, Radius=0)  # -> Rectangle, Length
rec_2pt_2 = Rectangle2Pt(Plane=yz, PointA=item_10, PointB=item_7, Radius=0)  # -> Rectangle, Length
rad_mod = ClusterInput()
rad_mod_2 = ClusterInput()
ep_constr = ClusterInput()
face = HBFace(geo=item, name="Ceiling", bc="Adiabatic", rad_mod=rad_mod)  # -> report, faces; plug-in component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
face_2 = HBFace(geo=item_3, name="Floor", bc="Adiabatic", rad_mod=rad_mod_2)  # -> report, faces; plug-in component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
face_3 = HBFace(geo=item_2, name="Corridor Walls", bc="outdoors", rad_mod=relay)  # -> report, faces; plug-in component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
face_4 = HBFace(geo=item_5, name="Façades", bc="Outdoors", ep_constr=ep_constr, rad_mod=relay)  # -> report, faces; plug-in component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
srf = Surface(rec_2pt_2.Rectangle)
srf_2 = Surface(rec_2pt.Rectangle)
face_5 = HBFace(geo=[item_4, srf_2], name="Partition Walls", bc="Adiabatic", rad_mod=relay)  # -> report, faces; plug-in component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
face_6 = HBFace(geo=srf, name="Air", type="AirBoundary", bc="outdoors")  # -> report, faces; plug-in component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
merge = Merge(
    Data1=flatten(face_6.faces),
    Data2=flatten(face_4.faces),
    Data3=flatten(face_5.faces),
    Data4=flatten(face_3.faces),
    Data5=flatten(face_2.faces),
    Data6=flatten(face.faces))
R = ClusterOutput(merge)

# ==== cluster Cluster_2
B = ClusterInput()
B_2 = ClusterInput()
wdws = ClusterInput()
doors = ClusterInput()
debrep = DeconstructBrep(Brep=B)  # -> Faces, Edges, Vertices
debrep_2 = DeconstructBrep(Brep=B_2)  # -> Faces, Edges, Vertices
area = Area(Geometry=doors)  # -> Area, Centroid
item = TreeItem(Tree=simplify(debrep.Faces), Path="{0}", Index=Slider(3, range=0..5), Wrap=True)
area_2 = Area(Geometry=wdws)  # -> Area, Centroid
item_2 = ListItem(List=debrep.Faces, Index=0, Wrap=True)
item_3 = ListItem(List=debrep_2.Faces, Index=0, Wrap=True)
item_4 = ListItem(List=debrep.Faces, Index=[Slider(1, range=0..5), Slider(2, range=0..5)], Wrap=True)
item_5 = ListItem(List=debrep_2.Faces, Index=[Slider(3, range=0..5), Slider(1, range=0..5)], Wrap=True)
ma = MassAddition(Input=area_2.Area)  # -> Result, PartialResults
ma_2 = MassAddition(Input=area.Area)  # -> Result, PartialResults
merge = Merge(Data1=flatten(item_4), Data2=flatten(item), Data3=flatten(item_5))
merge_2 = Merge(Data1=flatten(item_2), Data2=flatten(item_3))
area_3 = Area(Geometry=merge_2)  # -> Area, Centroid
area_4 = Area(Geometry=merge)  # -> Area, Centroid
ma_3 = MassAddition(Input=area_3.Area)  # -> Result, PartialResults
ma_4 = MassAddition(Input=area_4.Area)  # -> Result, PartialResults
subtraction = Subtraction(A=ma_4.Result, B=ma_2.Result)
subtraction_2 = Subtraction(A=ma_3.Result, B=ma.Result)
façade = ClusterOutput(subtraction_2)
partitions = ClusterOutput(subtraction)

# ==== cluster Cluster_3
A = ClusterInput()
P = ClusterInput()
A_2 = ClusterInput()
B = ClusterInput()
multiplication = Multiplication(A=A, B=2)
F = ClusterInput()
rec_2pt = Rectangle2Pt(Plane=P, PointA=A_2, PointB=B, Radius=0)  # -> Rectangle, Length
neg = Negative(Value=multiplication)
Z = UnitZ(Factor=F)
move = Move(Geometry=rec_2pt.Rectangle, Motion=expr("-x*2", Z))  # -> Geometry, Transform
rotate = Rotate(Geometry=move.Geometry, Angle=1.570796327, Plane=PlaneXY(0, 0, 0))  # -> Geometry, Transform
explode = Explode(Curve=move.Geometry, Recursive=True)  # -> Segments, Vertices
area = Area(Geometry=rec_2pt.Rectangle)  # -> Area, Centroid
move_2 = Move(Geometry=rec_2pt.Rectangle, Motion=Z)  # -> Geometry, Transform
explode_2 = Explode(Curve=rotate.Geometry, Recursive=True)  # -> Segments, Vertices
R = ClusterOutput(rec_2pt.Rectangle)
xz = XZPlane(Origin=area.Centroid)
item = ListItem(List=explode.Vertices, Index=Slider(2, range=0..3), Wrap=True)
item_2 = ListItem(List=explode_2.Vertices, Index=Slider(3, range=0..3), Wrap=True)
boxrec = BoxRectangle(Rectangle=rec_2pt.Rectangle, Height=neg)
item_3 = ListItem(List=explode.Vertices, Index=Slider(3, range=0..3), Wrap=True)
boxrec_2 = BoxRectangle(Rectangle=move_2.Geometry, Height=multiplication)
vec2pt = Vector2Pt(PointA=item_2, PointB=item, Unitize=False)  # -> Vector, Length
merge = Merge(Data1=boxrec_2, Data2=boxrec)
move_3 = Move(Geometry=rotate.Geometry, Motion=vec2pt.Vector)  # -> Geometry, Transform
explode_3 = Explode(Curve=move_3.Geometry, Recursive=True)  # -> Segments, Vertices
item_4 = ListItem(List=explode_3.Vertices, Index=Slider(2, range=0..3), Wrap=True)
ln = Line(StartPoint=item_3, EndPoint=item_4)
midpt = CurveMiddle(Curve=ln)
yz = YZPlane(Origin=midpt)
xz_2 = XZPlane(Origin=midpt)
mirror = Mirror(Geometry=move_3.Geometry, Plane=yz)  # -> Geometry, Transform
mirror_2 = Mirror(Geometry=move.Geometry, Plane=xz_2)  # -> Geometry, Transform
A_3 = ClusterInput()
multiplication_2 = Multiplication(A=A_3, B=5)
Z_2 = UnitZ(Factor=multiplication_2)
boxrec_3 = BoxRectangle(Rectangle=mirror_2.Geometry, Height=Z_2)
boxrec_4 = BoxRectangle(Rectangle=mirror.Geometry, Height=Z_2)
boxrec_5 = BoxRectangle(Rectangle=move_3.Geometry, Height=Z_2)
debox = DeconstructBox(Box=boxrec_3)  # -> Plane, X, Y, Z
debox_2 = DeconstructBox(Box=boxrec_4)  # -> Plane, X, Y, Z
debox_3 = DeconstructBox(Box=boxrec_5)  # -> Plane, X, Y, Z
facen = FaceNormals(Mesh=debox.Plane)  # -> Centers, Normals
facen_2 = FaceNormals(Mesh=debox_2.Plane)  # -> Centers, Normals
facen_3 = FaceNormals(Mesh=debox_3.Plane)  # -> Centers, Normals
devec = DeconstructVector(Vector=facen.Normals)  # -> XComponent, YComponent, ZComponent
devec_2 = DeconstructVector(Vector=facen_2.Normals)  # -> XComponent, YComponent, ZComponent
devec_3 = DeconstructVector(Vector=facen_3.Normals)  # -> XComponent, YComponent, ZComponent
equals = Equality(FirstNumber=devec.ZComponent, SecondNumber="-1")  # -> Equality, Inequality
equals_2 = Equality(FirstNumber=devec_2.ZComponent, SecondNumber="-1")  # -> Equality, Inequality
equals_3 = Equality(FirstNumber=devec_3.ZComponent, SecondNumber="-1")  # -> Equality, Inequality
num = Number(equals.Equality)
num_2 = Number(equals_2.Equality)
num_3 = Number(equals_3.Equality)
gate = StreamGate(Stream=boxrec_3, Gate=num)  # -> Target0, Target1
gate_2 = StreamGate(Stream=boxrec_5, Gate=num_3)  # -> Target0, Target1
gate_3 = StreamGate(Stream=boxrec_4, Gate=num_2)  # -> Target0, Target1
xy = XYPlane(Origin=Point(0, 0, 0))
mirror_3 = Mirror(Geometry=gate_3.Target1, Plane=xy)  # -> Geometry, Transform
mirror_4 = Mirror(Geometry=gate_2.Target1, Plane=xy)  # -> Geometry, Transform
mirror_5 = Mirror(Geometry=gate.Target1, Plane=xy)  # -> Geometry, Transform
merge_2 = Merge(
    Data1=flatten(gate_2.Target0),
    Data2=flatten(mirror_4.Geometry),
    Data3=flatten(gate_3.Target0),
    Data4=flatten(mirror_3.Geometry),
    Data5=flatten(gate.Target0),
    Data6=flatten(mirror_5.Geometry))
mirror_6 = Mirror(Geometry=merge_2, Plane=xz)  # -> Geometry, Transform
merge_3 = Merge(Data1=merge_2, Data2=mirror_6.Geometry, Data3=merge)
R_2 = ClusterOutput(merge_3)

# ==== cluster Cluster_4
open_space = ClusterInput()
rooms = ClusterInput()
number_slider = Slider(0, range=0..5)
number_slider_2 = Slider(2, range=0..5)
doors = ClusterInput()
corridor = ClusterInput()
debrep = DeconstructBrep(Brep=rooms)  # -> simplify(Faces), Edges, Vertices
debrep_2 = DeconstructBrep(Brep=open_space)  # -> Faces, Edges, Vertices
debrep_3 = DeconstructBrep(Brep=corridor)  # -> Faces, Edges, Vertices
area = Area(Geometry=doors)  # -> Area, Centroid
item = TreeItem(Tree=simplify(debrep.Faces), Path="{0}", Index=Slider(3, range=0..5), Wrap=True)
item_2 = ListItem(List=debrep_3.Faces, Index=Slider(3, range=0..5), Wrap=True)
item_3 = TreeItem(Tree=simplify(debrep.Faces), Path="{3}", Index=Slider(3, range=0..5), Wrap=True)
item_4 = ListItem(List=debrep.Faces, Index=[Slider(1, range=0..5), Slider(2, range=0..5)], Wrap=True)
item_5 = ListItem(List=debrep_2.Faces, Index=Slider(1, range=0..5), Wrap=True)
ma = MassAddition(Input=area.Area)  # -> Result, PartialResults
merge = Merge(Data1=flatten(item_4), Data2=flatten(item), Data3=flatten(item_3), Data4=flatten(item_5), Data5=flatten(item_2))
area_2 = Area(Geometry=merge)  # -> Area, Centroid
ma_2 = MassAddition(Input=area_2.Area)  # -> Result, PartialResults
subtraction = Subtraction(A=ma_2.Result, B=ma.Result)
partitions = ClusterOutput(subtraction)

# ==== cluster Cluster_5
open_space = ClusterInput()
rooms = ClusterInput()
number_slider = Slider(0, range=0..5)
number_slider_2 = Slider(2, range=0..5)
doors = ClusterInput()
open_space_2 = ClusterInput()
debrep = DeconstructBrep(Brep=rooms)  # -> simplify(Faces), Edges, Vertices
debrep_2 = DeconstructBrep(Brep=open_space)  # -> Faces, Edges, Vertices
debrep_3 = DeconstructBrep(Brep=open_space_2)  # -> Faces, Edges, Vertices
area = Area(Geometry=doors)  # -> Area, Centroid
item = TreeItem(Tree=simplify(debrep.Faces), Path="{0}", Index=Slider(3, range=0..5), Wrap=True)
item_2 = ListItem(List=debrep_3.Faces, Index=Slider(1, range=0..5), Wrap=True)
item_3 = TreeItem(Tree=simplify(debrep.Faces), Path="{3}", Index=Slider(3, range=0..5), Wrap=True)
item_4 = ListItem(List=debrep.Faces, Index=[Slider(1, range=0..5), Slider(2, range=0..5)], Wrap=True)
item_5 = ListItem(List=debrep_2.Faces, Index=Slider(3, range=0..5), Wrap=True)
ma = MassAddition(Input=area.Area)  # -> Result, PartialResults
merge = Merge(Data1=flatten(item_4), Data2=flatten(item), Data3=flatten(item_3), Data4=flatten(item_5), Data5=flatten(item_2))
area_2 = Area(Geometry=merge)  # -> Area, Centroid
ma_2 = MassAddition(Input=area_2.Area)  # -> Result, PartialResults
subtraction = Subtraction(A=ma_2.Result, B=ma.Result)
partitions = ClusterOutput(subtraction)
