# Grasshopper definition Geometry Generation File.gh (Grasshopper 1.0.7)
# plug-ins: treesloth01

ground_to_window_height = Slider(1.2, range=0..10)
window_base_dimension_1 = Slider(0.22, range=0..1)
window_base_dimension_2 = Slider(0.3, range=0..1)
window_base_dimension_3 = Slider(0.38, range=0..1)
window_to_ceiling_height = Slider(0.5, range=0..1)
partition_wall_thickness = Slider(0.2, range=0..1)
external_wall_thickness = Slider(0.3, range=0..1)
functions_ratio = Slider(0.5, range=0..1)
circulation_size = Slider(1, range=0..1)
ceiling_height = Slider(3.7, range=2.4..4)
door_height = Slider(2.5, range=2..3)
door_width = Slider(1, range=0.8..1.2)
width_1 = Slider(8.8, range=5..40)
width_2 = Slider(12, range=5..40)
width_3 = Slider(15.2, range=5..40)
part_1 = Slider(2.9, range=2..10)
part_1_2 = Slider(3.6, range=2..10)
part_1_3 = Slider(5.4, range=2..10)
merge = Merge(Data1=window_base_dimension_1, Data2=window_base_dimension_2, Data3=window_base_dimension_3)
merge_2 = Merge(Data1=width_1, Data2=width_2, Data3=width_3)
merge_3 = Merge(Data1=part_1, Data2=part_1_2, Data3=part_1_3)
cluster = Cluster_28(room_sizes=merge_3, max_length="100")  # -> flatten(lengths), division_settings
lng = ListLength(List=merge_2)
series = Series(Start=0, Step=1, Count=lng)
prepend_element = PrependElement(Data=cluster.division_settings, Index=series)
series_2 = Series(Start=0, Step=1, Count="8")
append_element = AppendElement(Data=prepend_element, Index=series_2)
shape = Shape(X=merge_2, T=merge_2, B=cluster.lengths)
merge_4 = Merge(Data1="False", Data2="True", Data3="True")
merge_5 = Merge(Data1="True", Data2="False", Data3="False")
cull = CullPattern(List=shape, CullPattern=merge_5)
cull_2 = CullPattern(List=shape, CullPattern=merge_4)
series_3 = Series(Start=0, Step=1, Count="3")
width_division = WidthDivision(C=cull_2)  # -> start_mid, start_3_cuts, end_mid, end_3_cuts
append_element_2 = AppendElement(Data=simplify(graft(merge_2)), Index=series_3)
cluster_2 = Cluster_15(B="1", L_2=cluster.lengths, L=merge_2, L_3=cull, i="2")
cluster_3 = Cluster_15(B="2", L_2=cluster.lengths, L=merge_2, L_3=cull, i=["0", "3"])
cluster_4 = Cluster_15(B="3", L_2=cluster.lengths, L=merge_2, L_3=cull, i=["0", "3"])
cluster_5 = Cluster_15(B="4", L_2=cluster.lengths, L=merge_2, L_3=cull, i=["0", "4"])
cluster_6 = Cluster_15(B="5", L_2=cluster.lengths, L=merge_2, L_3=cull, i="2")
cluster_7 = Cluster_15(B="6", L_2=cluster.lengths, L=merge_2, L_3=cull, i=["2", "3"])
cluster_8 = Cluster_15(B="7", L_2=cluster.lengths, L=merge_2, L_3=cull, i=["2", "3"])
series_4 = Series(Start=0, Step=1, Count="8")
append_element_3 = AppendElement(Data=append_element_2, Index=series_4)
ln = Line(StartPoint=width_division.start_mid, EndPoint=width_division.end_mid)
cluster_9 = Cluster_30(mid_lines=ln, facade_wall_w=external_wall_thickness)
ln_2 = Line(StartPoint=width_division.start_3_cuts, EndPoint=width_division.end_3_cuts)
addition = Addition(A=append_element_3, B=external_wall_thickness)
division = Division(A=addition, B="2")
length_division = LengthDivision(
    ext_lines=cull_2,
    _2_segments_mid_line=ln,
    circulation_size=circulation_size,
    part_deg=append_element,
    proportion_0_5=functions_ratio,
    _3_seg_lines=ln_2)  # -> _1_ext, _1_int, _1_ext_r, _2_ext_1, _2_int_1, _2_ext_2, _2_int_2, _2_ext_r_1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
offset = OffsetCurve(Curve=cluster_9, Distance=expr("-x", division), Corners=1)
offset_2 = OffsetCurve(Curve=cluster_9, Distance=division, Corners=1)
division_2 = Division(A=external_wall_thickness, B="2")
division_3 = Division(A=partition_wall_thickness, B="2")
cluster_10 = Cluster_37(data=offset)
merge_6 = Merge(Data1=cluster_2, Data2=cluster_3, Data3=cluster_4, Data4=cluster_5, Data5=cluster_6, Data6=cluster_7, Data7=cluster_8)
cluster_11 = Cluster_37(data=offset_2)
lng_2 = ListLength(List=cluster.division_settings)
ext = ExtendCurve(Curve=merge_6, Type=0, Start=expr("-0.5*x", external_wall_thickness), End=expr("-0.5*x", external_wall_thickness))
series_5 = Series(Start=0, Step=1, Count=lng_2)
lng_3 = ListLength(List=merge)
trim = TrimTree(Tree=cluster_10, Depth=1)
trim_2 = TrimTree(Tree=cluster_11, Depth=1)
append_element_4 = AppendElement(Data=ext, Index=series_5)
series_6 = Series(Start=0, Step=1, Count=lng_3)
selection = Selection(
    int_pts=length_division._1_int,
    ext_pts=length_division._1_ext,
    door_width=door_width,
    window_size=merge,
    half_part_wall_width=division_3,
    half_facade_width=division_2,
    rest=length_division._1_ext_r,
    meeting_room="True",
    scenario="0")  # -> room_corridor_wall, door, part_wall, facade_wall, window, rest_facade_wall, rest_window
selection_2 = Selection_2(
    int_pts=length_division._2_int_1,
    ext_pts=length_division._2_ext_1,
    door_width=door_width,
    window_size=merge,
    half_part_wall_width=division_3,
    half_facade_width=division_2,
    rest=length_division._2_ext_r_1,
    meeting_room="True",
    scenario="1")  # -> room_corridor_wall, door, part_wall, facade_wall, window, rest_facade_wall, rest_window
selection_3 = Selection_2(
    int_pts=length_division._2_int_2,
    ext_pts=length_division._2_ext_2,
    door_width=door_width,
    window_size=merge,
    half_part_wall_width=division_3,
    half_facade_width=division_2,
    rest=length_division._2_ext_r_2,
    meeting_room="False",
    scenario="1")  # -> room_corridor_wall, door, part_wall, facade_wall, window, rest_facade_wall, rest_window
selection_4 = Selection_2(
    int_pts=length_division._3_int_1,
    ext_pts=length_division._3_ext_1,
    door_width=door_width,
    window_size=merge,
    half_part_wall_width=division_3,
    half_facade_width=division_2,
    rest=length_division._3_ext_r_1,
    meeting_room="True",
    scenario="2")  # -> room_corridor_wall, door, part_wall, facade_wall, window, rest_facade_wall, rest_window
selection_5 = Selection_3(
    int_pts=length_division._3_int_2,
    ext_pts=length_division._3_ext_2,
    door_width=door_width,
    window_size=merge,
    half_part_wall_width=division_3,
    half_facade_width=division_2,
    rest=length_division._3_ext_r_2,
    meeting_room="False",
    scenario="2")  # -> room_corridor_wall, door, part_wall, facade_wall, window, rest_facade_wall, rest_window
selection_6 = Selection_2(
    int_pts=length_division._4_int_1,
    ext_pts=length_division._4_ext_1,
    door_width=door_width,
    window_size=merge,
    half_part_wall_width=division_3,
    half_facade_width=division_2,
    rest=length_division._4_ext_r_1,
    meeting_room="True",
    scenario="3")  # -> room_corridor_wall, door, part_wall, facade_wall, window, rest_facade_wall, rest_window
selection_7 = Selection_2(
    int_pts=length_division._4_int_2,
    ext_pts=length_division._4_ext_2,
    door_width=door_width,
    window_size=merge,
    half_part_wall_width=division_3,
    half_facade_width=division_2,
    rest=length_division._4_ext_r_2,
    meeting_room="False",
    scenario="3")  # -> room_corridor_wall, door, part_wall, facade_wall, window, rest_facade_wall, rest_window
midpt = CurveMiddle(Curve=trim)
midpt_2 = CurveMiddle(Curve=trim_2)
append_element_5 = AppendElement(Data=append_element_4, Index=series_6)
series_7 = Series(Start=0, Step=1, Count="4")
pdecon = Deconstruct(Point=midpt)  # -> XComponent, YComponent, ZComponent
pdecon_2 = Deconstruct(Point=midpt_2)  # -> XComponent, YComponent, ZComponent
append_element_6 = AppendElement(Data=append_element_5, Index=series_7)
sort = SortList(Keys=pdecon.YComponent, ValuesA=trim)  # -> Keys, graft(ValuesA)
sort_2 = SortList(Keys=pdecon_2.YComponent, ValuesA=trim_2)  # -> Keys, graft(ValuesA)
subtraction = Subtraction(A=ceiling_height, B=window_to_ceiling_height)
subtraction_2 = Subtraction(A=ceiling_height, B=door_height)
end = EndPoints(Curve=sort_2.ValuesA)  # -> Start, End
end_2 = EndPoints(Curve=sort.ValuesA)  # -> Start, End
ln_3 = Line(StartPoint=end_2.Start, EndPoint=end.Start)
ln_4 = Line(StartPoint=end_2.End, EndPoint=end.End)
ext_2 = ExtendCurve(Curve=ln_3, Type=0, Start="-0.15", End="-0.15")
ext_3 = ExtendCurve(Curve=ln_4, Type=0, Start="-0.15", End="-0.15")
end_3 = EndPoints(Curve=ext_2)  # -> Start, End
end_4 = EndPoints(Curve=ext_3)  # -> Start, End
merge_7 = Merge(
    Data1=selection.room_corridor_wall,
    Data2=selection_2.room_corridor_wall,
    Data3=selection_3.room_corridor_wall,
    Data4=selection_4.room_corridor_wall,
    Data5=selection_5.room_corridor_wall,
    Data6=selection_6.room_corridor_wall,
    Data7=selection_7.room_corridor_wall)
merge_8 = Merge(
    Data1=selection.door,
    Data2=selection_2.door,
    Data3=selection_3.door,
    Data4=selection_4.door,
    Data5=selection_5.door,
    Data6=selection_6.door,
    Data7=selection_7.door)
merge_9 = Merge(
    Data1=selection.facade_wall,
    Data2=selection_2.facade_wall,
    Data3=selection_3.facade_wall,
    Data4=selection_4.facade_wall,
    Data5=selection_5.facade_wall,
    Data6=selection_6.facade_wall,
    Data7=selection_7.facade_wall)
merge_10 = Merge(
    Data1=selection.window,
    Data2=selection_2.window,
    Data3=selection_3.window,
    Data4=selection_4.window,
    Data5=selection_5.window,
    Data6=selection_6.window,
    Data7=selection_7.window)
merge_11 = Merge(
    Data1=selection.rest_facade_wall,
    Data2=selection_2.rest_facade_wall,
    Data3=selection_3.rest_facade_wall,
    Data4=selection_4.rest_facade_wall,
    Data5=selection_5.rest_facade_wall,
    Data6=selection_6.rest_facade_wall,
    Data7=selection_7.rest_facade_wall)
merge_12 = Merge(
    Data1=selection.rest_window,
    Data2=selection_2.rest_window,
    Data3=selection_3.rest_window,
    Data4=selection_4.rest_window,
    Data5=selection_5.rest_window,
    Data6=selection_6.rest_window,
    Data7=selection_7.rest_window)
merge_13 = Merge(
    Data1=selection.part_wall,
    Data2=selection_2.part_wall,
    Data3=selection_3.part_wall,
    Data4=selection_4.part_wall,
    Data5=selection_5.part_wall,
    Data6=selection_6.part_wall,
    Data7=selection_7.part_wall)
rec_3pt = Rectangle3Pt(PointA=end_2.Start, PointB=end.Start, PointC=end.End)  # -> Rectangle, Length
Z = UnitZ(Factor=ceiling_height)
offset_3 = OffsetCurve(Curve=ext_3, Distance=expr("-x", "0.3"), Corners=1)
offset_4 = OffsetCurve(Curve=ext_2, Distance="0.3", Corners=1)
neg = Negative(Value="0.3")
move = Move(Geometry=rec_3pt.Rectangle, Motion=Z)  # -> Geometry, Transform
merge_14 = Merge(Data1=merge_10, Data2=merge_12)
merge_15 = Merge(Data1=merge_9, Data2=merge_11, Data3=append_element_6)
end_5 = EndPoints(Curve=offset_4)  # -> Start, End
end_6 = EndPoints(Curve=offset_3)  # -> Start, End
boxrec = BoxRectangle(Rectangle=move.Geometry, Height="0.3")
boxrec_2 = BoxRectangle(Rectangle=rec_3pt.Rectangle, Height=neg)
door = Door(relay=merge_8, D=division_3, F=door_height, relay_2=subtraction_2)  # -> B, doors_flat, doors_vol
window = Window(H=ground_to_window_height, relay=merge_14, D=division_2, F=subtraction, relay_2=window_to_ceiling_height)  # -> B, B_2, windows_flat, windows_vol
facade_full_h = RoomCorridorWall(relay=merge_15, D=division_2, relay_2=ceiling_height)
room_corridor_wall = RoomCorridorWall(relay=merge_7, D=division_3, relay_2=ceiling_height)
part_wall = RoomCorridorWall(relay=merge_13, D=division_3, relay_2=ceiling_height)
rec_3pt_2 = Rectangle3Pt(PointA=end_4.Start, PointB=end_4.End, PointC=simplify(end_6.Start))  # -> Rectangle, Length
rec_3pt_3 = Rectangle3Pt(PointA=end_3.Start, PointB=end_3.End, PointC=simplify(end_5.Start))  # -> Rectangle, Length
addition_2 = Addition(A=ceiling_height, B="0.3")
merge_16 = Merge(Data1=boxrec_2, Data2=boxrec)
cluster_12 = Cluster_32(relay=rec_3pt_3.Rectangle)
cluster_13 = Cluster_33(relay=rec_3pt_2.Rectangle)
dom = ConstructDomain(DomainStart="-0.3", DomainEnd=addition_2)
series_8 = Series(Start=0, Step=1, Count="3")
trim_3 = TrimTree(Tree=merge_16, Depth=1)
neg_2 = Negative(Value=dom)
panel = Panel("D:\Maximawiti\Nouveau dossier\UCL\TFE")
append_element_7 = AppendElement(Data=trim_3, Index=series_8)
boxrec_3 = BoxRectangle(Rectangle=cluster_13, Height=dom)
boxrec_4 = BoxRectangle(Rectangle=cluster_12, Height=neg_2)
append_element_8 = AppendElement(Data=append_element_7, Index=series_8)
series_9 = Series(Start=0, Step=1, Count="4")
merge_17 = Merge(Data1=room_corridor_wall, Data2=door.B, Data3=part_wall)
merge_18 = Merge(Data1=facade_full_h, Data2=window.B, Data3=window.B_2)
trim_4 = TrimTree(Tree=boxrec_3, Depth=1)
trim_5 = TrimTree(Tree=boxrec_4, Depth=1)
series_10 = Series(Start=0, Step=1, Count="3")
append_element_9 = AppendElement(Data=append_element_8, Index=series_9)
concat = Concatenate(
    FragmentA="{",
    FragmentB=Slider(0, range=0..2),
    FragmentC=";",
    FragmentD=Slider(1, range=0..2),
    FragmentE=";",
    FragmentF=Slider(1, range=0..7),
    FragmentG=";",
    FragmentH=Slider(0, range=0..2),
    FragmentI=";",
    FragmentJ=Slider(2, range=0..2),
    FragmentL=";",
    FragmentM=Slider(0, range=0..3),
    FragmentK="}")
cluster_14 = Cluster_36(directory=panel, file_name="Windows Flat ", data=window.windows_flat)
cluster_15 = Cluster_36(directory=panel, file_name="Windows ", data=window.windows_vol)
cluster_16 = Cluster_36(directory=panel, file_name="Façade Wall ", data=merge_18)
cluster_17 = Cluster_36(directory=panel, file_name="Part Wall ", data=merge_17)
cluster_18 = Cluster_36(directory=panel, file_name="Doors ", data=door.doors_vol)
append_element_10 = AppendElement(Data=trim_5, Index=series_10)
append_element_11 = AppendElement(Data=trim_4, Index=series_10)
cluster_19 = Cluster_36(directory="D:\Maximawiti\Nouveau dossier\UCL\TFE", file_name="Floor + Roof ", data=append_element_9)
append_element_12 = AppendElement(Data=append_element_10, Index=series_10)
append_element_13 = AppendElement(Data=append_element_11, Index=series_10)
series_11 = Series(Start=0, Step=1, Count="4")
append_element_14 = AppendElement(Data=append_element_12, Index=series_11)
append_element_15 = AppendElement(Data=append_element_13, Index=series_11)
merge_19 = Merge(
    Data1=room_corridor_wall,
    Data2=door.B,
    Data3=door.doors_vol,
    Data4=part_wall,
    Data5=facade_full_h,
    Data6=window.B,
    Data7=window.B_2,
    Data8=window.windows_vol,
    Data9=append_element_9,
    Data10=append_element_14,
    Data11=append_element_15)
branch = TreeBranch(Tree=merge_19, Path=concat, MaintainPaths=True)
concat_2 = Concatenate(
    FragmentA="{",
    FragmentB=Slider(0, range=0..2),
    FragmentC=";",
    FragmentD=Slider(0, range=0..2),
    FragmentE=";",
    FragmentF=Slider(1, range=0..7),
    FragmentG=";",
    FragmentH=Slider(0, range=0..2),
    FragmentI=";",
    FragmentJ=Slider(0, range=0..2),
    FragmentL=";",
    FragmentM=Slider(0, range=0..3),
    FragmentK="}")
cluster_20 = Cluster_36(directory="D:\Maximawiti\Nouveau dossier\UCL\TFE", file_name="PH Walls i ", data=append_element_14)
branch_2 = TreeBranch(Tree=append_element_15, Path=concat_2, MaintainPaths=True)
cluster_21 = Cluster_36(directory="D:\Maximawiti\Nouveau dossier\UCL\TFE", file_name="PH Walls f ", data=append_element_15)

# ==== cluster Shape
X = ClusterInput()
T = ClusterInput()
B = ClusterInput()
repeat = RepeatData(Data="3", Length="3")  # -> simplify(graft(Data))
concat = Concatenate(
    FragmentA="{",
    FragmentB=Slider(0, range=0..2),
    FragmentC=";",
    FragmentD=Slider(0, range=0..2),
    FragmentF=";",
    FragmentG=Slider(7, range=0..7),
    FragmentE="}")

graft = GraftTree(Tree=T, IncludeEmptyLists=True, IncludeNullItems=True)  # -> simplify(Tree)
addition = Addition(A=graft, B=B)
X_2 = UnitX(Factor=addition)

rectangle = Rectangle(Plane=PlaneXY(0, 0, 0), XSize=X, YSize=X, Radius=0)  # -> Rectangle, Length
graft_2 = GraftTree(Tree=rectangle.Rectangle, IncludeEmptyLists=True, IncludeNullItems=True)  # -> simplify(Tree)
cp = ControlPoints(Curve=rectangle.Rectangle)  # -> Points, Weights, Knots
explode = Explode(Curve=rectangle.Rectangle, Recursive=True)  # -> Segments, Vertices
item = ListItem(List=explode.Segments, Index="1", Wrap=True)  # -> simplify(Item)
item_2 = ListItem(List=cp.Points, Index=["1", "2"], Wrap=True)  # -> simplify(Item)
item_3 = ListItem(List=item_2, Index=0, Wrap=True)
item_4 = ListItem(List=item_2, Index="1", Wrap=True)
repeat_2 = RepeatData(Data=item_3, Length="3")  # -> simplify(graft(Data))
repeat_3 = RepeatData(Data=item_4, Length="3")  # -> simplify(graft(Data))

move = Move(Geometry=graft_2, Motion=X_2)  # -> Geometry, Transform
cp_2 = ControlPoints(Curve=move.Geometry)  # -> Points, Weights, Knots
item_5 = ListItem(List=cp_2.Points, Index=["4", "3"], Wrap=True)  # -> simplify(Item)
item_6 = ListItem(List=cp_2.Points, Index=["2", "3"], Wrap=True)
item_7 = ListItem(List=item_5, Index=0, Wrap=True)
item_8 = ListItem(List=item_5, Index="1", Wrap=True)

Y = UnitY(Factor=addition)
move_2 = Move(Geometry=move.Geometry, Motion=Y)  # -> Geometry, Transform
explode_2 = Explode(Curve=move_2.Geometry, Recursive=True)  # -> Segments, Vertices
cp_3 = ControlPoints(Curve=move_2.Geometry)  # -> Points, Weights, Knots
item_9 = ListItem(List=cp_3.Points, Index=["1", "0"], Wrap=True)
item_10 = ListItem(List=explode_2.Segments, Index=0, Wrap=True)
ln = Line(StartPoint=item_6, EndPoint=item_9)

X_3 = UnitX(Factor=addition)
move_3 = Move(Geometry=move_2.Geometry, Motion=expr("-x", X_3))  # -> Geometry, Transform
cp_4 = ControlPoints(Curve=move_3.Geometry)  # -> Points, Weights, Knots
explode_3 = Explode(Curve=move_3.Geometry, Recursive=True)  # -> Segments, Vertices
item_11 = ListItem(List=cp_3.Points, Index=["3", "4"], Wrap=True)
item_12 = ListItem(List=explode_3.Segments, Index="1", Wrap=True)
item_13 = ListItem(List=cp_4.Points, Index=["2", "1"], Wrap=True)
ln_2 = Line(StartPoint=item_11, EndPoint=item_13)

X_4 = UnitX(Factor=addition)
move_4 = Move(Geometry=move_2.Geometry, Motion=X_4)  # -> Geometry, Transform
cp_5 = ControlPoints(Curve=move_4.Geometry)  # -> Points, Weights, Knots
explode_4 = Explode(Curve=move_4.Geometry, Recursive=True)  # -> Segments, Vertices
item_14 = ListItem(List=cp_3.Points, Index=["1", "2"], Wrap=True)
item_15 = ListItem(List=explode_4.Segments, Index="3", Wrap=True)
item_16 = ListItem(List=cp_5.Points, Index=["4", "3"], Wrap=True)
ln_3 = Line(StartPoint=item_14, EndPoint=item_16)

Y_2 = UnitY(Factor=addition)
move_5 = Move(Geometry=move_2.Geometry, Motion=Y_2)  # -> Geometry, Transform
cp_6 = ControlPoints(Curve=move_5.Geometry)  # -> Points, Weights, Knots
explode_5 = Explode(Curve=move_5.Geometry, Recursive=True)  # -> Segments, Vertices
item_17 = ListItem(List=cp_3.Points, Index=["2", "3"], Wrap=True)
item_18 = ListItem(List=explode_5.Segments, Index="0", Wrap=True)
item_19 = ListItem(List=cp_6.Points, Index=["1", "0"], Wrap=True)
ln_4 = Line(StartPoint=item_17, EndPoint=item_19)

Y_3 = UnitY(Factor=addition)
move_6 = Move(Geometry=move_3.Geometry, Motion=Y_3)  # -> Geometry, Transform
cp_7 = ControlPoints(Curve=move_6.Geometry)  # -> Points, Weights, Knots
explode_6 = Explode(Curve=move_6.Geometry, Recursive=True)  # -> Segments, Vertices
item_20 = ListItem(List=cp_4.Points, Index=["2", "3"], Wrap=True)
item_21 = ListItem(List=explode_6.Segments, Index="0", Wrap=True)
item_22 = ListItem(List=cp_7.Points, Index=["1", "0"], Wrap=True)
ln_5 = Line(StartPoint=item_20, EndPoint=item_22)

item_23 = ListItem(List=item_9, Index=0, Wrap=True)
item_24 = ListItem(List=item_6, Index=0, Wrap=True)
item_25 = ListItem(List=item_9, Index="1", Wrap=True)
item_26 = ListItem(List=item_6, Index="1", Wrap=True)
flip = FlipCurve(Curve=ln)  # -> Curve, Flag

ln_6 = Line(StartPoint=repeat_3, EndPoint=item_8)
ln_7 = Line(StartPoint=repeat_2, EndPoint=item_7)
merge = Merge(Data1=ln_7, Data2=ln_6)

merge_2 = Merge(Data1=item_25, Data2=item_23)
merge_3 = Merge(Data1=item_26, Data2=item_24)
ln_8 = Line(StartPoint=merge_2, EndPoint=merge_3)
repeat_4 = RepeatData(Data=simplify(graft(item)), Length=repeat)  # -> simplify(graft(Data))
repeat_5 = RepeatData(Data=simplify(graft(rectangle.Rectangle)), Length=repeat)  # -> simplify(graft(Data))
repeat_6 = RepeatData(Data=move.Geometry, Length=repeat)  # -> simplify(graft(Data))
merge_4 = Merge(Data1=simplify(graft(move_2.Geometry)), Data2=ln_8, Data3=repeat_6, Data4=ln_3, Data5=item_15, Data6=ln_4, Data7=item_18)
merge_5 = Merge(Data1=repeat_5, Data2=merge, Data3=repeat_6)
merge_6 = Merge(Data1=simplify(graft(move_2.Geometry)), Data2=ln_8, Data3=repeat_6, Data4=ln_4, Data5=item_18)
merge_7 = Merge(
    Data1=simplify(graft(move_2.Geometry)),
    Data2=ln_8,
    Data3=repeat_6,
    Data4=ln_3,
    Data5=item_15,
    Data6=ln_4,
    Data7=item_18,
    Data8=ln_2,
    Data9=simplify(graft(move_3.Geometry)))
group = Group(Objects=merge_5)
group_2 = Group(Objects=merge_4)
group_3 = Group(Objects=merge_6)
group_4 = Group(Objects=merge_7)
merge_8 = Merge(Data1=repeat_4, Data2=merge, Data3=repeat_6, Data4=ln, Data5=simplify(graft(move_2.Geometry)), Data6=ln_3, Data7=item_15)
merge_9 = Merge(Data1=repeat_4, Data2=merge, Data3=repeat_6, Data4=ln, Data5=simplify(graft(move_2.Geometry)), Data6=ln_2, Data7=item_12)
merge_10 = Merge(
    Data1=repeat_4,
    Data2=merge,
    Data3=repeat_6,
    Data4=ln,
    Data5=simplify(graft(move_2.Geometry)),
    Data6=ln_2,
    Data7=simplify(graft(move_3.Geometry)),
    Data8=ln_5,
    Data9=item_21)
merge_11 = Merge(Data1=merge_5, Data2=ln, Data3=item_10)
group_5 = Group(Objects=merge_11)
group_6 = Group(Objects=merge_8)
group_7 = Group(Objects=merge_9)
group_8 = Group(Objects=merge_10)
merge_12 = Merge(Data1=group, Data2=group_5, Data3=group_6, Data4=group_7, Data5=group_8, Data6=group_3, Data7=group_2, Data8=group_4)  # -> simplify(graft(Result))
ungroup = Ungroup(Group=merge_12)  # -> simplify(Objects)
O = ClusterOutput(ungroup)
branch = TreeBranch(Tree=ungroup, Path=concat, MaintainPaths=True)

# ==== cluster WidthDivision
C = ClusterInput()
end = EndPoints(Curve=C)  # -> Start, End
merge = Merge(Data1="False", Data2="True")
merge_2 = Merge(Data1="True", Data2="False")
merge_3 = Merge(Data1="True", Data2="False")
merge_4 = Merge(Data1="False", Data2="True")
cull = CullPattern(List=end.Start, CullPattern=merge_3)
cull_2 = CullPattern(List=end.Start, CullPattern=merge_4)
cull_3 = CullPattern(List=end.End, CullPattern=merge_2)
cull_4 = CullPattern(List=end.End, CullPattern=merge)
ln = Line(StartPoint=cull_3, EndPoint=cull_4)
ln_2 = Line(StartPoint=cull, EndPoint=cull_2)
midpt = CurveMiddle(Curve=ln)
midpt_2 = CurveMiddle(Curve=ln_2)
divide = DivideCurve(Curve=ln_2, Count="3", Kinks=False)  # -> simplify(Points), Tangents, Parameters
divide_2 = DivideCurve(Curve=ln, Count="3", Kinks=False)  # -> simplify(Points), Tangents, Parameters
end_mid = ClusterOutput(midpt)
start_mid = ClusterOutput(midpt_2)
trim = TrimTree(Tree=divide.Points, Depth=1)
trim_2 = TrimTree(Tree=divide_2.Points, Depth=1)
merge_5 = Merge(Data1="False", Data2="True", Data3="True", Data4="False")
cull_5 = CullPattern(List=trim_2, CullPattern=merge_5)
cull_6 = CullPattern(List=trim, CullPattern=merge_5)
end_3_cuts = ClusterOutput(cull_5)
start_3_cuts = ClusterOutput(cull_6)

# ==== cluster LengthDivision

_3_seg_lines = ClusterInput()
crv = Curve(_3_seg_lines)

circulation_size = ClusterInput()

ext_lines = ClusterInput()
merge = Merge(Data1="True", Data2="False")
merge_2 = Merge(Data1="False", Data2="True")
crv_2 = Curve(ext_lines)
cull = CullPattern(List=crv_2, CullPattern=merge)
cull_2 = CullPattern(List=crv_2, CullPattern=merge_2)

_2_segments_mid_line = ClusterInput()
crv_3 = Curve(_2_segments_mid_line)
offset = OffsetCurve(Curve=crv_3, Distance=expr("-x", circulation_size), Corners=1)
offset_2 = OffsetCurve(Curve=crv_3, Distance=circulation_size, Corners=1)
trim = TrimTree(Tree=offset_2, Depth=1)
trim_2 = TrimTree(Tree=offset, Depth=1)

merge_3 = Merge(Data1="True", Data2="False")
cull_3 = CullPattern(List=crv, CullPattern=merge_3)
offset_3 = OffsetCurve(Curve=cull_3, Distance=circulation_size, Corners=1)
trim_3 = TrimTree(Tree=offset_3, Depth=1)

merge_4 = Merge(Data1="False", Data2="True")
cull_4 = CullPattern(List=crv, CullPattern=merge_4)
offset_4 = OffsetCurve(Curve=cull_4, Distance=expr("-x", circulation_size), Corners=1)
trim_4 = TrimTree(Tree=offset_4, Depth=1)

proportion_0_5 = ClusterInput()
part_deg = ClusterInput()
division = Division(A="2", B="3")
concat = Concatenate(
    FragmentA="{",
    FragmentB=Slider(0, range=0..2),
    FragmentC=";",
    FragmentD=Slider(0, range=0..2),
    FragmentE=";",
    FragmentF=Slider(7, range=0..7),
    FragmentG=";",
    FragmentH=Slider(0, range=0..2),
    FragmentI="}")
number_slider = Slider(10, range=0..10)
addition = Addition(A=number_slider, B=1)
division_2 = Division(A=proportion_0_5, B=division)
branch = TreeBranch(Path=concat, MaintainPaths=True)
viewer = ParamViewer(branch)
item = ListItem(List=branch, Index=number_slider, Wrap=True)
item_2 = ListItem(List=branch, Index=addition, Wrap=True)
devec = DeconstructVector(Vector=item)  # -> XComponent, YComponent, ZComponent
panel = Panel(devec.YComponent)
cluster = Cluster(lines=trim_2, part=part_deg, fct_ratio=proportion_0_5)  # -> first, last
cluster_2 = Cluster(lines=trim, part=part_deg, fct_ratio=proportion_0_5)  # -> first, last
cluster_3 = Cluster(lines=trim, part=part_deg)  # -> first, last
cluster_4 = Cluster(lines=cull_2, part=part_deg, fct_ratio=proportion_0_5)  # -> first, last
cluster_5 = Cluster(lines=cull, part=part_deg)  # -> first, last
cluster_6 = Cluster(lines=cull, part=part_deg, fct_ratio=proportion_0_5)  # -> first, last
cluster_7 = Cluster(lines=cull_2, part=part_deg)  # -> first, last
cluster_8 = Cluster(lines=trim_3, part=part_deg, fct_ratio=division_2)  # -> first, last
cluster_9 = Cluster(lines=trim_4, part=part_deg, fct_ratio=division_2)  # -> first, last
cluster_10 = Cluster(lines=cull_2, part=part_deg, fct_ratio=division_2)  # -> first, last
cluster_11 = Cluster(lines=cull, part=part_deg, fct_ratio=division_2)  # -> first, last
_3_ext_r_1 = ClusterOutput(cluster_6.last)
_3_ext_r_2 = ClusterOutput(cluster_4.first)
_1_ext_r = ClusterOutput(cluster_7.first)
_1_ext = ClusterOutput(cluster_5.first)
_1_int = ClusterOutput(cluster_3.first)
_2_ext_1 = ClusterOutput(cluster_6.first)
_2_int_1 = ClusterOutput(cluster_2.first)
_2_ext_2 = ClusterOutput(cluster_4.first)
_2_int_2 = ClusterOutput(cluster.first)
_3_ext_1 = ClusterOutput(cluster_6.first)
_3_int_1 = ClusterOutput(cluster_2.first)
_3_ext_2 = ClusterOutput(cluster_4.last)
_3_int_2 = ClusterOutput(cluster.last)
_4_ext_1 = ClusterOutput(cluster_11.first)
_4_int_1 = ClusterOutput(cluster_8.first)
_4_ext_2 = ClusterOutput(cluster_10.first)
_4_int_2 = ClusterOutput(cluster_9.first)
_2_ext_r_1 = ClusterOutput(cluster_6.last)
_4_ext_r_1 = ClusterOutput(cluster_11.last)
_4_ext_r_2 = ClusterOutput(cluster_10.last)
_2_ext_r_2 = ClusterOutput(cluster_4.last)

# ==== cluster Selection
half_part_wall_width = ClusterInput()
half_facade_width = ClusterInput()
meeting_room = ClusterInput()
window_size = ClusterInput()
scenario = ClusterInput()
door_width = ClusterInput()
ext_pts = ClusterInput()
int_pts = ClusterInput()
rest = ClusterInput()
lng = ListLength(List=window_size)
ln = Line(StartPoint=int_pts, EndPoint=ext_pts)
cluster = Cluster_2(L=rest)  # -> L_3, L_2
cluster_2 = Cluster_2(L=int_pts)  # -> L_3, L_2
cluster_3 = Cluster_2(L=ext_pts)  # -> L_3, L_2
series = Series(Start=0, Step=1, Count=lng)
lng_2 = ListLength(List=ln)
ln_2 = Line(StartPoint=cluster_2.L_3, EndPoint=cluster_2.L_2)
ln_3 = Line(StartPoint=cluster.L_3, EndPoint=cluster.L_2)
ln_4 = Line(StartPoint=cluster_3.L_3, EndPoint=cluster_3.L_2)
subtraction = Subtraction(A=lng_2, B="2")
number_slider = Slider(0, range=0..3)
number_slider_2 = Slider(0, range=0..3)
dom = ConstructDomain(DomainStart="1", DomainEnd=subtraction)
cluster_4 = Cluster_13(l0=half_facade_width, L=ln_2)
subset = SubList(List=ln, Domain=dom, Wrap=True)  # -> simplify(List), Index
gate = StreamGate(Stream=cluster_4, Gate=meeting_room)  # -> Target0, Target1
gate_2 = StreamGate(Stream=subset.List, Gate=meeting_room)  # -> Target0, Target1
cluster_5 = Cluster_8(L=ln_3, l1=half_facade_width)
concat = Concatenate(
    FragmentA="{",
    FragmentB=Slider(0, range=0..2),
    FragmentC=";",
    FragmentD=Slider(0, range=0..2),
    FragmentE=";",
    FragmentF=Slider(4, range=0..7),
    FragmentG=";",
    FragmentH=Slider(0, range=0..2),
    FragmentI=";",
    FragmentK="}")
cluster_6 = Cluster_8(L=ln_4, l1=half_facade_width)
cluster_7 = Cluster_9(pts=gate_2.Target1)
cluster_8 = Cluster_10(L=gate.Target1)
cluster_9 = Cluster_3(C=[gate.Target0, cluster_8], B=door_width)  # -> int_part, door
ext = ExtendCurve(Curve=[cluster_7, gate_2.Target0], Type=0, Start=expr("-x", half_part_wall_width), End=expr("-x", half_facade_width))
trim = TrimTree(Tree=ext, Depth=1)
branch = TreeBranch(Tree=trim, Path=concat, MaintainPaths=True)
cluster_10 = Cluster_4(T=cluster_5, L=window_size)  # -> T_3, T_2
cluster_11 = Cluster_4(T=cluster_6, L=window_size)  # -> T_3, T_2
append_element = AppendElement(Data=cluster_9.int_part, Index=series)
append_element_2 = AppendElement(Data=cluster_9.door, Index=series)
append_element_3 = AppendElement(Data=trim, Index=series)
append_element_4 = AppendElement(Data=append_element, Index=scenario)
append_element_5 = AppendElement(Data=append_element_2, Index=scenario)
append_element_6 = AppendElement(Data=append_element_3, Index=scenario)
append_element_7 = AppendElement(Data=cluster_11.T_3, Index=scenario)
append_element_8 = AppendElement(Data=cluster_11.T_2, Index=scenario)
append_element_9 = AppendElement(Data=cluster_10.T_3, Index=scenario)
append_element_10 = AppendElement(Data=cluster_10.T_2, Index=scenario)
room_corridor_wall = ClusterOutput(append_element_4)
door = ClusterOutput(append_element_5)
part_wall = ClusterOutput(append_element_6)
facade_wall = ClusterOutput(append_element_7)
window = ClusterOutput(append_element_8)
rest_facade_wall = ClusterOutput(append_element_9)
rest_window = ClusterOutput(append_element_10)

# ==== cluster RoomCorridorWall
relay = ClusterInput()
relay_2 = ClusterInput()
D = ClusterInput()
cluster = Cluster_14(C=relay, D=D)  # -> S, E, E_2
rec_3pt = Rectangle3Pt(PointA=cluster.E, PointB=cluster.E_2, PointC=cluster.S)  # -> Rectangle, Length
boxrec = BoxRectangle(Rectangle=rec_3pt.Rectangle, Height=relay_2)
B = ClusterOutput(boxrec)

# ==== cluster Door
relay = ClusterInput()
D = ClusterInput()
F = ClusterInput()
relay_2 = ClusterInput()
cluster = Cluster_14(C=relay, D=D)  # -> S, E, E_2
cluster_2 = Cluster_14(C=relay, D="0.02")  # -> S, E, E_2
rec_3pt = Rectangle3Pt(PointA=cluster.E, PointB=cluster.E_2, PointC=cluster.S)  # -> Rectangle, Length
Z = UnitZ(Factor=F)
rec_3pt_2 = Rectangle3Pt(PointA=cluster_2.E, PointB=cluster_2.E_2, PointC=cluster_2.S)  # -> Rectangle, Length
move = Move(Geometry=rec_3pt.Rectangle, Motion=Z)  # -> Geometry, Transform
extr = Extrude(Base=relay, Direction=Z)
doors_flat = ClusterOutput(extr)
boxrec = BoxRectangle(Rectangle=move.Geometry, Height=relay_2)
boxrec_2 = BoxRectangle(Rectangle=rec_3pt_2.Rectangle, Height=Z)
B = ClusterOutput(boxrec)
doors_vol = ClusterOutput(boxrec_2)

# ==== cluster Window
relay = ClusterInput()
D = ClusterInput()
F = ClusterInput()
cluster = Cluster_14(C=relay, D=D)  # -> S, E, E_2
cluster_2 = Cluster_14(C=relay, D="0.01")  # -> S, E, E_2
H = ClusterInput()
rec_3pt = Rectangle3Pt(PointA=cluster_2.E, PointB=cluster_2.E_2, PointC=cluster_2.S)  # -> Rectangle, Length
rec_3pt_2 = Rectangle3Pt(PointA=cluster.E, PointB=cluster.E_2, PointC=cluster.S)  # -> Rectangle, Length
Z = UnitZ(Factor=F)
relay_2 = ClusterInput()
move = Move(Geometry=rec_3pt_2.Rectangle, Motion=Z)  # -> Geometry, Transform
Z_2 = UnitZ(Factor=H)
move_2 = Move(Geometry=relay, Motion=Z_2)  # -> Geometry, Transform
subtraction = Subtraction(A=F, B=H)
move_3 = Move(Geometry=rec_3pt.Rectangle, Motion=Z_2)  # -> Geometry, Transform
boxrec = BoxRectangle(Rectangle=rec_3pt_2.Rectangle, Height=H)
boxrec_2 = BoxRectangle(Rectangle=move.Geometry, Height=relay_2)
Z_3 = UnitZ(Factor=subtraction)
B = ClusterOutput(boxrec)
B_2 = ClusterOutput(boxrec_2)
extr = Extrude(Base=move_2.Geometry, Direction=Z_3)
boxrec_3 = BoxRectangle(Rectangle=move_3.Geometry, Height=subtraction)
windows_flat = ClusterOutput(extr)
windows_vol = ClusterOutput(boxrec_3)

# ==== cluster Cluster_15
L = ClusterInput()
L_2 = ClusterInput()
lng = ListLength(List=L)
lng_2 = ListLength(List=L_2)
series = Series(Start=0, Step=1, Count=lng_2)
series_2 = Series(Start=0, Step=1, Count=lng)
concat = Concatenate(FragmentA="{", FragmentB=series, FragmentC=";")  # -> simplify(graft(Result))
B = ClusterInput()
concat_2 = Concatenate(FragmentA=concat, FragmentB=series_2, FragmentC=";")  # -> simplify(graft(Result))
L_3 = ClusterInput()
i = ClusterInput()
concat_3 = Concatenate(FragmentA=concat_2, FragmentB=B, FragmentC="}")  # -> simplify(Result)
item = ListItem(List=L_3, Index=i, Wrap="False")
branch = TreeBranch(Tree=item, Path=concat_3, MaintainPaths=True)
ends = ClusterOutput(branch)

# ==== cluster Selection_2
half_part_wall_width = ClusterInput()
half_facade_width = ClusterInput()
meeting_room = ClusterInput()
window_size = ClusterInput()
scenario = ClusterInput()
door_width = ClusterInput()
ext_pts = ClusterInput()
int_pts = ClusterInput()
rest = ClusterInput()
lng = ListLength(List=window_size)
ln = Line(StartPoint=int_pts, EndPoint=ext_pts)
cluster = Cluster_2(L=rest)  # -> L_3, L_2
cluster_2 = Cluster_2(L=int_pts)  # -> L_3, L_2
cluster_3 = Cluster_2(L=ext_pts)  # -> L_3, L_2
series = Series(Start=0, Step=1, Count=lng)
number_slider = Slider(1, range=0..3)
lng_2 = ListLength(List=ln)
ln_2 = Line(StartPoint=cluster_2.L_3, EndPoint=cluster_2.L_2)
ln_3 = Line(StartPoint=cluster.L_3, EndPoint=cluster.L_2)
ln_4 = Line(StartPoint=cluster_3.L_3, EndPoint=cluster_3.L_2)
subtraction = Subtraction(A=lng_2, B="1")
dom = ConstructDomain(DomainStart="1", DomainEnd=subtraction)
concat = Concatenate(
    FragmentA="{",
    FragmentB=Slider(0, range=0..2),
    FragmentC=";",
    FragmentD=Slider(0, range=0..2),
    FragmentE=";",
    FragmentF=Slider(4, range=0..7),
    FragmentG=";",
    FragmentH=Slider(0, range=0..2),
    FragmentI=";",
    FragmentJ=Slider(0, range=0..3),
    FragmentL=";",
    FragmentK="}")
subset = SubList(List=ln, Domain=dom, Wrap=True)  # -> simplify(List), Index
cluster_4 = Cluster_20(l0=half_facade_width, l1=half_part_wall_width, L=ln_2)
branch = TreeBranch(Tree=cluster_4, Path=concat, MaintainPaths=True)
gate = StreamGate(Stream=cluster_4, Gate=meeting_room)  # -> Target0, Target1
gate_2 = StreamGate(Stream=subset.List, Gate=meeting_room)  # -> Target0, Target1
cluster_5 = Cluster_18(L=ln_3, l1=half_facade_width)
branch_2 = TreeBranch(Tree=cluster_5, Path=concat, MaintainPaths=True)
cluster_6 = Cluster_17(L=ln_4, l0=half_facade_width)
cluster_7 = Cluster_9(pts=gate_2.Target1)
cluster_8 = Cluster_10(L=gate.Target1)
ext = ExtendCurve(Curve=[cluster_7, gate_2.Target0], Type=0, Start=expr("-x", half_part_wall_width), End=expr("-x", half_facade_width))
cluster_9 = Cluster_3(C=[gate.Target0, cluster_8], B=door_width)  # -> int_part, door
lng_3 = ListLength(List=ext)
subtraction_2 = Subtraction(A=lng_3, B="2")
dom_2 = ConstructDomain(DomainStart=0, DomainEnd=subtraction_2)
first_last = FirstLast(List=ext)  # -> FirstValue, LastValue
ext_2 = ExtendCurve(Curve=first_last.LastValue, Type=0, Start=expr("2*x", half_part_wall_width), End="0")
subset_2 = SubList(List=ext, Domain=dom_2, Wrap=True)  # -> simplify(List), Index
merge = Merge(Data1=subset_2.List, Data2=ext_2)
trim = TrimTree(Tree=merge, Depth=1)
cluster_10 = Cluster_4(T=cluster_6, L=window_size)  # -> T_3, T_2
cluster_11 = Cluster_4(T=cluster_5, L=window_size)  # -> T_3, T_2
append_element = AppendElement(Data=cluster_9.int_part, Index=series)
append_element_2 = AppendElement(Data=cluster_9.door, Index=series)
append_element_3 = AppendElement(Data=trim, Index=series)
append_element_4 = AppendElement(Data=append_element_3, Index=scenario)
append_element_5 = AppendElement(Data=append_element, Index=scenario)
append_element_6 = AppendElement(Data=append_element_2, Index=scenario)
append_element_7 = AppendElement(Data=cluster_10.T_3, Index=scenario)
append_element_8 = AppendElement(Data=cluster_10.T_2, Index=scenario)
append_element_9 = AppendElement(Data=cluster_11.T_3, Index=scenario)
append_element_10 = AppendElement(Data=cluster_11.T_2, Index=scenario)
part_wall = ClusterOutput(append_element_4)
room_corridor_wall = ClusterOutput(append_element_5)
door = ClusterOutput(append_element_6)
facade_wall = ClusterOutput(append_element_7)
window = ClusterOutput(append_element_8)
rest_facade_wall = ClusterOutput(append_element_9)
rest_window = ClusterOutput(append_element_10)

# ==== cluster Selection_3
half_part_wall_width = ClusterInput()
half_facade_width = ClusterInput()
meeting_room = ClusterInput()
window_size = ClusterInput()
scenario = ClusterInput()
door_width = ClusterInput()
ext_pts = ClusterInput()
int_pts = ClusterInput()
rest = ClusterInput()
lng = ListLength(List=window_size)
ln = Line(StartPoint=int_pts, EndPoint=ext_pts)
cluster = Cluster_2(L=rest)  # -> L_3, L_2
cluster_2 = Cluster_2(L=int_pts)  # -> L_3, L_2
cluster_3 = Cluster_2(L=ext_pts)  # -> L_3, L_2
series = Series(Start=0, Step=1, Count=lng)
lng_2 = ListLength(List=ln)
ln_2 = Line(StartPoint=cluster_2.L_3, EndPoint=cluster_2.L_2)
ln_3 = Line(StartPoint=cluster.L_3, EndPoint=cluster.L_2)
ln_4 = Line(StartPoint=cluster_3.L_3, EndPoint=cluster_3.L_2)
subtraction = Subtraction(A=lng_2, B="2")
number_slider = Slider(2, range=0..3)
dom = ConstructDomain(DomainStart="0", DomainEnd=subtraction)
cluster_4 = Cluster_26(l0=half_part_wall_width, l0_2=half_facade_width, L=ln_2)
subset = SubList(List=ln, Domain=dom, Wrap=True)  # -> simplify(List), Index
concat = Concatenate(
    FragmentA="{",
    FragmentB=Slider(0, range=0..2),
    FragmentC=";",
    FragmentD=Slider(0, range=0..2),
    FragmentE=";",
    FragmentF=Slider(4, range=0..7),
    FragmentG=";",
    FragmentH=Slider(0, range=0..2),
    FragmentI=";",
    FragmentJ=Slider(3, range=0..3),
    FragmentL=";",
    FragmentK="}")
cluster_5 = Cluster_23(L=ln_3, l0=half_facade_width)
cluster_6 = Cluster_22(L=ln_4, l1=half_facade_width)
gate = StreamGate(Stream=cluster_4, Gate=meeting_room)  # -> Target0, Target1
gate_2 = StreamGate(Stream=subset.List, Gate=meeting_room)  # -> Target0, Target1
cluster_7 = Cluster_24(pts=gate_2.Target1)
branch = TreeBranch(Tree=cluster_6, Path=concat, MaintainPaths=True)
branch_2 = TreeBranch(Tree=cluster_5, Path=concat, MaintainPaths=True)
cluster_8 = Cluster_10(L=gate.Target1)
ext = ExtendCurve(Curve=[cluster_7, gate_2.Target0], Type=0, Start=expr("-x", half_part_wall_width), End=expr("-x", half_facade_width))
cluster_9 = Cluster_3(C=[gate.Target0, cluster_8], B=door_width)  # -> int_part, door
lng_3 = ListLength(List=ext)
first_last = FirstLast(List=ext)  # -> FirstValue, LastValue
subtraction_2 = Subtraction(A=lng_3, B="1")
dom_2 = ConstructDomain(DomainStart="1", DomainEnd=subtraction_2)
ext_2 = ExtendCurve(Curve=first_last.FirstValue, Type=0, Start=expr("2*x", half_part_wall_width), End="0")
subset_2 = SubList(List=ext, Domain=dom_2, Wrap=True)  # -> simplify(List), Index
merge = Merge(Data1=ext_2, Data2=subset_2.List)
trim = TrimTree(Tree=merge, Depth=1)
cluster_10 = Cluster_4(T=cluster_5, L=window_size)  # -> T_3, T_2
cluster_11 = Cluster_4(T=cluster_6, L=window_size)  # -> T_3, T_2
append_element = AppendElement(Data=trim, Index=series)
append_element_2 = AppendElement(Data=cluster_9.int_part, Index=series)
append_element_3 = AppendElement(Data=cluster_9.door, Index=series)
append_element_4 = AppendElement(Data=append_element_2, Index=scenario)
append_element_5 = AppendElement(Data=append_element_3, Index=scenario)
append_element_6 = AppendElement(Data=append_element, Index=scenario)
append_element_7 = AppendElement(Data=cluster_11.T_3, Index=scenario)
append_element_8 = AppendElement(Data=cluster_11.T_2, Index=scenario)
append_element_9 = AppendElement(Data=cluster_10.T_3, Index=scenario)
append_element_10 = AppendElement(Data=cluster_10.T_2, Index=scenario)
part_wall = ClusterOutput(append_element_6)
room_corridor_wall = ClusterOutput(append_element_4)
door = ClusterOutput(append_element_5)
facade_wall = ClusterOutput(append_element_7)
window = ClusterOutput(append_element_8)
rest_facade_wall = ClusterOutput(append_element_9)
rest_window = ClusterOutput(append_element_10)

# ==== cluster Cluster_28
max_length = ClusterInput()
room_sizes = ClusterInput()
bang = ExplodeTree(Data=simplify(graft(room_sizes)))  # -> flatten(Branch0), flatten(Branch1), flatten(Branch2)
series = Series(Start="1", Step=1, Count=max_length)
cluster = Cluster_27(room_width=bang.Branch0, serie=series)
cluster_2 = Cluster_27(room_width=bang.Branch1, serie=series)
cluster_3 = Cluster_27(room_width=bang.Branch2, serie=series)
lng = ListLength(List=series)
addition = Addition(A=cluster, B=cluster_2, C=cluster_3)
partition = PartitionList(List=addition, Size=lng)  # -> simplify(Chunks)
branch = TreeBranch(Tree=partition, Path="{0}", MaintainPaths=True)
sort = SortList(Keys=branch, ValuesA=series)  # -> Keys, ValuesA
panel = Panel(sort.Keys)
item = ListItem(List=sort.ValuesA, Index="2", Wrap=True)
item_2 = ListItem(List=sort.ValuesA, Index="29", Wrap=True)
item_3 = ListItem(List=sort.ValuesA, Index="30", Wrap=True)
panel_2 = Panel(sort.ValuesA)
merge = Merge(Data1=item, Data2=item_2, Data3=item_3)
division = Division(A=simplify(graft(merge)), B=room_sizes)
lengths = ClusterOutput(merge)
division_2 = Division(A=division, B="2")
round = Round(Number=division_2)  # -> Nearest, Floor, Ceiling
multiplication = Multiplication(A=round.Nearest, B="2")
division_settings = ClusterOutput(multiplication)

# ==== cluster Cluster_30
facade_wall_w = ClusterInput()
mid_lines = ClusterInput()
cluster = Cluster_29(T=mid_lines, shape=["2", "3"], wing="2")
cluster_2 = Cluster_29(T=mid_lines, shape=["0", "1"], wing="0")
cluster_3 = Cluster_29(T=mid_lines, shape=["2", "3"], wing="1")
cluster_4 = Cluster_29(T=mid_lines, shape="4", wing="3")
cluster_5 = Cluster_29(T=mid_lines, shape=["5", "6", "7"], wing=["1", "2"])
cluster_6 = Cluster_29(T=mid_lines, shape=["2", "3", "4"], wing="0")
cluster_7 = Cluster_29(T=mid_lines, shape="1", wing="1")
cluster_8 = Cluster_29(T=mid_lines, shape=["5", "6", "7"], wing=["0", "3"])
cluster_9 = Cluster_29(T=mid_lines, shape="4", wing=["1", "2"])
ext = ExtendCurve(Curve=cluster, Type=0, Start="0", End=expr("0.5 * x", facade_wall_w))
ext_2 = ExtendCurve(Curve=cluster_4, Type=0, Start="0", End=expr("0.5 * x", facade_wall_w))
ext_3 = ExtendCurve(Curve=cluster_5, Type=0, Start="0", End=expr("0.5 * x", facade_wall_w))
ext_4 = ExtendCurve(Curve=cluster_6, Type=0, Start=expr("0.5*x", facade_wall_w), End="0")
ext_5 = ExtendCurve(Curve=cluster_7, Type=0, Start="0", End=expr("0.5 * x", facade_wall_w))
merge = Merge(
    Data1=ext_4,
    Data2=ext_5,
    Data3=ext,
    Data4=ext_2,
    Data5=ext_3,
    Data6=cluster_2,
    Data7=cluster_3,
    Data8=cluster_9,
    Data9=cluster_8)
R = ClusterOutput(merge)

# ==== cluster Cluster_32
relay = ClusterInput()
cluster = Cluster_31(tree=relay, shape="0", wing="0")
cluster_2 = Cluster_31(tree=relay, shape="1", wing="0")
cluster_3 = Cluster_31(tree=relay, shape="1", wing="1")
cluster_4 = Cluster_31(tree=relay, shape="2", wing="1")
cluster_5 = Cluster_31(tree=relay, shape="2", wing="2")
cluster_6 = Cluster_31(tree=relay, shape="3", wing="1")
cluster_7 = Cluster_31(tree=relay, shape="3", wing="2")
cluster_8 = Cluster_31(tree=relay, shape="4", wing="1")
cluster_9 = Cluster_31(tree=relay, shape="4", wing="2")
cluster_10 = Cluster_31(tree=relay, shape="4", wing="3")
cluster_11 = Cluster_31(tree=relay, shape="5", wing="0")
cluster_12 = Cluster_31(tree=relay, shape="5", wing="1")
cluster_13 = Cluster_31(tree=relay, shape="6", wing="0")
cluster_14 = Cluster_31(tree=relay, shape="6", wing="1")
cluster_15 = Cluster_31(tree=relay, shape="6", wing="2")
cluster_16 = Cluster_31(tree=relay, shape="7", wing="0")
cluster_17 = Cluster_31(tree=relay, shape="7", wing="1")
cluster_18 = Cluster_31(tree=relay, shape="7", wing="2")
cluster_19 = Cluster_31(tree=relay, shape="7", wing="3")
merge = Merge(
    Data1=cluster,
    Data2=cluster_2,
    Data3=cluster_3,
    Data4=cluster_4,
    Data5=cluster_5,
    Data6=cluster_6,
    Data7=cluster_7,
    Data8=cluster_8,
    Data9=cluster_9,
    Data10=cluster_10,
    Data11=cluster_11,
    Data12=cluster_12,
    Data13=cluster_13,
    Data14=cluster_14,
    Data15=cluster_15,
    Data16=cluster_16,
    Data17=cluster_17,
    Data18=cluster_18,
    Data19=cluster_19)
R = ClusterOutput(merge)

# ==== cluster Cluster_33
relay = ClusterInput()
cluster = Cluster_31(tree=relay, shape="0", wing="0")
cluster_2 = Cluster_31(tree=relay, shape="1", wing="0")
cluster_3 = Cluster_31(tree=relay, shape="2", wing="0")
cluster_4 = Cluster_31(tree=relay, shape="2", wing="1")
cluster_5 = Cluster_31(tree=relay, shape="3", wing="0")
cluster_6 = Cluster_31(tree=relay, shape="3", wing="1")
cluster_7 = Cluster_31(tree=relay, shape="4", wing="0")
cluster_8 = Cluster_31(tree=relay, shape="4", wing="1")
cluster_9 = Cluster_31(tree=relay, shape="4", wing="2")
cluster_10 = Cluster_31(tree=relay, shape="5", wing="1")
cluster_11 = Cluster_31(tree=relay, shape="6", wing="2")
cluster_12 = Cluster_31(tree=relay, shape="7", wing="2")
cluster_13 = Cluster_31(tree=relay, shape="7", wing="3")
merge = Merge(
    Data1=cluster,
    Data2=cluster_2,
    Data3=cluster_3,
    Data4=cluster_4,
    Data5=cluster_5,
    Data6=cluster_6,
    Data7=cluster_7,
    Data8=cluster_8,
    Data9=cluster_9,
    Data10=cluster_10,
    Data11=cluster_11,
    Data12=cluster_12,
    Data13=cluster_13)
R = ClusterOutput(merge)

# ==== cluster Cluster_36
data = ClusterInput()
cluster = Cluster_35(relay=data)  # -> B, B_2, B_3, B_4, B_5, B_6, B_7, B_8
file_name = ClusterInput()
concat = Concatenate(FragmentA=file_name, FragmentB="4")
concat_2 = Concatenate(FragmentA=file_name, FragmentB="5")
concat_3 = Concatenate(FragmentA=file_name, FragmentB="0")
concat_4 = Concatenate(FragmentA=file_name, FragmentB="3")
concat_5 = Concatenate(FragmentA=file_name, FragmentB="1")
concat_6 = Concatenate(FragmentA=file_name, FragmentB="6")
concat_7 = Concatenate(FragmentA=file_name, FragmentB="2")
concat_8 = Concatenate(FragmentA=file_name, FragmentB="7")
directory = ClusterInput()
pack = PackData(Save=Toggle(False), Directory=directory, Filename=concat_3, B=cluster.B, IncrementalSave=False)
pack_2 = PackData(Save=Toggle(False), Directory=directory, Filename=concat_5, B=cluster.B_2, IncrementalSave=False)
pack_3 = PackData(Save=Toggle(False), Directory=directory, Filename=concat_7, B=cluster.B_3, IncrementalSave=False)
pack_4 = PackData(Save=Toggle(False), Directory=directory, Filename=concat_4, B=cluster.B_4, IncrementalSave=False)
pack_5 = PackData(Save=Toggle(False), Directory=directory, Filename=concat, B=cluster.B_5, IncrementalSave=False)
pack_6 = PackData(Save=Toggle(False), Directory=directory, Filename=concat_2, B=cluster.B_6, IncrementalSave=False)
pack_7 = PackData(Save=Toggle(False), Directory=directory, Filename=concat_6, B=cluster.B_7, IncrementalSave=False)
pack_8 = PackData(Save=Toggle(False), Directory=directory, Filename=concat_8, B=cluster.B_8, IncrementalSave=False)
panel = Panel(pack)
panel_2 = Panel(pack_2)
panel_3 = Panel(pack_3)
panel_4 = Panel(pack_4)
panel_5 = Panel(pack_5)
panel_6 = Panel(pack_6)
panel_7 = Panel(pack_7)
panel_8 = Panel(pack_8)

# ==== cluster Cluster_37
series = Series(Start=0, Step=1, Count="3")
series_2 = Series(Start=0, Step=1, Count=Slider(5, range=0..10))
concat = Concatenate(FragmentA="{", FragmentB=simplify(graft(series)), FragmentC=";")  # -> flatten(Result)
concat_2 = Concatenate(FragmentA=simplify(graft(concat)), FragmentB=series, FragmentC=";")  # -> flatten(Result)
series_3 = Series(Start=0, Step=1, Count="4")
concat_3 = Concatenate(FragmentA=simplify(graft(concat_2)), FragmentB=series_2, FragmentC=";")  # -> flatten(Result)
concat_4 = Concatenate(FragmentA=simplify(graft(concat_3)), FragmentB=series_3)  # -> flatten(Result)
data = ClusterInput()
branch = TreeBranch(Tree=data, Path=concat_4, MaintainPaths=True)
clean = CleanTree(RemoveNulls=True, RemoveInvalid=True, RemoveEmpty=Toggle(True), Tree=branch)
branches = ClusterOutput(clean)

# ==== cluster Cluster
fct_ratio = ClusterInput()
part = ClusterInput()
lines = ClusterInput()
series = Series(Start=0, Step=1, Count="3")
append_element = AppendElement(Data=lines, Index=series)
divide = DivideCurve(Curve=append_element, Count=simplify(graft(part)), Kinks=False)  # -> Points, Tangents, Parameters
lng = ListLength(List=divide.Points)
multiplication = Multiplication(A=lng, B=fct_ratio)
round = Round(Number=multiplication)  # -> Nearest, Floor, Ceiling
subtraction = Subtraction(A=lng, B="1")
subtraction_2 = Subtraction(A=round.Ceiling, B="1")
dom = ConstructDomain(DomainStart=0, DomainEnd=subtraction_2)
dom_2 = ConstructDomain(DomainStart=subtraction_2, DomainEnd=subtraction)
subset = SubList(List=divide.Points, Domain=dom, Wrap=True)  # -> simplify(List), Index
subset_2 = SubList(List=divide.Points, Domain=dom_2, Wrap=True)  # -> simplify(List), Index
last = ClusterOutput(subset_2.List)
first = ClusterOutput(subset.List)

# ==== cluster Cluster_2
L = ClusterInput()
lng = ListLength(List=L)
subtraction = Subtraction(A=lng, B="2")
shift = ShiftList(List=L, Shift=1, Wrap=True)
dom = ConstructDomain(DomainStart=0, DomainEnd=subtraction)
subset = SubList(List=shift, Domain=dom, Wrap=True)  # -> simplify(List), Index
subset_2 = SubList(List=L, Domain=dom, Wrap=True)  # -> simplify(List), Index
L_2 = ClusterOutput(subset.List)
L_3 = ClusterOutput(subset_2.List)
ln = Line(StartPoint=subset_2.List, EndPoint=subset.List)

# ==== cluster Cluster_3
C = ClusterInput()
B = ClusterInput()
len = Length(Curve=C)
subtraction = Subtraction(A=len, B=B)
divdist = DivideDistance(Curve=C, Distance=subtraction)  # -> Points, Tangents, Parameters
shatter = Shatter(Curve=simplify(graft(C)), Parameters=divdist.Parameters)  # -> simplify(Segments)
item = ListItem(List=shatter, Index=0, Wrap=True)
item_2 = ListItem(List=shatter, Index="1", Wrap=True)
trim = TrimTree(Tree=item, Depth="2")
trim_2 = TrimTree(Tree=item_2, Depth="2")
door = ClusterOutput(trim_2)
int_part = ClusterOutput(trim)

# ==== cluster Cluster_4
T = ClusterInput()
L = ClusterInput()
trim = TrimTree(Tree=T, Depth=1)
item = ListItem(List=trim, Index=0, Wrap=True)
lng = ListLength(List=L)
lng_2 = ListLength(List=item)
series = Series(Start=0, Step=1, Count=lng)
multiplication = Multiplication(A=lng_2, B=lng)
repeat = RepeatData(Data=L, Length=multiplication)  # -> simplify(graft(Data))
append_element = AppendElement(Data=trim, Index=series)
len = Length(Curve=append_element)
multiplication_2 = Multiplication(A=len, B="4")
multiplication_3 = Multiplication(A=multiplication_2, B=repeat)
division = Division(A=multiplication_3, B="2")
subtraction = Subtraction(A=len, B=division)
division_2 = Division(A=subtraction, B="2")
addition = Addition(A=division_2, B=division)
divdist = DivideDistance(Curve=append_element, Distance=division_2)  # -> Points, Tangents, Parameters
divdist_2 = DivideDistance(Curve=append_element, Distance=addition)  # -> Points, Tangents, Parameters
item_2 = ListItem(List=divdist.Parameters, Index="1", Wrap=True)
item_3 = ListItem(List=divdist_2.Parameters, Index="1", Wrap=True)
merge = Merge(Data1=item_2, Data2=item_3)
shatter = Shatter(Curve=simplify(graft(append_element)), Parameters=merge)  # -> simplify(Segments)
item_4 = ListItem(List=shatter, Index="1", Wrap=True)
item_5 = ListItem(List=shatter, Index="2", Wrap=True)
item_6 = ListItem(List=shatter, Index=0, Wrap=True)
merge_2 = Merge(Data1=item_6, Data2=item_5)
trim_2 = TrimTree(Tree=item_4, Depth=1)
trim_3 = TrimTree(Tree=merge_2, Depth=1)
T_2 = ClusterOutput(trim_2)
T_3 = ClusterOutput(trim_3)

# ==== cluster Cluster_8
L = ClusterInput()
cluster = Cluster_7(relay=L)  # -> _0, _1_f, _1_r, _2_f, _2_l, _2_r, _3_f, _3_l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
merge = Merge(
    Data1=cluster._1_f,
    Data2=cluster._2_l,
    Data3=cluster._3_l,
    Data4=cluster._4_l,
    Data5=cluster._5_l,
    Data6=cluster._6_l_1,
    Data7=cluster._6_l_2,
    Data8=cluster._7_l_1,
    Data9=cluster._7_l_2)
merge_2 = Merge(Data1=cluster._2_f, Data2=cluster._3_f, Data3=cluster._4_f)
merge_3 = Merge(
    Data1=cluster._0,
    Data2=cluster._1_r,
    Data3=cluster._2_r,
    Data4=cluster._3_r,
    Data5=cluster._4_r,
    Data6=cluster._5_r,
    Data7=cluster._6_r,
    Data8=cluster._7_r)
l1 = ClusterInput()
ext = ExtendCurve(Curve=merge, Type=0, Start="0", End=l1)
ext_2 = ExtendCurve(Curve=merge_2, Type=0, Start=l1, End="0")
merge_4 = Merge(Data1=ext, Data2=ext_2, Data3=merge_3)
R = ClusterOutput(merge_4)

# ==== cluster Cluster_9
pts = ClusterInput()
lng = ListLength(List=pts)
subtraction = Subtraction(A=lng, B="1")
dom = ConstructDomain(DomainStart="1", DomainEnd=subtraction)
subset = SubList(List=pts, Domain=dom, Wrap=True)  # -> simplify(List), Index
out = ClusterOutput(subset.List)

# ==== cluster Cluster_10
L = ClusterInput()
lng = ListLength(List=L)
subtraction = Subtraction(A=lng, B="1")
item = ListItem(List=L, Index="1", Wrap=True)
item_2 = ListItem(List=L, Index=0, Wrap=True)
dom = ConstructDomain(DomainStart="2", DomainEnd=subtraction)
merge = Merge(Data1=item_2, Data2=item)
subset = SubList(List=L, Domain=dom, Wrap=True)  # -> simplify(List), Index
join = JoinCurves(Curves=merge, Preserve="True")  # -> simplify(Curves)
merge_2 = Merge(Data1=join, Data2=subset.List)
out = ClusterOutput(merge_2)

# ==== cluster Cluster_13
L = ClusterInput()
lng = ListLength(List=L)
subtraction = Subtraction(A=lng, B="2")
l0 = ClusterInput()
dom = ConstructDomain(DomainStart="1", DomainEnd=subtraction)
first_last = FirstLast(List=L)  # -> FirstValue, LastValue
subset = SubList(List=L, Domain=dom, Wrap=True)  # -> simplify(List), Index
cluster = Cluster_12(T_2=first_last.FirstValue, l0=l0, T=first_last.LastValue)  # -> first, last
ext = ExtendCurve(Curve=subset.List, Type=0, Start="0.1", End=expr("-x", "0.1"))
merge = Merge(Data1=cluster.first, Data2=ext, Data3=cluster.last)
out = ClusterOutput(merge)

# ==== cluster Cluster_14
C = ClusterInput()
D = ClusterInput()
offset = OffsetCurve(Curve=C, Distance=expr("-x", D), Corners=1)
offset_2 = OffsetCurve(Curve=C, Distance=D, Corners=1)
trim = TrimTree(Tree=offset, Depth=1)
trim_2 = TrimTree(Tree=offset_2, Depth=1)
end = EndPoints(Curve=trim_2)  # -> Start, End
end_2 = EndPoints(Curve=C)  # -> Start, End
end_3 = EndPoints(Curve=trim)  # -> Start, End
E = ClusterOutput(end.End)
S = ClusterOutput(end_2.Start)
E_2 = ClusterOutput(end_3.End)

# ==== cluster Cluster_17
L = ClusterInput()
cluster = Cluster_16(relay=L)  # -> _0, _1_f, _1_r, _2_f, _2_l, _2_r, _3_f, _3_l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
merge = Merge(
    Data1=cluster._1_f,
    Data2=cluster._2_l,
    Data3=cluster._3_l,
    Data4=cluster._4_l,
    Data5=cluster._5_l,
    Data6=cluster._6_l_1,
    Data7=cluster._6_l_2,
    Data8=cluster._7_l_1,
    Data9=cluster._7_l_2)
merge_2 = Merge(Data1=cluster._2_f, Data2=cluster._3_f, Data3=cluster._4_f)
merge_3 = Merge(
    Data1=cluster._0,
    Data2=cluster._1_r,
    Data3=cluster._2_r,
    Data4=cluster._3_r,
    Data5=cluster._4_r,
    Data6=cluster._5_r,
    Data7=cluster._6_r,
    Data8=cluster._7_r)
l0 = ClusterInput()
ext = ExtendCurve(Curve=merge_2, Type=0, Start=l0, End="0")
merge_4 = Merge(Data1=merge, Data2=ext, Data3=merge_3)
R = ClusterOutput(merge_4)

# ==== cluster Cluster_18
L = ClusterInput()
cluster = Cluster_16(relay=L)  # -> _0, _1_f, _1_r, _2_f, _2_l, _2_r, _3_f, _3_l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
merge = Merge(
    Data1=cluster._1_f,
    Data2=cluster._2_l,
    Data3=cluster._3_l,
    Data4=cluster._4_l,
    Data5=cluster._5_l,
    Data6=cluster._6_l_1,
    Data7=cluster._6_l_2,
    Data8=cluster._7_l_1,
    Data9=cluster._7_l_2)
merge_2 = Merge(Data1=cluster._2_f, Data2=cluster._3_f, Data3=cluster._4_f)
merge_3 = Merge(
    Data1=cluster._0,
    Data2=cluster._1_r,
    Data3=cluster._2_r,
    Data4=cluster._3_r,
    Data5=cluster._4_r,
    Data6=cluster._5_r,
    Data7=cluster._6_r,
    Data8=cluster._7_r)
l1 = ClusterInput()
ext = ExtendCurve(Curve=merge, Type=0, Start="0", End=l1)
merge_4 = Merge(Data1=ext, Data2=merge_2, Data3=merge_3)
R = ClusterOutput(merge_4)

# ==== cluster Cluster_20
L = ClusterInput()
lng = ListLength(List=L)
subtraction = Subtraction(A=lng, B="2")
l1 = ClusterInput()
l0 = ClusterInput()
dom = ConstructDomain(DomainStart="1", DomainEnd=subtraction)
first_last = FirstLast(List=L)  # -> FirstValue, LastValue
subset = SubList(List=L, Domain=dom, Wrap=True)  # -> simplify(List), Index
cluster = Cluster_19(relay=first_last.FirstValue, l0=l0, l0_2=l1, C=first_last.LastValue)  # -> first, last
ext = ExtendCurve(Curve=subset.List, Type=0, Start=l1, End=expr("-x", l1))
merge = Merge(Data1=cluster.first, Data2=ext, Data3=cluster.last)
out = ClusterOutput(merge)

# ==== cluster Cluster_22
L = ClusterInput()
cluster = Cluster_21(relay=L)  # -> _0, _1_f, _1_r, _2_f, _2_l, _2_r, _3_f, _3_l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
merge = Merge(
    Data1=cluster._1_f,
    Data2=cluster._2_l,
    Data3=cluster._3_l,
    Data4=cluster._4_l,
    Data5=cluster._5_l,
    Data6=cluster._6_l_1,
    Data7=cluster._6_l_2,
    Data8=cluster._7_l_1,
    Data9=cluster._7_l_2)
merge_2 = Merge(Data1=cluster._2_f, Data2=cluster._3_f, Data3=cluster._4_f)
merge_3 = Merge(
    Data1=cluster._0,
    Data2=cluster._1_r,
    Data3=cluster._2_r,
    Data4=cluster._3_r,
    Data5=cluster._4_r,
    Data6=cluster._5_r,
    Data7=cluster._6_r,
    Data8=cluster._7_r)
l1 = ClusterInput()
ext = ExtendCurve(Curve=merge, Type=0, Start="0", End=l1)
merge_4 = Merge(Data1=ext, Data2=merge_2, Data3=merge_3)
R = ClusterOutput(merge_4)

# ==== cluster Cluster_23
L = ClusterInput()
cluster = Cluster_21(relay=L)  # -> _0, _1_f, _1_r, _2_f, _2_l, _2_r, _3_f, _3_l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
merge = Merge(
    Data1=cluster._1_f,
    Data2=cluster._2_l,
    Data3=cluster._3_l,
    Data4=cluster._4_l,
    Data5=cluster._5_l,
    Data6=cluster._6_l_1,
    Data7=cluster._6_l_2,
    Data8=cluster._7_l_1,
    Data9=cluster._7_l_2)
merge_2 = Merge(Data1=cluster._2_f, Data2=cluster._3_f, Data3=cluster._4_f)
merge_3 = Merge(
    Data1=cluster._0,
    Data2=cluster._1_r,
    Data3=cluster._2_r,
    Data4=cluster._3_r,
    Data5=cluster._4_r,
    Data6=cluster._5_r,
    Data7=cluster._6_r,
    Data8=cluster._7_r)
l0 = ClusterInput()
ext = ExtendCurve(Curve=merge_2, Type=0, Start=l0, End="0")
merge_4 = Merge(Data1=merge, Data2=ext, Data3=merge_3)
R = ClusterOutput(merge_4)

# ==== cluster Cluster_24
pts = ClusterInput()
lng = ListLength(List=pts)
subtraction = Subtraction(A=lng, B="1")
dom = ConstructDomain(DomainStart="2", DomainEnd=subtraction)
subset = SubList(List=pts, Domain=dom, Wrap=True)  # -> simplify(List), Index
out = ClusterOutput(subset.List)

# ==== cluster Cluster_26
L = ClusterInput()
lng = ListLength(List=L)
subtraction = Subtraction(A=lng, B="2")
l0 = ClusterInput()
l0_2 = ClusterInput()
dom = ConstructDomain(DomainStart="1", DomainEnd=subtraction)
first_last = FirstLast(List=L)  # -> FirstValue, LastValue
subset = SubList(List=L, Domain=dom, Wrap=True)  # -> simplify(List), Index
cluster = Cluster_25(C=first_last.FirstValue, l0=l0, T=first_last.LastValue, l1=l0_2)  # -> first, last
ext = ExtendCurve(Curve=subset.List, Type=0, Start=l0, End=expr("-x", l0))
merge = Merge(Data1=cluster.first, Data2=ext, Data3=cluster.last)
out = ClusterOutput(merge)

# ==== cluster Cluster_27
serie = ClusterInput()
room_width = ClusterInput()
division = Division(A=serie, B=room_width)
first_last = FirstLast(List=division)  # -> FirstValue, LastValue
series = Series(Start="1", Step=1, Count=first_last.LastValue)  # -> simplify(graft(Series))
repeat = RepeatData(Data=series, Length=room_width)  # -> flatten(Data)
subtraction = Subtraction(A=division, B=repeat)
abs = Absolute(Value=subtraction)
rythm = ClusterOutput(abs)

# ==== cluster Cluster_29
series = Series(Start=0, Step=1, Count="3")
concat = Concatenate(FragmentA="{", FragmentB=series, FragmentC=";")
shape = ClusterInput()
concat_2 = Concatenate(FragmentA=simplify(graft(concat)), FragmentB=series, FragmentC=";")  # -> simplify(Result)
concat_3 = Concatenate(FragmentA=simplify(graft(concat_2)), FragmentB=shape, FragmentC="}")  # -> simplify(Result)
T = ClusterInput()
wing = ClusterInput()
branch = TreeBranch(Tree=T, Path=concat_3, MaintainPaths=True)
item = ListItem(List=branch, Index=wing, Wrap="False")
clean = CleanTree(RemoveNulls=True, RemoveInvalid=True, RemoveEmpty=False, Tree=item)
wing_2 = ClusterOutput(clean)

# ==== cluster Cluster_31
tree = ClusterInput()
series = Series(Start=0, Step=1, Count="3")
concat = Concatenate(FragmentA="{", FragmentB=series, FragmentC=";")
shape = ClusterInput()
wing = ClusterInput()
concat_2 = Concatenate(FragmentA=simplify(graft(concat)), FragmentB=series, FragmentC=";")  # -> flatten(Result)
concat_3 = Concatenate(FragmentA=simplify(graft(concat_2)), FragmentB=shape, FragmentC=";")  # -> flatten(Result)
concat_4 = Concatenate(FragmentA=simplify(graft(concat_3)), FragmentB=wing, FragmentC="}")  # -> flatten(Result)
branch = TreeBranch(Tree=tree, Path=concat_4, MaintainPaths=True)
clean = CleanTree(RemoveNulls=True, RemoveInvalid=True, RemoveEmpty=False, Tree=branch)
T = ClusterOutput(clean)

# ==== cluster Cluster_35
relay = ClusterInput()
cluster = Cluster_34(T=relay, B="0")
cluster_2 = Cluster_34(T=relay, B="1")
cluster_3 = Cluster_34(T=relay, B="2")
cluster_4 = Cluster_34(T=relay, B="3")
cluster_5 = Cluster_34(T=relay, B="4")
cluster_6 = Cluster_34(T=relay, B="5")
cluster_7 = Cluster_34(T=relay, B="6")
cluster_8 = Cluster_34(T=relay, B="7")
B = ClusterOutput(cluster)
B_2 = ClusterOutput(cluster_2)
B_3 = ClusterOutput(cluster_3)
B_4 = ClusterOutput(cluster_4)
B_5 = ClusterOutput(cluster_5)
B_6 = ClusterOutput(cluster_6)
B_7 = ClusterOutput(cluster_7)
B_8 = ClusterOutput(cluster_8)

# ==== cluster Cluster_7
relay = ClusterInput()
cluster = Cluster_6(scenario="0", wing="0", lines=relay)
cluster_2 = Cluster_5(scenario="1", wing="1", lines=relay, f_l="1")  # -> R, B
cluster_3 = Cluster_6(scenario="1", wing="0", lines=relay)
_0 = ClusterOutput(cluster)
_1_f = ClusterOutput(cluster_2.B)
merge = Merge(Data1=cluster_2.R, Data2=cluster_3)
cluster_4 = Cluster_5(scenario="2", wing="0", lines=relay, f_l="0")  # -> R, B
cluster_5 = Cluster_5(scenario="2", wing="2", lines=relay, f_l="1")  # -> R, B
cluster_6 = Cluster_6(scenario="2", wing="1", lines=relay)
_1_r = ClusterOutput(merge)
_2_f = ClusterOutput(cluster_4.B)
_2_l = ClusterOutput(cluster_5.B)
merge_2 = Merge(Data1=cluster_4.R, Data2=cluster_5.R, Data3=cluster_6)
cluster_7 = Cluster_5(scenario="3", wing="0", lines=relay, f_l="0")  # -> R, B
cluster_8 = Cluster_5(scenario="3", wing="2", lines=relay, f_l="1")  # -> R, B
_2_r = ClusterOutput(merge_2)
cluster_9 = Cluster_6(scenario="3", wing="1", lines=relay)
merge_3 = Merge(Data1=cluster_7.R, Data2=cluster_8.R, Data3=cluster_9)
_3_l = ClusterOutput(cluster_8.B)
_3_f = ClusterOutput(cluster_7.B)
cluster_10 = Cluster_5(scenario="4", wing="0", lines=relay, f_l="0")  # -> R, B
cluster_11 = Cluster_5(scenario="4", wing="3", lines=relay, f_l="1")  # -> R, B
cluster_12 = Cluster_6(scenario="4", wing="1", lines=relay)
cluster_13 = Cluster_6(scenario="4", wing="2", lines=relay)
_3_r = ClusterOutput(merge_3)
_4_l = ClusterOutput(cluster_11.B)
merge_4 = Merge(Data1=cluster_10.R, Data2=cluster_11.R, Data3=cluster_12, Data4=cluster_13)
_4_f = ClusterOutput(cluster_10.B)
_4_r = ClusterOutput(merge_4)
cluster_14 = Cluster_5(scenario="5", wing="1", lines=relay, f_l="1")  # -> R, B
cluster_15 = Cluster_6(scenario="5", wing="0", lines=relay)
merge_5 = Merge(Data1=cluster_14.R, Data2=cluster_15)
_5_l = ClusterOutput(cluster_14.B)
_5_r = ClusterOutput(merge_5)
cluster_16 = Cluster_5(scenario="6", wing="1", lines=relay, f_l="1")  # -> R, B
cluster_17 = Cluster_5(scenario="6", wing="2", lines=relay, f_l="1")  # -> R, B
cluster_18 = Cluster_6(scenario="6", wing="0", lines=relay)
merge_6 = Merge(Data1=cluster_16.R, Data2=cluster_17.R, Data3=cluster_18)
_6_l_1 = ClusterOutput(cluster_16.B)
_6_l_2 = ClusterOutput(cluster_17.B)
_6_r = ClusterOutput(merge_6)
cluster_19 = Cluster_5(scenario="7", wing="2", lines=relay, f_l="1")  # -> R, B
cluster_20 = Cluster_5(scenario="7", wing="1", lines=relay, f_l="1")  # -> R, B
cluster_21 = Cluster_6(scenario="7", wing="0", lines=relay)
cluster_22 = Cluster_6(scenario="7", wing="3", lines=relay)
merge_7 = Merge(Data1=cluster_20.R, Data2=cluster_19.R, Data3=cluster_21, Data4=cluster_22)
_7_l_1 = ClusterOutput(cluster_20.B)
_7_l_2 = ClusterOutput(cluster_19.B)
_7_r = ClusterOutput(merge_7)

# ==== cluster Cluster_12
T = ClusterInput()
T_2 = ClusterInput()
cluster = Cluster_11(B=["2", "3"], T=T, B_2=["0", "1"])
cluster_2 = Cluster_11(B="4", T=T, B_2="3")
cluster_3 = Cluster_11(B="4", T=T, B_2=["0", "1", "2"])
cluster_4 = Cluster_11(B=["2", "3"], T=T, B_2="2")
cluster_5 = Cluster_11(B=["1", "5", "6", "7"], T=T, B_2=["0", "3"])
cluster_6 = Cluster_11(B=["1", "5", "6", "7"], T=T, B_2=["1", "2"])
cluster_7 = Cluster_11(B=["2", "3", "4"], T=T_2, B_2="0")
cluster_8 = Cluster_11(B=["2", "3", "4"], T=T_2, B_2=["1", "2", "3"])
cluster_9 = Cluster_11(B="0", T=T, B_2="0")
cluster_10 = Cluster_11(B=["0", "1", "5", "6", "7"], T=T_2, B_2=["0", "1", "2", "3"])
l0 = ClusterInput()
merge = Merge(Data1=cluster_6, Data2=cluster_4, Data3=cluster_2)
ext = ExtendCurve(Curve=cluster_7, Type=0, Start=expr("-x", l0), End="0")
ext_2 = ExtendCurve(Curve=merge, Type=0, Start="0", End=expr("-x", l0))
merge_2 = Merge(Data1=ext_2, Data2=cluster_5, Data3=cluster, Data4=cluster_3, Data5=cluster_9)
merge_3 = Merge(Data1=cluster_10, Data2=ext, Data3=cluster_8)
ext_3 = ExtendCurve(Curve=merge_3, Type=0, Start="0", End=expr("-x", "0.1"))
ext_4 = ExtendCurve(Curve=merge_2, Type=0, Start="0.1", End="0")
clean = CleanTree(RemoveNulls=True, RemoveInvalid=True, RemoveEmpty=False, Tree=ext_4)
clean_2 = CleanTree(RemoveNulls=True, RemoveInvalid=True, RemoveEmpty=False, Tree=ext_3)
prune = PruneTree(Tree=clean_2, Minimum="1", Maximum=0)
prune_2 = PruneTree(Tree=clean, Minimum="1", Maximum=0)
first = ClusterOutput(prune)
last = ClusterOutput(prune_2)

# ==== cluster Cluster_16
relay = ClusterInput()
cluster = Cluster_6(scenario="0", wing="0", lines=relay)
cluster_2 = Cluster_5(scenario="1", wing="1", lines=relay, f_l="1")  # -> R, B
cluster_3 = Cluster_6(scenario="1", wing="0", lines=relay)
_0 = ClusterOutput(cluster)
_1_f = ClusterOutput(cluster_2.B)
merge = Merge(Data1=cluster_2.R, Data2=cluster_3)
cluster_4 = Cluster_5(scenario="2", wing="0", lines=relay, f_l="0")  # -> R, B
cluster_5 = Cluster_5(scenario="2", wing="2", lines=relay, f_l="1")  # -> R, B
cluster_6 = Cluster_6(scenario="2", wing="1", lines=relay)
_1_r = ClusterOutput(merge)
_2_f = ClusterOutput(cluster_4.B)
_2_l = ClusterOutput(cluster_5.B)
merge_2 = Merge(Data1=cluster_4.R, Data2=cluster_5.R, Data3=cluster_6)
cluster_7 = Cluster_5(scenario="3", wing="0", lines=relay, f_l="0")  # -> R, B
cluster_8 = Cluster_5(scenario="3", wing="2", lines=relay, f_l="1")  # -> R, B
_2_r = ClusterOutput(merge_2)
cluster_9 = Cluster_6(scenario="3", wing="1", lines=relay)
merge_3 = Merge(Data1=cluster_7.R, Data2=cluster_8.R, Data3=cluster_9)
_3_l = ClusterOutput(cluster_8.B)
_3_f = ClusterOutput(cluster_7.B)
cluster_10 = Cluster_5(scenario="4", wing="0", lines=relay, f_l="0")  # -> R, B
cluster_11 = Cluster_5(scenario="4", wing="3", lines=relay, f_l="1")  # -> R, B
cluster_12 = Cluster_6(scenario="4", wing="1", lines=relay)
cluster_13 = Cluster_6(scenario="4", wing="2", lines=relay)
_3_r = ClusterOutput(merge_3)
merge_4 = Merge(Data1=cluster_10.R, Data2=cluster_11.R, Data3=cluster_12, Data4=cluster_13)
_4_l = ClusterOutput(cluster_11.B)
_4_f = ClusterOutput(cluster_10.B)
cluster_14 = Cluster_5(scenario="5", wing="1", lines=relay, f_l="1")  # -> R, B
_4_r = ClusterOutput(merge_4)
cluster_15 = Cluster_6(scenario="5", wing="0", lines=relay)
merge_5 = Merge(Data1=cluster_14.R, Data2=cluster_15)
_5_l = ClusterOutput(cluster_14.B)
_5_r = ClusterOutput(merge_5)
cluster_16 = Cluster_5(scenario="6", wing="1", lines=relay, f_l="1")  # -> R, B
cluster_17 = Cluster_5(scenario="6", wing="2", lines=relay, f_l="1")  # -> R, B
cluster_18 = Cluster_6(scenario="6", wing="0", lines=relay)
merge_6 = Merge(Data1=cluster_16.R, Data2=cluster_17.R, Data3=cluster_18)
_6_l_1 = ClusterOutput(cluster_16.B)
_6_l_2 = ClusterOutput(cluster_17.B)
_6_r = ClusterOutput(merge_6)
cluster_19 = Cluster_5(scenario="7", wing="2", lines=relay, f_l="1")  # -> R, B
cluster_20 = Cluster_5(scenario="7", wing="1", lines=relay, f_l="1")  # -> R, B
cluster_21 = Cluster_6(scenario="7", wing="0", lines=relay)
cluster_22 = Cluster_6(scenario="7", wing="3", lines=relay)
merge_7 = Merge(Data1=cluster_20.R, Data2=cluster_19.R, Data3=cluster_21, Data4=cluster_22)
_7_l_1 = ClusterOutput(cluster_20.B)
_7_l_2 = ClusterOutput(cluster_19.B)
_7_r = ClusterOutput(merge_7)

# ==== cluster Cluster_19
relay = ClusterInput()
cluster = Cluster_11(B=["2", "3", "4"], T=relay, B_2="0")
cluster_2 = Cluster_11(B=["2", "3", "4"], T=relay, B_2=["1", "2", "3"])
cluster_3 = Cluster_11(B=["0", "1", "5", "6", "7"], T=relay, B_2=["0", "1", "2", "3"])
l0 = ClusterInput()
l0_2 = ClusterInput()
C = ClusterInput()
ext = ExtendCurve(Curve=cluster, Type=0, Start=expr("-x", l0), End="0")
ext_2 = ExtendCurve(Curve=C, Type=0, Start=l0_2, End=expr("-x", l0_2))
merge = Merge(Data1=cluster_3, Data2=ext, Data3=cluster_2)
last = ClusterOutput(ext_2)
ext_3 = ExtendCurve(Curve=merge, Type=0, Start="0", End=expr("-x", l0_2))
clean = CleanTree(RemoveNulls=True, RemoveInvalid=True, RemoveEmpty=False, Tree=ext_3)
prune = PruneTree(Tree=clean, Minimum="1", Maximum=0)
first = ClusterOutput(prune)

# ==== cluster Cluster_21
relay = ClusterInput()
cluster = Cluster_6(scenario="0", wing="0", lines=relay)
cluster_2 = Cluster_5(scenario="1", wing="1", lines=relay, f_l="1")  # -> R, B
cluster_3 = Cluster_6(scenario="1", wing="0", lines=relay)
_0 = ClusterOutput(cluster)
_1_f = ClusterOutput(cluster_2.B)
merge = Merge(Data1=cluster_2.R, Data2=cluster_3)
cluster_4 = Cluster_5(scenario="2", wing="0", lines=relay, f_l="0")  # -> R, B
cluster_5 = Cluster_5(scenario="2", wing="2", lines=relay, f_l="1")  # -> R, B
cluster_6 = Cluster_6(scenario="2", wing="1", lines=relay)
_1_r = ClusterOutput(merge)
_2_f = ClusterOutput(cluster_4.B)
_2_l = ClusterOutput(cluster_5.B)
merge_2 = Merge(Data1=cluster_4.R, Data2=cluster_5.R, Data3=cluster_6)
cluster_7 = Cluster_5(scenario="3", wing="0", lines=relay, f_l="0")  # -> R, B
cluster_8 = Cluster_5(scenario="3", wing="2", lines=relay, f_l="1")  # -> R, B
_2_r = ClusterOutput(merge_2)
cluster_9 = Cluster_6(scenario="3", wing="1", lines=relay)
merge_3 = Merge(Data1=cluster_7.R, Data2=cluster_8.R, Data3=cluster_9)
_3_l = ClusterOutput(cluster_8.B)
_3_f = ClusterOutput(cluster_7.B)
cluster_10 = Cluster_5(scenario="4", wing="0", lines=relay, f_l="0")  # -> R, B
cluster_11 = Cluster_5(scenario="4", wing="3", lines=relay, f_l="1")  # -> R, B
cluster_12 = Cluster_6(scenario="4", wing="1", lines=relay)
cluster_13 = Cluster_6(scenario="4", wing="2", lines=relay)
_3_r = ClusterOutput(merge_3)
merge_4 = Merge(Data1=cluster_10.R, Data2=cluster_11.R, Data3=cluster_12, Data4=cluster_13)
_4_l = ClusterOutput(cluster_11.B)
_4_f = ClusterOutput(cluster_10.B)
_4_r = ClusterOutput(merge_4)
cluster_14 = Cluster_5(scenario="5", wing="1", lines=relay, f_l="1")  # -> R, B
cluster_15 = Cluster_6(scenario="5", wing="0", lines=relay)
merge_5 = Merge(Data1=cluster_14.R, Data2=cluster_15)
_5_l = ClusterOutput(cluster_14.B)
_5_r = ClusterOutput(merge_5)
cluster_16 = Cluster_5(scenario="6", wing="1", lines=relay, f_l="1")  # -> R, B
cluster_17 = Cluster_5(scenario="6", wing="2", lines=relay, f_l="1")  # -> R, B
cluster_18 = Cluster_6(scenario="6", wing="0", lines=relay)
merge_6 = Merge(Data1=cluster_16.R, Data2=cluster_17.R, Data3=cluster_18)
_6_l_1 = ClusterOutput(cluster_16.B)
_6_l_2 = ClusterOutput(cluster_17.B)
_6_r = ClusterOutput(merge_6)
cluster_19 = Cluster_5(scenario="7", wing="2", lines=relay, f_l="1")  # -> R, B
cluster_20 = Cluster_5(scenario="7", wing="1", lines=relay, f_l="1")  # -> R, B
cluster_21 = Cluster_6(scenario="7", wing="0", lines=relay)
cluster_22 = Cluster_6(scenario="7", wing="3", lines=relay)
merge_7 = Merge(Data1=cluster_20.R, Data2=cluster_19.R, Data3=cluster_21, Data4=cluster_22)
_7_l_1 = ClusterOutput(cluster_20.B)
_7_l_2 = ClusterOutput(cluster_19.B)
_7_r = ClusterOutput(merge_7)

# ==== cluster Cluster_25
T = ClusterInput()
cluster = Cluster_11(B=["2", "3"], T=T, B_2=["0", "1"])
cluster_2 = Cluster_11(B="4", T=T, B_2="3")
cluster_3 = Cluster_11(B="4", T=T, B_2=["0", "1", "2"])
cluster_4 = Cluster_11(B=["2", "3"], T=T, B_2="2")
cluster_5 = Cluster_11(B=["1", "5", "6", "7"], T=T, B_2=["0", "3"])
cluster_6 = Cluster_11(B=["1", "5", "6", "7"], T=T, B_2=["1", "2"])
cluster_7 = Cluster_11(B="0", T=T, B_2="0")
merge = Merge(Data1=cluster_6, Data2=cluster_4, Data3=cluster_2)
l1 = ClusterInput()
ext = ExtendCurve(Curve=merge, Type=0, Start="0", End=expr("-x", l1))
merge_2 = Merge(Data1=ext, Data2=cluster_5, Data3=cluster, Data4=cluster_3, Data5=cluster_7)
C = ClusterInput()
l0 = ClusterInput()
ext_2 = ExtendCurve(Curve=merge_2, Type=0, Start=l0, End="0")
ext_3 = ExtendCurve(Curve=C, Type=0, Start=expr("-x", l0), End=expr("-x", l0))
clean = CleanTree(RemoveNulls=True, RemoveInvalid=True, RemoveEmpty=False, Tree=ext_2)
first = ClusterOutput(ext_3)
prune = PruneTree(Tree=clean, Minimum="1", Maximum=0)
last = ClusterOutput(prune)

# ==== cluster Cluster_34
B = ClusterInput()
series = Series(Start=0, Step=1, Count="3")
concat = Concatenate(FragmentA="{", FragmentB=series, FragmentC=";")  # -> flatten(Result)
concat_2 = Concatenate(FragmentA=simplify(graft(concat)), FragmentB=series, FragmentC=";")  # -> flatten(Result)
concat_3 = Concatenate(FragmentA=simplify(graft(concat_2)), FragmentB=B, FragmentC=";")  # -> flatten(Result)
T = ClusterInput()
concat_4 = Concatenate(FragmentA=simplify(graft(concat_3)), FragmentB=series, FragmentC=";")  # -> flatten(Result)
series_2 = Series(Start=0, Step=1, Count="4")
concat_5 = Concatenate(FragmentA=simplify(graft(concat_4)), FragmentB=series, FragmentC=";")  # -> flatten(Result)
concat_6 = Concatenate(FragmentA=simplify(graft(concat_5)), FragmentB=series_2, FragmentC="}")  # -> flatten(Result)
branch = TreeBranch(Tree=T, Path=concat_6, MaintainPaths=True)
B_2 = ClusterOutput(branch)

# ==== cluster Cluster_5
scenario = ClusterInput()
wing = ClusterInput()
lines = ClusterInput()
f_l = ClusterInput()
series = Series(Start=0, Step=1, Count="3")
lng = ListLength(List=lines)
first_last = FirstLast(List=lines)  # -> FirstValue, LastValue
subtraction = Subtraction(A=lng, B="2")
concat = Concatenate(FragmentA="{", FragmentB=series, FragmentC=";")  # -> simplify(graft(Result))
merge = Merge(Data1=first_last.FirstValue, Data2=first_last.LastValue)
subtraction_2 = Subtraction(A=f_l, B="1")
dom = ConstructDomain(DomainStart="1", DomainEnd=subtraction)
concat_2 = Concatenate(FragmentA=concat, FragmentB=series, FragmentC=";")  # -> simplify(graft(Result))
item = ListItem(List=merge, Index=subtraction_2, Wrap=True)
item_2 = ListItem(List=merge, Index=f_l, Wrap=True)
subset = SubList(List=lines, Domain=dom, Wrap=True)  # -> List, Index
concat_3 = Concatenate(FragmentA=concat_2, FragmentB=scenario, FragmentC=";", FragmentD=series, FragmentE=";", FragmentF=wing, FragmentG="}")  # -> flatten(Result)
merge_2 = Merge(Data1=simplify(subset.List), Data2=item)
branch = TreeBranch(Tree=merge_2, Path=concat_3, MaintainPaths=True)
branch_2 = TreeBranch(Tree=item_2, Path=concat_3, MaintainPaths=True)
R = ClusterOutput(branch)
B = ClusterOutput(branch_2)

# ==== cluster Cluster_6
scenario = ClusterInput()
wing = ClusterInput()
series = Series(Start=0, Step=1, Count="3")
concat = Concatenate(FragmentA="{", FragmentB=series, FragmentC=";")  # -> simplify(graft(Result))
concat_2 = Concatenate(FragmentA=concat, FragmentB=series, FragmentC=";")  # -> simplify(graft(Result))
concat_3 = Concatenate(FragmentA=concat_2, FragmentB=scenario, FragmentC=";", FragmentD=series, FragmentE=";")  # -> simplify(graft(Result))
concat_4 = Concatenate(FragmentA=concat_2, FragmentB=scenario, FragmentC=";", FragmentD=series, FragmentE=";", FragmentF=wing, FragmentG="}")  # -> flatten(Result)
lines = ClusterInput()
branch = TreeBranch(Tree=lines, Path=concat_4, MaintainPaths=True)
R = ClusterOutput(branch)

# ==== cluster Cluster_11
series = Series(Start=0, Step=1, Count="3")
concat = Concatenate(FragmentA="{", FragmentB=series, FragmentC=";")  # -> simplify(graft(Result))
concat_2 = Concatenate(FragmentA=concat, FragmentB=series, FragmentC=";")  # -> simplify(graft(Result))
B = ClusterInput()
concat_3 = Concatenate(FragmentA=concat_2, FragmentB=B, FragmentC=";")  # -> simplify(graft(Result))
concat_4 = Concatenate(FragmentA=concat_3, FragmentB=series, FragmentC=";")  # -> simplify(graft(Result))
B_2 = ClusterInput()
concat_5 = Concatenate(FragmentA=concat_4, FragmentB=B_2, FragmentC="}")  # -> flatten(Result)
T = ClusterInput()
branch = TreeBranch(Tree=T, Path=concat_5, MaintainPaths=True)
out = ClusterOutput(branch)
